# Grasshopper definition solar analisis.gh (Grasshopper 1.0.8)
# plug-ins: Pufferfish, LunchBox

geometry_pipeline = GeometryPipeline(
    GroupByLayer=False,
    GroupByType=False,
    IncludeHidden=True,
    IncludeLocked=True,
    LayerFilter="okoli",
    NameFilter="*",
    SublayerFiltering=True,
    TypeFilter=32)
# INPUT
# GEOMETRIE
geometry_pipeline_2 = GeometryPipeline(
    GroupByLayer=False,
    GroupByType=False,
    IncludeHidden=True,
    IncludeLocked=True,
    LayerFilter="budova",
    NameFilter="*",
    SublayerFiltering=True,
    TypeFilter=32)
geometry = Geometry(geometry_pipeline)
geometry_2 = Geometry(geometry_pipeline_2)

# ---- group: Hong Kong
file_path = FilePath("C:\Users\geftg\Desktop\dp2\reserse analysis\JOCKEY CLUB INNOVATION TOWER (POLYU SCHOOL OF DESIGN)\HKG_KOW_Hong.Kong.Obs.450050_TMYx.epw")

# ---- group: klementinum
file_path_2 = FilePath("C:\Users\geftg\Desktop\dp2\praha epw\CZE_PM_Praha-Karlov-Klementinum.115190_TMYx.epw")  # disabled

# ----
# MAX TEPLOTA DNE
max_teplota_ve_dni = Slider(19, range=10..20)

# ----
# LOKACE
importepw = LBImportEPW(epw_file=file_path)  # -> location, dry_bulb_temperature, dew_point_temperature, relative_humidity, wind_speed, wind_direction, direct_normal_rad, diffuse_horizontal_rad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; plug-in component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

number_slider = Slider(10, range=10..100)  # disabled
curve = Curve(<curve referenced from the Rhino model>)  # disabled

mesh_join = MeshJoin(Meshes=geometry_2)
kvalita_obal_hmoty = Slider(3, range=1..10)
# OBALOVÁ HMOTA
bounding_box = BoundingBox(Content=mesh_join, Plane=PlaneXY(0, 0, 0))  # -> Box, Box_2
# OBALUJÍCÍ HMOTA
brep = Brep(bounding_box.Box)
triremesh = TriRemesh(Geometry=brep, Target=mesh_join, Length=kvalita_obal_hmoty, Iterations=25)  # -> Triangulation, Dual, Creases

close_curve = CloseCurve(Curve=curve, CloseType=0, Bulge=0.5, Tolerance=0)  # -> Closed, ResultBoolean; disabled
unit_z = UnitZ(Factor=number_slider)  # disabled
panel = Panel("-10")  # disabled
multiplication = Multiplication(A=unit_z, B=panel)  # disabled
extrude = Extrude(Base=close_curve.Closed, Direction=unit_z)  # disabled
extrude_2 = Extrude(Base=close_curve.Closed, Direction=multiplication)  # disabled

subd_from_mesh = SubDFromMesh(Mesh=triremesh.Triangulation, Creases=1, Corners=1, Interpolate=False)
# VYHLAZENÍ
vyhlazení = Slider(1, range=0..5)
mesh_from_subd = MeshFromSubD(SubD=subd_from_mesh, Density=vyhlazení)

merge = Merge(Data1=extrude, Data2=extrude_2)  # disabled
geometry_3 = Geometry()  # disabled

# ----
# CELÝ ROK
analysisperiod = LBAnalysisPeriod(
    start_month=Slider(1, range=1..12),
    start_day=1,
    start_hour=0,
    end_month=Slider(12, range=1..12),
    end_day=Slider(31, range=0..31),
    end_hour=Slider(23, range=0..23))  # -> period, hoys, dates; plug-in component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

xdata = LBDeconstructData(data=importepw.dew_point_temperature)  # -> header, values; plug-in component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
den = Panel("24")
partition_list = PartitionList(List=xdata.values, Size=den)
sort_list = SortList(Keys=partition_list, ValuesValuesA=partition_list)  # -> Keys, ValuesValuesA
subtraction = Subtraction(A=den, B=1)
# OBDOBÍ
list_item = ListItem(List=sort_list.Keys, Index=subtraction, Wrap=True)  # -> flatten(Item)
# DNY NAD x °C
larger_than = LargerThan(FirstNumber=list_item, SecondNumber=max_teplota_ve_dni)  # -> LargerThan, OrEqualTo
duplicate_data = DuplicateData(Data=larger_than.LargerThan, Number=den, Order=True)
dispatch = Dispatch(List=analysisperiod.hoys, DispatchPattern=duplicate_data)  # -> ListA, ListB

mesh = Mesh(<mesh referenced from the Rhino model>)  # disabled
brep_join = BrepJoin(Breps=merge)  # -> Breps, Closed; disabled
mesh_split = MeshSplit(Mesh=mesh, Splitters=brep_join.Breps)  # disabled
deconstruct_mesh = DeconstructMesh(Mesh=mesh_split)  # -> Vertices, Faces, Colours, Normals; disabled

# ----
# REDUKCE KOMPLEXNOSTI
panel_2 = Panel("10000")
reduce_mesh = ReduceMesh(Mesh=mesh_from_subd, FaceCount=panel_2, Accuracy="10", FaceType=0, Distort=True, Normalize=False)  # -> Reduced, CountDifference
mesh_2 = Mesh(reduce_mesh.Reduced)

list_length = ListLength(List=deconstruct_mesh.Faces)  # -> flatten(Length); disabled
sort_list_2 = SortList(Keys=list_length, ValuesValuesA=mesh_split)  # -> Keys, ValuesValuesA; disabled
number_slider_2 = Slider(933, range=0..1000)  # disabled
sub_list = SubList(List=sort_list_2.ValuesValuesA, Wrap=True)  # -> List, Index; disabled

point = Point(Point(-707798.0382, 104040.6802, 216367.3504))
# PAPRSKY
sunpath = LBSunPath(location=importepw.location, hoys=dispatch.ListA, center_pt=point, scale=1)  # -> out, vectors, altitudes, azimuths, hoys, sun_pts, analemma, daily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; plug-in component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

list_item_2 = ListItem(List=sort_list_2.ValuesValuesA, Index=number_slider_2, Wrap=True)  # disabled

point_2 = Point(Point(-1001.181201, 92.94235857, 388.8535168))
xy_plane = XYPlane(Origin=point_2)
font = Font(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)
# LEGENDA
legendpar = LBLegendParameters(base_plane=xy_plane, font=font)  # -> leg_par; plug-in component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

# ----
# ANALÝZA
number_slider_3 = Slider(10, range=1..20)
# SOLÁRNÍ ANALÝZA
directsunhours = LBDirectSunHours(
    vectors=flatten(sunpath.vectors),
    geometry=flatten(mesh_2),
    context=flatten(geometry),
    grid_size=number_slider_3,
    offset_dist=Slider(1, range=1..100),
    legend_par=legendpar,
    run=Toggle(True))  # -> out, points, results, mesh, legend, title, int_mtx; plug-in component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

mesh_3 = Mesh(directsunhours.mesh)
# EXPORT
c_script = CSharpScript(mesh=directsunhours.mesh)  # -> r_mesh, r_color, r_names; inputs mesh: Mesh
# ---------- c_script: C# ----------
#region Usings
using System;
using System.Linq;
using System.Collections;
using System.Collections.Generic;
using System.Drawing;

using Rhino;
using Rhino.Geometry;

using Grasshopper;
using Grasshopper.Kernel;
using Grasshopper.Kernel.Data;
using Grasshopper.Kernel.Types;
#endregion

public class Script_Instance : GH_ScriptInstance {
    static Mesh _mesh;
    private void RunScript(
		Mesh mesh,
		ref object r_mesh,
		ref object r_color,
		ref object r_names) {
        _mesh=mesh;
        List<(Color,List<MeshFace>)> cols=new List<(Color,List<MeshFace>)>();
        
        foreach (MeshFace m in mesh.Faces) {
            Color c=FaceColor(m);
            bool exists=false;
            foreach ((Color,List<MeshFace>) e in cols) {
                if (e.Item1==c){
                    exists=true;
                    e.Item2.Add(m);
                    break;
                }
            }
            if (!exists) {
                cols.Add((c, new List<MeshFace>{m}));
            }
        }

        List<Mesh> meshes=new List<Mesh>();
        List<Color> colours=new List<Color>();
        List<string> names=new List<string>();
    
        int fi=0;
        foreach ((Color,List<MeshFace>) e in cols) {
            Mesh m=new Mesh();

            //m.Vertices.AddVertices(mesh.Vertices);
            foreach (MeshFace n in e.Item2) {
                int baseIndex = m.Vertices.Count;

                m.Vertices.Add(mesh.Vertices[n.A]);
                m.Vertices.Add(mesh.Vertices[n.B]);
                m.Vertices.Add(mesh.Vertices[n.C]);
                if (n.IsQuad) m.Vertices.Add(mesh.Vertices[n.D]);
                
                m.Normals.Add(mesh.Normals[n.A]);
                m.Normals.Add(mesh.Normals[n.B]);
                m.Normals.Add(mesh.Normals[n.C]);
                if (n.IsQuad) m.Normals.Add(mesh.Normals[n.D]);

                 if (n.IsQuad) m.Faces.AddFace(baseIndex, baseIndex + 1, baseIndex + 2, baseIndex + 3);
                else m.Faces.AddFace(baseIndex, baseIndex + 1, baseIndex + 2);
            }
           // foreach (Vector3d n in mesh.Normals) m.Normals.Add(n);
          //  m.Faces.AddFaces(e.Item2);
            //m.Compact();

            names.Add("building"+fi);fi++;
            meshes.Add(m);
            colours.Add(e.Item1);
        }

        r_mesh = meshes;
        r_color = colours;
        r_names = names;
    }

    Color FaceColor(MeshFace m){
        int firtstVerIndex=m.A;
        Color c=_mesh.VertexColors[firtstVerIndex];
        return c;
    }
}
# ---------- end c_script ----------
# EXPORT
boolean_toggle = BooleanToggle(False)
object_bake = ObjectBake(
    BakeToggle=boolean_toggle,
    GeometryObjects=c_script.r_mesh,
    Layer="baked",
    ObjectName=c_script.r_names,
    ObjectColor=c_script.r_color,
    LayerColor=RGB(255, 255, 255))
