# Grasshopper definition digitalni.gh (Grasshopper 1.0.8)
# plug-ins: NodeFasade, Pufferfish, Rhino.Inside for Autodesk Revit

geometry_pipeline = GeometryPipeline(
    GroupByLayer=False,
    GroupByType=False,
    IncludeHidden=True,
    IncludeLocked=True,
    LayerFilter="navrh::fasady::balkonova",
    NameFilter="*",
    SublayerFiltering=True,
    TypeFilter=1073741848)
# NASTAVENÍ GEOMETRIE
geometry_pipeline_2 = GeometryPipeline(
    GroupByLayer=False,
    GroupByType=False,
    IncludeHidden=True,
    IncludeLocked=True,
    LayerFilter="navrh::fasady::spodek",
    NameFilter="*",
    SublayerFiltering=True,
    TypeFilter=1073741848)
# VSTUPNÍ GEOMETRIE
geometry_pipeline_3 = GeometryPipeline(
    GroupByLayer=False,
    GroupByType=False,
    IncludeHidden=True,
    IncludeLocked=True,
    LayerFilter="navrh::fasady::main",
    NameFilter="*",
    SublayerFiltering=True,
    TypeFilter=1073741848)
merge = Merge(Data1=geometry_pipeline_3, Data2=geometry_pipeline, Data3=geometry_pipeline_2)

# ----
# VELIKOST JEDNOTKY
modul = Slider(417, range=100..500)  # disabled
number = Number("358")

# ----
# VYTVOŘENÍ PANELŮ FASÁDY
brep_join = BrepJoin(Breps=merge)  # -> Breps, Closed

geometry_pipeline_4 = GeometryPipeline(
    GroupByLayer=False,
    GroupByType=False,
    IncludeHidden=True,
    IncludeLocked=True,
    LayerFilter="navrh::stena_spolecna",
    NameFilter="*",
    SublayerFiltering=True,
    TypeFilter=1073741848)
geometry_pipeline_5 = GeometryPipeline(
    GroupByLayer=False,
    GroupByType=False,
    IncludeHidden=True,
    IncludeLocked=True,
    LayerFilter="navrh::strecha",
    NameFilter="*",
    SublayerFiltering=True,
    TypeFilter=1073741848)
geometry = Geometry([<mesh referenced from the Rhino model> x23])

division = Division(A=number, B=2)

cluster = Cluster_2(brep=brep_join.Breps, number=number)
vnitřní_dělelí_elementů = Slider(1, range=1..4)
vnitřní_odsazení = Slider(0, range=0..1)
okraje_elementů = Slider(0, range=0..1)
kvalita = Slider(1, range=0..1)
meshbuilder = MeshBuilder(
    Nodes=cluster,
    Type=kvalita,
    Len=number,
    Divide=vnitřní_dělelí_elementů,
    Border=okraje_elementů,
    Spacing=vnitřní_odsazení)
cluster_2 = Cluster_3(mesh=meshbuilder)

# ----
# CESTA K SOUBORU
# DAT POČASÍ
file_path = FilePath("C:\Users\geftg\Desktop\dp2\praha epw\CZE_PM_Praha-Karlov-Klementinum.115190_TMYx.epw")
importepw = LBImportEPW(epw_file=file_path)  # -> location, dry_bulb_temperature, dew_point_temperature, relative_humidity, wind_speed, wind_direction, direct_normal_rad, diffuse_horizontal_rad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; plug-in component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

# ----
# STÍNÍCÍ ZÁSTAVBA
merge_2 = Merge(Data1=geometry_pipeline_5, Data2=geometry_pipeline_4)
# SOLÁRNÍ ANALÝZA
panel = Panel("true")
clean_tree = CleanTree(RemoveNulls=panel, RemoveInvalid=panel, RemoveEmpty=panel, Tree=geometry)
merge_3 = Merge(Data1=clean_tree, Data2=merge_2)

panel_2 = Panel("417")  # disabled

# ----
# ANALYZOVANÁ GEOMETRIE
# SOLÁRNÍ EXPOZICE
# LOKACE
# KRITICKÉ OBDOBÍ
analysisperiod = LBAnalysisPeriod(start_month=Slider(1, range=1..12), start_day=1, start_hour=0, end_month=Slider(6, range=1..12), end_day="31")  # -> period, hoys, dates; plug-in component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

point = Point(Point(-684777.9215, 99944.19086, 212665.107))
xy_plane = XYPlane(Origin=point)
# LEGENDA
legendpar = LBLegendParameters(vert_or_horiz=xy_plane, base_plane=xy_plane)  # -> leg_par; plug-in component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

# ---- group: ref pt south s=1
geometry_2 = Geometry(<surface referenced from the Rhino model>)

# ----
merge_4 = Merge(Data1=brep_join.Breps, Data2=geometry_2)

skymatrix = LBCumulativeSkyMatrix(
    location=importepw.location,
    direct_rad=importepw.direct_normal_rad,
    diffuse_rad=importepw.diffuse_horizontal_rad,
    hoys=analysisperiod.hoys)  # -> out, sky_mtx; plug-in component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
number_slider = Slider(1000, range=1..10000)
incidentradiation = LBIncidentRadiation(
    sky_mtx=skymatrix.sky_mtx,
    geometry=flatten(merge_4),
    context=flatten(merge_3),
    grid_size=number_slider,
    offset_dist=Slider(1, range=1..10000),
    legend_par=legendpar,
    run=Toggle(True))  # -> out, points, results, total, mesh, legend, title, int_mtx; plug-in component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

point_2 = Point(Point(-707798.0382, 104040.6802, 216367.3504))  # disabled
sunpath = LBSunPath(location=importepw.location, hoys=analysisperiod.hoys, center_pt=point_2, scale=1)  # -> out, vectors, altitudes, azimuths, hoys, sun_pts, analemma, daily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; disabled; plug-in component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
boolean_toggle = BooleanToggle(True)  # disabled
boolean_toggle_2 = BooleanToggle(False)  # disabled
directsunhours = LBDirectSunHours(
    vectors=flatten(sunpath.vectors),
    geometry=flatten(merge_4),
    context=flatten(merge_3),
    grid_size=number_slider,
    geo_block=boolean_toggle,
    legend_par=legendpar,
    run=boolean_toggle_2)  # -> out, points, results, mesh, legend, title, int_mtx; disabled; plug-in component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

# ----
# HODNOTA IDEÁLNÍ JIHU = MAXIMUM
assign_values_to_surfs = CSharpScript(surfs=geometry_2, ptsA=incidentradiation.points, ptsV=incidentradiation.results)  # -> max; inputs surfs: list of Surface, ptsA: list of Point3d, ptsV: list of Double
# ---------- assign_values_to_surfs: C# ----------
// Grasshopper Script Instance
#region Usings
using System;
using System.Linq;
using System.Collections;
using System.Collections.Generic;
using System.Drawing;

using Rhino;
using Rhino.Geometry;

using Grasshopper;
using Grasshopper.Kernel;
using Grasshopper.Kernel.Data;
using Grasshopper.Kernel.Types;
#endregion

public class Script_Instance : GH_ScriptInstance
{
    #region Notes
    /* 
      Members:
        RhinoDoc RhinoDocument
        GH_Document GrasshopperDocument
        IGH_Component Component
        int Iteration

      Methods (Virtual & overridable):
        Print(string text)
        Print(string format, params object[] args)
        Reflect(object obj)
        Reflect(object obj, string method_name)
    */
    #endregion

    private void RunScript(
		List<Surface> surfs,
		List<Point3d> ptsA,
		List<double> ptsV,
		ref object _max)
    {
        if (ptsA==null) return;
        List<double> vals=new List<double>();
        double max=0,min=1e10;
        foreach (Surface s in surfs) {
            Point3d center=s.PointAt(0.5,0.5);
            
            double minDis=1e10;
            double val=-1;
            for (int i=0; i<ptsA.Count; i++){
                Point3d ptA=ptsA[i];
                double dis=ptA.DistanceTo(center);
                if (dis<minDis) {
                    val=ptsV[i];
                    minDis=dis;                    
                }
            }
            if (val<min)min=val;
            if (val>max)max=val;
            vals.Add(val);
        }
       // a = vals;
      //  _min=min;
        _max=max;
    }
}
# ---------- end assign_values_to_surfs ----------
construct_domain = ConstructDomain(DomainStart=0, DomainEnd=assign_values_to_surfs)

offset_mesh = OffsetMesh(Mesh=incidentradiation.mesh, Distance="100", BothSides=0, CreateSolid="false")
mesh = Mesh(offset_mesh)
panel_3 = Panel("255")  # disabled

tloušťka_panelu = Slider(-100, range=-150..150)

# ----
# HMOTA OKEN
# FILTROVÁNÍ
# TYP OKEN
# OBJEKTY OKEN
# V PROJEKTU
# DOSTUPNÉ VARIANTY
query_design_options = QueryDesignOptions()
type = Type(<hostobjecttype referenced from the Revit model>, SelectedBuiltInCategory="autodesk.revit.category.local:walls")

value_picker = ValuePicker(query_design_options)

design_option_filter = DesignOptionFilter(DesignOption=value_picker, Inverted=False)
type_filter = TypeFilter(Types=type, Inverted=False)
# HMOTA OKEN
logical_and_filter = LogicalAndFilter(FilterA=type_filter, FilterB=design_option_filter)

query_elements = QueryElements(Filter=logical_and_filter, Limit=100)  # -> flatten(Elements), Count
element_curve = ElementCurve(Element=query_elements.Elements)  # -> Element, Curve
analyze_wall = AnalyzeWall(Wall=query_elements.Elements)  # -> WallSystemFamily, WallType, ParentStackedWall, BaseLevel, BaseLevelOffset, BottomIsAttached, TopLevel, TopLevelOffset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
curve = Curve(element_curve.Curve)
unit_z = UnitZ(Factor=analyze_wall.BaseLevelOffset)
move = Move(Geometry=curve, Motion=unit_z)  # -> Geometry, Transform

unit_z_2 = UnitZ(Factor=analyze_wall.Height)
point_on_curve = PointOnCurve(move.Geometry, parameter=0.5)
brep_closest_point = BrepClosestPoint(Point=point_on_curve, Brep=brep_join.Breps)  # -> Point, Normal, Distance
# PANELY NE NA OKNÁCH
extrude = Extrude(Base=move.Geometry, Direction=unit_z_2)
multiplication = Multiplication(A=brep_closest_point.Normal, B=1000)
extrude_2 = Extrude(Base=extrude, Direction=multiplication)

# ----
# PŘIŘADIT HODNOTY K BODŮM
c_script = CSharpScript(objects=cluster_2, cutters=extrude_2)  # -> notintersects; inputs objects: list of Surface, cutters: list of Brep
# ---------- c_script: C# ----------
#region Usings
using System;
using System.Linq;
using System.Collections;
using System.Collections.Generic;
using System.Drawing;

using Rhino;
using Rhino.Geometry;

using Grasshopper;
using Grasshopper.Kernel;
using Grasshopper.Kernel.Data;
using Grasshopper.Kernel.Types;
#endregion

public class Script_Instance : GH_ScriptInstance {
    private void RunScript(
		List<Surface> objects,
		List<Brep> cutters,
		ref object _notintersects)
    {
        if (cutters==null) {
            _notintersects=objects;
            return;
        }
        List<Surface> notintersects=new List<Surface>();
        notintersects.Capacity=objects.Count/2;

        List<BoundingBox> cuttersboxes=cutters.Select(i=>i.GetBoundingBox(true)).ToList();

        foreach (Surface s in objects) {
            bool ptinside=false;

            // fastly
            bool intersectcenter=false;
            Point3d center=s.PointAt(.5,.5);
            foreach (BoundingBox bb in cuttersboxes) {
                if (bb.Contains(center)) {
                    intersectcenter=true;
                    break;
                }
            }

            if (!intersectcenter) {
                notintersects.Add(s);
            }

            // by coners
           /* Point3d[] coners=new Point3d[4] {
                s.PointAt(0,0),
                s.PointAt(1,0),
                s.PointAt(0,1),
                s.PointAt(1,1)
            };
            bool[] ptsInside=new bool[4];
            BoundingBox[] collisions=new BoundingBox[4];

            for (int i=0; i<4; i++){
                Point3d p = coners[i];
                foreach (BoundingBox bb in cuttersboxes) {
                    if (bb.Contains(p)) {
                        collisions[i]=bb;
                        ptinside=true;
                        break;
                    }
                }
                if (ptinside){
                    ptsInside[i]=true;
                }
            }            
         
            // add
            if (!ptinside) {
                notintersects.Add(s);
                continue;
            }

            // do not add
            if (ptsInside[0]==ptsInside[1]==ptsInside[2]==ptsInside[3]==true){
                continue;
            }*/

            //todo trim
          //  Surface splitted=s;
           // collisions.Distinct();
           // for (int i=0; i<4; i++){
             //   foreach (BoundingBox c in collisions) {
               //     if (/*c!=BoundingBox.Unset not work*/c.Min!=Point3d.Unset) splitted=split(splitted, c);
               // }
              //  notintersects.Add(splitted);
            //}
            //    continue;
            
        }

        _notintersects=notintersects;
    }

    bool Intersects(BoundingBox current, Point3d p) {
        return
        (current.Min.X < p.X) && (current.Max.X > p.X) &&
        (current.Min.Y < p.Y) && (current.Max.Y > p.Y) &&
        (current.Min.Z < p.Z) && (current.Max.Z > p.Z);
    }

    Surface split(Surface surface, BoundingBox bb) {
        Brep boxBrep = Brep.CreateFromBox(bb);
        if (boxBrep == null) return null;

        Brep[] pieces = surface.ToBrep().Split(boxBrep, RhinoDoc.ActiveDoc.ModelAbsoluteTolerance);
        if (pieces == null || pieces.Length == 0) return null;

        Surface outside = null;

        foreach (Brep p in pieces) {
            Point3d c = p.GetBoundingBox(true).Center;
            if (!bb.Contains(c)) {
                outside=p.Surfaces[0];
                break;
            }
        }

        return outside;
    }
}

    /* bool Intersects(BoundingBox current, BoundingBox other) {
            return
            (current.Min.X < other.Max.X) && (current.Max.X > other.Min.X) &&
            (current.Min.Y < other.Max.Y) && (current.Max.Y > other.Min.Y) &&
            (current.Min.Z < other.Max.Z) && (current.Max.Z > other.Min.Z);
        }*/
# ---------- end c_script ----------

assign_values_to_surfs_2 = CSharpScript(povrchy=c_script, body_solární_analýzy=incidentradiation.points, hodnoty_bodů=incidentradiation.results)  # -> hodnoty; inputs povrchy: list of Surface, body_solární_analýzy: list of Point3d, hodnoty_bodů: list of Double
# ---------- assign_values_to_surfs_2: C# ----------
// Grasshopper Script Instance
#region Usings
using System;
using System.Linq;
using System.Collections;
using System.Collections.Generic;
using System.Drawing;

using Rhino;
using Rhino.Geometry;

using Grasshopper;
using Grasshopper.Kernel;
using Grasshopper.Kernel.Data;
using Grasshopper.Kernel.Types;
#endregion

public class Script_Instance : GH_ScriptInstance {
    private void RunScript(
		List<Surface> povrchy,
		List<Point3d> body_solární_analýzy,
		List<double> hodnoty_bodů,
		ref object hodnoty)
    {
        if (body_solární_analýzy==null) return;
        if (povrchy==null) return;

        double[] vals=new double[povrchy.Count];
     //   double max=0,min=1e10;
        for (int p=0; p<povrchy.Count; p++) {
            Surface s = povrchy[p];

            if (s==null) vals[p]=-1;
            Point3d center=s.PointAt(0.5,0.5);
            
            double minDis=1e10;
            double val=-1;
            for (int i=0; i<body_solární_analýzy.Count; i++){
                Point3d ptA=body_solární_analýzy[i];
                double dis=ptA.DistanceTo(center);
                if (dis<minDis) {
                    val=hodnoty_bodů[i];
                    minDis=dis;                    
                }
            }
        //   if (val<min)min=val;
          //  if (val>max)max=val;
            vals[p]=val;
        }
        hodnoty = vals;
     //   _min=min;
      //  _max=max;
    }
}
# ---------- end assign_values_to_surfs_2 ----------
remap_numbers = RemapNumbers(Value=assign_values_to_surfs_2, Source=construct_domain, Target=Domain(0, 1))  # -> Mapped, Clipped
assigngeometry = AssignGeometry(Nodes=cluster, Surfaces=c_script, Values=remap_numbers.Mapped, Tol=division)

# ----
# RHINO - PANELY BEZ BARVY
mesh_brep = MeshBrep(
    Brep=c_script,
    Settings={GridMaxCount=0, GridMinCount=16, JaggedSeams=False, MaxEdgeLength=0, MinEdgeLength=0.0001, MinTolerance=0, Refine=True, RefineAngle=0, RelativeTolerance=0.65, SimplePlanes=True, Tolerance=0})
mesh_join = MeshJoin(Meshes=mesh_brep)
offset_mesh_2 = OffsetMesh(Mesh=mesh_join, Distance="100", BothSides=0, CreateSolid="false")
custom_preview = CustomPreview(Geometry=offset_mesh_2, Material=ColourSwatch(SwatchColor=RGB(252, 10, 10)))

# ----
# RHINO - PANELY S BARVOU
# DITHERING
tloustka_panelu = Panel("100")  # disabled
# treeshold
cluster_3 = Cluster_4(distance=tloustka_panelu, nodes=assigngeometry)  # -> surface_2, surface; disabled
colour_swatch = ColourSwatch(SwatchColor=RGB(255, 255, 255))  # disabled
colour_swatch_2 = ColourSwatch(SwatchColor=RGB(3, 3, 3))  # disabled
custom_preview_2 = CustomPreview(Geometry=cluster_3.surface, Material=colour_swatch)  # disabled
custom_preview_3 = CustomPreview(Geometry=cluster_3.surface_2, Material=colour_swatch_2)  # disabled

práh = Slider(0.35, range=0..1)
floydsteinbergdither = FloydSteinbergDither(Nodes=assigngeometry, Pivot=práh)

# ----
# ROZDĚLIT GEOMETRII PODLE BARVY
getgeometryandvalues = GetGeometryAndValues(Nodes=floydsteinbergdither)  # -> Surfaces, Values
smaller_than = SmallerThan(FirstNumber=getgeometryandvalues.Values, SecondNumber="0.5")  # -> SmallerThan, OrEqualTo
flip = Flip(Surface=getgeometryandvalues.Surfaces)  # -> Surface, Result
dispatch = Dispatch(List=getgeometryandvalues.Surfaces, DispatchPattern=smaller_than.SmallerThan)  # -> ListA, ListB

# ----
# HMOTA GEOMETRIE
surface = Surface(dispatch.ListA)
parameter_point_on_surface = ParameterPointOnSurface(Surface=surface, ParameterU="0.5", ParameterV="0.5")  # -> Point, Normal
multiplication_2 = Multiplication(A=parameter_point_on_surface.Normal, B=tloušťka_panelu)
extrude_3 = Extrude(Base=surface, Direction=multiplication_2)

surface_2 = Surface(dispatch.ListB)
parameter_point_on_surface_2 = ParameterPointOnSurface(Surface=surface_2, ParameterU="0.5", ParameterV="0.5")  # -> Point, Normal
multiplication_3 = Multiplication(A=parameter_point_on_surface_2.Normal, B=tloušťka_panelu)
extrude_4 = Extrude(Base=surface_2, Direction=multiplication_3)

simple_mesh = SimpleMesh(Brep=extrude_3)
simple_mesh_2 = SimpleMesh(Brep=extrude_4)
mesh_join_2 = MeshJoin(Meshes=simple_mesh)
mesh_join_3 = MeshJoin(Meshes=simple_mesh_2)

# ----
# RHINO - PANELY FINAL
colour_swatch_3 = ColourSwatch(SwatchColor=RGB(3, 3, 3))  # disabled
# IMPORT DO PROJEKTU
colour_swatch_4 = ColourSwatch(SwatchColor=RGB(255, 255, 255))  # disabled
custom_preview_4 = CustomPreview(Geometry=simple_mesh, Material=colour_swatch_3)  # disabled
custom_preview_5 = CustomPreview(Geometry=mesh_join_3, Material=colour_swatch_4)  # disabled

# ----
# BIM PRO REVIT
# TMAVÁ
nazev = Panel("interaktivní_fasada_tmava")
# SVĚTLÁ
material = Material(<material referenced from the Revit model>)
category = Category(<category referenced from the Revit model>)
add_directshape_geometry = AddDirectShapeGeometry(Name=nazev, Category=category, Geometry=simple_mesh, Material=material, TrackingMode=2)

nazev_2 = Panel("interaktivni_fasada_svetla")
material_2 = Material(<material referenced from the Revit model>)
category_2 = Category(<category referenced from the Revit model>)
add_directshape_geometry_2 = AddDirectShapeGeometry(Name=nazev_2, Category=category_2, Geometry=simple_mesh_2, Material=material_2, TrackingMode=2)

# ----
# RHINO - PANELY S BARVOU
# grayscale
getgeometryandvalues_2 = GetGeometryAndValues(Nodes=assigngeometry)  # -> Surfaces, Values; disabled
tloustka_panelu_2 = Panel("100")  # disabled
flip_2 = Flip(Surface=getgeometryandvalues_2.Surfaces)  # -> Surface, Result; disabled
offset_surface = OffsetSurface(Surface=flip_2.Surface, Distance=tloustka_panelu_2, Retrim=True)  # disabled

multiplication_4 = Multiplication(A=getgeometryandvalues_2.Values, B=panel_3)  # disabled

number_2 = Number(multiplication_4)  # disabled
colour_rgb = ColourRGB(Alpha=255, Red=number_2, Green=number_2, Blue=number_2)  # disabled
custom_preview_6 = CustomPreview(Geometry=offset_surface, Material=colour_rgb)  # disabled

# ==== cluster Cluster_2
brep = ClusterInput()
number = ClusterInput()
# Rozdělit plochu fasády na horizontální úrovně
number_2 = Number(number)
deconstruct_brep = DeconstructBrep(Brep=brep)  # -> Faces, Edges, flatten(Vertices)
cluster = Cluster(breps=brep, B=number_2)

# ---- group: same dir
curve = Curve(cluster)
average = Average(Input=flatten(deconstruct_brep.Vertices))
point_on_curve = PointOnCurve(curve, parameter=0.059)
end_points = EndPoints(Curve=curve)  # -> Start, End
vector_2pt = Vector2Pt(PointA=average, PointB=end_points.Start, Unitize=False)  # -> Vector, Length
vector_2pt_2 = Vector2Pt(PointA=average, PointB=point_on_curve, Unitize=False)  # -> Vector, Length
xy_plane = XYPlane(Origin=end_points.Start)
angle = Angle(VectorA=vector_2pt.Vector, VectorB=vector_2pt_2.Vector, Plane=xy_plane)  # -> Angle, Reflex
smaller_than = SmallerThan(FirstNumber=angle.Reflex, SecondNumber="pi")  # -> SmallerThan, OrEqualTo
dispatch = Dispatch(List=curve, DispatchPattern=smaller_than.SmallerThan)  # -> ListA, ListB
flip_curve = FlipCurve(Curve=dispatch.ListA)  # -> Curve, Flag
merge = Merge(Data1=flip_curve.Curve, Data2=dispatch.ListB)

# ---- group: create mesh lattice / StartFromPoint
point = Point(Point(-721164.1875, 93608.9375, 208311.1562))

# ---- group: create mesh lattice
curve_2 = Curve(merge)

# ----
nodesfromcurves = NodesFromCurves(Curves=curve_2, Start=point, Len=number_2)
nodes = ClusterOutput(nodesfromcurves)

# ==== cluster Cluster_3
mesh = ClusterInput()
deconstruct_mesh = DeconstructMesh(Mesh=mesh)  # -> Vertices, Faces, Colours, Normals
deconstruct_face = DeconstructFace(Face=deconstruct_mesh.Faces)  # -> CornerA, CornerB, CornerC, CornerD
list_item = ListItem(List=deconstruct_mesh.Vertices, Index=deconstruct_face.CornerA, Wrap=True)
list_item_2 = ListItem(List=deconstruct_mesh.Vertices, Index=deconstruct_face.CornerB, Wrap=True)
list_item_3 = ListItem(List=deconstruct_mesh.Vertices, Index=deconstruct_face.CornerC, Wrap=True)
list_item_4 = ListItem(List=deconstruct_mesh.Vertices, Index=deconstruct_face.CornerD, Wrap=True)
_4point_surface = _4PointSurface(CornerA=list_item, CornerB=list_item_2, CornerC=list_item_3, CornerD=list_item_4)
surface = ClusterOutput(_4point_surface)

# ==== cluster Cluster_4
distance = ClusterInput()
nodes = ClusterInput()

getgeometryandvalues = GetGeometryAndValues(Nodes=nodes)  # -> Surfaces, Values
smaller_than = SmallerThan(FirstNumber=getgeometryandvalues.Values, SecondNumber="0.5")  # -> SmallerThan, OrEqualTo
flip = Flip(Surface=getgeometryandvalues.Surfaces)  # -> Surface, Result
dispatch = Dispatch(List=flip.Surface, DispatchPattern=smaller_than.SmallerThan)  # -> ListA, ListB

c_script = CSharpScript(x=getgeometryandvalues.Surfaces)  # -> out, a
# ---------- c_script: C# ----------
// Grasshopper Script Instance
#region Usings
using System;
using System.Linq;
using System.Collections;
using System.Collections.Generic;
using System.Drawing;

using Rhino;
using Rhino.Geometry;

using Grasshopper;
using Grasshopper.Kernel;
using Grasshopper.Kernel.Data;
using Grasshopper.Kernel.Types;
#endregion

public class Script_Instance : GH_ScriptInstance
{
    #region Notes
    /* 
      Members:
        RhinoDoc RhinoDocument
        GH_Document GrasshopperDocument
        IGH_Component Component
        int Iteration

      Methods (Virtual & overridable):
        Print(string text)
        Print(string format, params object[] args)
        Reflect(object obj)
        Reflect(object obj, string method_name)
    */
    #endregion

    private void RunScript(object x, object y, ref object a)
    {
        // Write your logic here
        a = null;
    }
}
# ---------- end c_script ----------

offset_surface = OffsetSurface(Surface=dispatch.ListB, Distance=distance, Retrim=True)
offset_surface_2 = OffsetSurface(Surface=dispatch.ListA, Distance=distance, Retrim=True)

surface = ClusterOutput(offset_surface)
surface_2 = ClusterOutput(offset_surface_2)

# ==== cluster Cluster
breps = ClusterInput()

# ---- group: reduce surfaces
brep_join = BrepJoin(Breps=breps)  # -> Breps, Closed
merge_faces = MergeFaces(Brep=brep_join.Breps)  # -> Breps, Before, After

# ----
brep_edges = BrepEdges(Brep=merge_faces.Breps)  # -> Naked, Interior, NonManifold
curve = Curve(brep_edges.Naked)
B = ClusterInput()

# ---- group: planes z
deconstruct_brep = DeconstructBrep(Brep=merge_faces.Breps)  # -> Faces, Edges, Vertices
point = Point(deconstruct_brep.Vertices)
deconstruct = Deconstruct(Point=point)  # -> XComponent, YComponent, ZComponent
sort_list = SortList(Keys=deconstruct.ZComponent, ValuesValuesA=point)  # -> Keys, ValuesValuesA
list_length = ListLength(List=sort_list.Keys)
subtraction = Subtraction(A=list_length, B="1")
list_item = ListItem(List=sort_list.ValuesValuesA, Index=0, Wrap=True)
list_item_2 = ListItem(List=sort_list.Keys, Index=subtraction, Wrap=True)
list_item_3 = ListItem(List=sort_list.Keys, Index=0, Wrap=True)
deconstruct_2 = Deconstruct(Point=list_item)  # -> XComponent, YComponent, ZComponent
subtraction_2 = Subtraction(A=list_item_2, B=list_item_3)
division = Division(A=subtraction_2, B=B)
series = Series(Start=list_item_3, Step=B, Count=division)
construct_point = ConstructPoint(XCoordinate=deconstruct_2.XComponent, YCoordinate=deconstruct_2.YComponent, ZCoordinate=series)
xy_plane = XYPlane(Origin=construct_point)

# ----
brep_plane = BrepPlane(Brep=merge_faces.Breps, Plane=xy_plane)  # -> flatten(Curves), Points
curves = ClusterOutput(brep_plane.Curves)
