# Grasshopper definition chipset.gh (Grasshopper 1.0.8)
# plug-ins: NodeFasade, Pufferfish, Rhino.Inside for Autodesk Revit

# NÁHODNOST
rnd_seed = Slider(5, range=0..1000)
# MNOŽSTVÍ LAMEL
dopln_lamely = Slider(0.25, range=0..1)
# LAMELY VÍCE DO STRAN
do_stran = Slider(10, range=0..10)

tloušťka = Slider(100, range=1..500)
# DIMENZE LAMEL
vysunutí = Slider(210, range=1..500)

meritko = Slider(500, range=100..1000)

geometry_pipeline = GeometryPipeline(
    GroupByLayer=False,
    GroupByType=False,
    IncludeHidden=True,
    IncludeLocked=True,
    LayerFilter="navrh::stena_spolecna",
    NameFilter="*",
    SublayerFiltering=True,
    TypeFilter=1073741848)
geometry_pipeline_2 = GeometryPipeline(
    GroupByLayer=False,
    GroupByType=False,
    IncludeHidden=True,
    IncludeLocked=True,
    LayerFilter="navrh::strecha",
    NameFilter="*",
    SublayerFiltering=True,
    TypeFilter=1073741848)
# OKNA
geometry = Geometry([<mesh referenced from the Rhino model> x21])

# ----
# STÍNÍCÍ HMOTA
poloměr_zakončení = Slider(127, range=1..200)  # disabled

geometry_pipeline_3 = GeometryPipeline(
    GroupByLayer=False,
    GroupByType=False,
    IncludeHidden=True,
    IncludeLocked=True,
    LayerFilter="navrh::fasady::balkonova",
    NameFilter="*",
    SublayerFiltering=True,
    TypeFilter=1073741848)
# VSTUP
# VSTUPNÍ GEOMETRIE
geometry_pipeline_4 = GeometryPipeline(
    GroupByLayer=False,
    GroupByType=False,
    IncludeHidden=True,
    IncludeLocked=True,
    LayerFilter="navrh::fasady::main",
    NameFilter="*",
    SublayerFiltering=True,
    TypeFilter=1073741848)
# MĚŘÍTKO LAMEL
geometry_2 = Geometry(<surface referenced from the Rhino model>)  # disabled

# ----
# V OPTION  SETECH
panel = Panel("CHIPSET")

type = Type(<hostobjecttype referenced from the Revit model>, SelectedBuiltInCategory="autodesk.revit.category.local:walls")
merge = Merge(Data1=type)

query_design_options = QueryDesignOptions()
query_design_options_2 = QueryDesignOptions(Name="Main Model", Primary=Toggle(True))
query_design_options_3 = QueryDesignOptions(Name=panel)
merge_2 = Merge(Data1=geometry_pipeline_2, Data2=geometry_pipeline, Data3=geometry)
division = Division(A=tloušťka, B="2")

# ----
# SPOJIT GEOMETRII
merge_3 = Merge(Data1=geometry_pipeline_4, Data2=geometry_pipeline_3, Data3=geometry_2)
brep_join = BrepJoin(Breps=merge_3)  # -> Breps, Closed
merge_faces = MergeFaces(Brep=brep_join.Breps)  # -> Breps, Before, After

panel_2 = Panel(query_design_options)
design_option_filter = DesignOptionFilter(DesignOption=[query_design_options_3, query_design_options_2], Inverted=False)

analysisperiod = LBAnalysisPeriod(start_month=Slider(3, range=1..12), start_day=1, start_hour=0, end_month=Slider(7, range=1..12))  # -> period, hoys, dates; plug-in component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

# ---- group: EPW soubor
file_path = FilePath("C:\Users\geftg\Desktop\dp2\praha epw\CZE_PM_Praha-Karlov-Klementinum.115190_TMYx.epw")

# ----
# PAPRSKY
# SOLÁRNÍ ANALÝZA
# LOKACE
# KRITICKÉ OBDOBÍ PŘED PRÁZDNINAMI
sever = Slider(1, range=0..360)

importepw = LBImportEPW(epw_file=file_path)  # -> location, dry_bulb_temperature, dew_point_temperature, relative_humidity, wind_speed, wind_direction, direct_normal_rad, diffuse_horizontal_rad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; plug-in component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

# ----
# ESTETIKA
# DISTRIBUCE UZLŮ
# NA FASÁDĚ
# ELEKTRICKÁ
# ESTETIKA
cluster = Cluster(brep=merge_faces.Breps, number=meritko)  # -> nodes, bottom
# SOLÁRNÍ ANALÝZA
number_slider = Slider(2, range=0..10)
electric = Electric(Nodes=cluster.nodes, Bottom_curves=cluster.bottom, Seed=rnd_seed, Side=do_stran, Fulls=number_slider, Tol="1e-6")
cluster_2 = Cluster_4(vertices=electric)

point = Point(Point(-707798.0382, 104040.6802, 216367.3504))
sunpath = LBSunPath(north=sever, location=importepw.location, hoys=analysisperiod.hoys, center_pt=point, scale=1)  # -> out, vectors, altitudes, azimuths, hoys, sun_pts, analemma, daily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; plug-in component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

point_2 = Point(Point(-687587.4837, 93818.74162, 211404.1594))
xy_plane = XYPlane(Origin=point_2)
legendpar = LBLegendParameters(vert_or_horiz=Toggle(True), base_plane=xy_plane, font="1")  # -> leg_par; plug-in component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

kvalita_analýzy = Slider(1000, range=1..10000)
directsunhours = LBDirectSunHours(
    vectors=flatten(sunpath.vectors),
    geometry=flatten(merge_faces.Breps),
    context=flatten(merge_2),
    grid_size=kvalita_analýzy,
    offset_dist=Slider(1, range=1..10000),
    geo_block=Toggle(True),
    legend_par=legendpar,
    run=Toggle(True))  # -> out, points, results, mesh, legend, title, int_mtx; plug-in component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

custom_preview = CustomPreview(Geometry=flatten(electric), Material=ColourSwatch(SwatchColor=RGB(255, 0, 0)))

month = Slider(6, range=0..6)  # disabled
number_slider_2 = Slider(12, range=0..30)  # disabled
hour = Slider(8.343, range=0..24)  # disabled
# NASTAVIT SLUNCE
hoy = LBCalculateHOY(month=month, day=number_slider_2, hour=hour)  # -> flatten(hoy), flatten(doy), flatten(date); disabled; plug-in component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
boolean_toggle = BooleanToggle(False)  # disabled
rhinosun = LBSetRhinoSun(north=sever, location=importepw.location, hoy=hoy.hoy, run=boolean_toggle)  # -> out; disabled; plug-in component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

type_filter = TypeFilter(Types=merge, Inverted=False)
union_filter = UnionFilter(Filters=design_option_filter)
tol = Slider(100, range=0..1000)

# ----
# REMAP
kvalita = Slider(4, range=1..10)

# ----
# ŽÁDNÉ PRVKY PŘIDĚLANÉ NA OKNA
# FILTROVÁNÍ
# MÉNĚ NA SEVERU
logical_and_filter = LogicalAndFilter(FilterA=type_filter, FilterB=union_filter)
# OVLIVNĚNÍ
cluster_3 = Cluster_3(brep=merge_faces.Breps, filter=logical_and_filter)

c_script = CSharpScript(curves=cluster_2, okna=cluster_3, tol=tol)  # -> a; inputs curves: list of Polyline, okna: list of Surface, tol: Double
# ---------- c_script: C# ----------
#region Usings
using System;
using System.Linq;
using System.Collections;
using System.Collections.Generic;
using System.Drawing;

using Rhino;
using Rhino.Geometry;

using Grasshopper;
using Grasshopper.Kernel;
using Grasshopper.Kernel.Data;
using Grasshopper.Kernel.Types;
#endregion

public class Script_Instance : GH_ScriptInstance{
    private void RunScript(
		List<Polyline> curves,
		List<Surface> okna,
		double tol,
		ref object a) {
        
        List<Polyline> notAtWindow=new List<Polyline>();
        foreach (Polyline p in curves) {
            int cntNotAtWindow=0;
            
            bool startAtWindow=isAtWindow(p.PointAt(0));
            if (!startAtWindow) cntNotAtWindow++;

            bool endAtWindow=isAtWindow(p.PointAt(1));
            if (!endAtWindow) cntNotAtWindow++;

            if (cntNotAtWindow>0){
                notAtWindow.Add(p);
            }
        }


        a = notAtWindow;

        bool isAtWindow(Point3d pt) {
            foreach (Surface s in okna) {
                s.ClosestPoint(pt, out double u, out double v);
                Point3d closest=s.PointAt(u, v);

                double dis=pt.DistanceTo(closest);
                if (dis<tol) {
                    return true;
                }
            }
            return false;
        }
    }
}
# ---------- end c_script ----------

curve = Curve(c_script)

c_script_2 = CSharpScript(points=directsunhours.points, values=directsunhours.results, curves=curve, steps=kvalita)  # -> a; inputs points: list of Point3d, values: list of Double, curves: list of Curve, steps: Double
# ---------- c_script_2: C# ----------
#region Usings
using System;
using System.Linq;
using System.Collections;
using System.Collections.Generic;
using System.Drawing;

using Rhino;
using Rhino.Geometry;

using Grasshopper;
using Grasshopper.Kernel;
using Grasshopper.Kernel.Data;
using Grasshopper.Kernel.Types;
#endregion

public class Script_Instance : GH_ScriptInstance {
    private void RunScript(
		List<Point3d> points,
		List<double> values,
		List<Curve> curves,
		double steps,
		ref object a) {
            if (points.Count!=values.Count) throw new Exception("point does not have same list len as values!");
        
        List<double> average_hours=new List<double>();
        average_hours.Capacity=curves.Count;

        foreach (Curve curve in curves) {
            double average=0;
            int cnt=0;
            for (double p=0; p<=1; p+=1/steps){
                Point3d pt=curve.PointAt(p);                 
                double value=0; 
                double min=1e10;           

                for (int i=0; i<values.Count; i++) {
                    double dis=points[i].DistanceTo(pt);
                    if (dis<min) {
                        min=dis;
                        value=values[i];
                    }
                }
                cnt++;
                average+=value;
            }

            average_hours.Add(average/cnt);
        }
        
        a = average_hours;
    }
}
# ---------- end c_script_2 ----------
# méně na více=méně
to_domain_0_1 = ToDomain01(number=c_script_2)
graph_mapper = GraphMapper(to_domain_0_1, x0=0, x1=1, y0=0, y1=1, container_name="Bezier", cpx=[0, 0.9146163464, 0.247166872, 1], cpy=[1, 1, 0, 0])
remap_numbers = RemapNumbers(Value=graph_mapper, Source=Domain(0, 1), Target=Domain(0, 1))  # -> Mapped, Clipped

filter = Filter(curve=curve, seed=rnd_seed, north=remap_numbers.Clipped, min=dopln_lamely)

using = Geometry(filter)
point_on_curve = PointOnCurve(using, parameter=0.393)
brep_closest_point = BrepClosestPoint(Point=point_on_curve, Brep=merge_faces.Breps)  # -> Point, Normal, Distance
multiplication = Multiplication(A=brep_closest_point.Normal, B=vysunutí)
# HMOTA
extrude = Extrude(Base=using, Direction=multiplication)
multiplication_2 = Multiplication(A=division, B=-1)
simple_mesh = SimpleMesh(Brep=extrude)
offset_mesh = OffsetMesh(Mesh=simple_mesh, Distance=division, BothSides=multiplication_2, CreateSolid="true")  # -> flatten(Offset)

# ----
# HMOTA LAMEL
merge_4 = Merge(Data1=offset_mesh)  # -> flatten(Result)

kvalita_sol_analýzy = Slider(500, range=1..10000)  # disabled
number_slider_3 = Slider(1, range=1..10000)  # disabled
boolean_toggle_2 = BooleanToggle(True)  # disabled
boolean_toggle_3 = BooleanToggle(True)  # disabled
# SOLÁRNÍ ANALÝZA
merge_5 = Merge(Data1=merge_2, Data2=merge_4)  # disabled
geometry_3 = Geometry(merge_faces.Breps)  # disabled
directsunhours_2 = LBDirectSunHours(
    vectors=flatten(sunpath.vectors),
    geometry=flatten(geometry_3),
    context=flatten(merge_5),
    grid_size=kvalita_sol_analýzy,
    offset_dist=number_slider_3,
    geo_block=boolean_toggle_3,
    run=boolean_toggle_2)  # -> out, points, results, mesh, legend, title, int_mtx; disabled; plug-in component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

# ----
# REPORT
colour_swatch = ColourSwatch(SwatchColor=RGB(115, 115, 115))
custom_preview_2 = CustomPreview(Geometry=flatten(merge_4), Material=colour_swatch)  # disabled

# ----
# BIM
nazev = Panel("chipset_lamely")
category = Category(<category referenced from the Revit model>)
# RHINO
material = Material(<material referenced from the Revit model>)
# REVIT
add_directshape_geometry = AddDirectShapeGeometry(Name=nazev, Category=category, Geometry=flatten(merge_4), Material=material, TrackingMode=2)

cluster_4 = Cluster_2(number=directsunhours_2.results, number_2=directsunhours.results)  # disabled
pokles_solárních_hodin_o = Panel(cluster_4)  # disabled

# ==== cluster Cluster
number = ClusterInput()
brep = ClusterInput()
brep_2 = Brep(brep)

brep_edges = BrepEdges(Brep=brep_2)  # -> Naked, Interior, NonManifold
reparameterize_curve = ReparameterizeCurve(Curve=brep_edges.Naked)  # -> Reparameterized, Original

curve = Curve(reparameterize_curve.Reparameterized)
# SEŘADIT KŘIVKY PODLE VÝŠKY
end_points = EndPoints(Curve=curve)  # -> Start, End
deconstruct = Deconstruct(Point=end_points.End)  # -> XComponent, YComponent, ZComponent
sort_list = SortList(Keys=deconstruct.ZComponent, ValuesValuesA=curve)  # -> Keys, ValuesValuesA

# ----
# FILTROVÁNÍ VODOROVNÝCH OKRAJŮ
c_script = CSharpScript(edges=reparameterize_curve.Reparameterized, brep=brep_2)  # -> top, bottom; inputs edges: list of Curve, brep: Brep
# ---------- c_script: C# ----------
#region Usings
using System;
using System.Linq;
using System.Collections;
using System.Collections.Generic;
using System.Drawing;

using Rhino;
using Rhino.Geometry;

using Grasshopper;
using Grasshopper.Kernel;
using Grasshopper.Kernel.Data;
using Grasshopper.Kernel.Types;
#endregion

public class Script_Instance : GH_ScriptInstance {
    static double tol=11;
    static double liftDis=100;

    private void RunScript(
		List<Curve> edges,
		Brep brep,
		ref object top,
		ref object bottom) {
        List<Curve> tops=new List<Curve>();
        List<Curve> bottoms=new List<Curve>();

        foreach (Curve c in edges){
            Point3d start=c.PointAt(0), end=c.PointAt(1);
            if (Math.Abs(start.Z-end.Z)<tol){

                Point3d mid=c.PointAt(.5);
                Point3d lift=new Point3d(mid.X,mid.Y,mid.Z+liftDis);
                Point3d closest=brep.ClosestPoint(lift);

                if (Math.Abs(closest.DistanceTo(lift))<liftDis/2){
                    bottoms.Add(c);
                }else{
                    tops.Add(c);
                }
            }
        }

        top = tops.OrderBy(i=>i.PointAt(0).Z);
        bottom = bottoms.OrderBy(i=>i.PointAt(0).Z);
    }
}
# ---------- end c_script ----------

# ---- group: MID
point = Point(Point(-696799.4834, 116395.1041, 0))

# ----
curve_2 = Curve(c_script.bottom)
point_on_curve = PointOnCurve(curve_2, parameter=0.04)
end_points_2 = EndPoints(Curve=curve_2)  # -> Start, End
vector_2pt = Vector2Pt(PointA=point, PointB=end_points_2.Start, Unitize=False)  # -> Vector, Length
vector_2pt_2 = Vector2Pt(PointA=point, PointB=point_on_curve, Unitize=False)  # -> Vector, Length
xy_plane = XYPlane(Origin=Point(0, 0, 0))
# USPOŘÁDAT SMĚR KŘIVEK PODLE HODIN
angle = Angle(VectorA=vector_2pt.Vector, VectorB=vector_2pt_2.Vector, Plane=xy_plane)  # -> Angle, Reflex
smaller_than = SmallerThan(FirstNumber=angle.Angle, SecondNumber="pi")  # -> SmallerThan, OrEqualTo
dispatch = Dispatch(List=curve_2, DispatchPattern=smaller_than.SmallerThan)  # -> ListA, ListB
flip_curve = FlipCurve(Curve=dispatch.ListB)  # -> Curve, Flag
merge = Merge(Data1=dispatch.ListA, Data2=flip_curve.Curve)

list_item = ListItem(List=sort_list.ValuesValuesA, Index=0, Wrap=True)
# POZICE ROVIN
end_points_3 = EndPoints(Curve=list_item)  # -> Start, End
deconstruct_2 = Deconstruct(Point=end_points_3.Start)  # -> XComponent, YComponent, ZComponent

number_2 = Number(number)

# ----
# DISTRIBUCE UZLŮ NA FASÁDĚ
list_length = ListLength(List=sort_list.Keys)
subtraction = Subtraction(A=list_length, B="1")
list_item_2 = ListItem(List=sort_list.Keys, Index=subtraction, Wrap=True)
list_item_3 = ListItem(List=sort_list.Keys, Index=0, Wrap=True)
subtraction_2 = Subtraction(A=list_item_2, B=list_item_3)
# SÉRIE ROVIN S JINOU VÝŠKOU
construct_domain = ConstructDomain(DomainStart=list_item_3, DomainEnd=list_item_2)
division = Division(A=subtraction_2, B=number_2)
range = Range(Domain=construct_domain, Steps=division)
construct_point = ConstructPoint(XCoordinate=deconstruct_2.XComponent, YCoordinate=deconstruct_2.YComponent, ZCoordinate=range)
xy_plane_2 = XYPlane(Origin=construct_point)

length = Length(Curve=merge)
division_2 = Division(A=length, B=number_2)
divide_curve = DivideCurve(Curve=merge, Count=division_2, Kinks=False)  # -> Points, Tangents, Parameters

list_length_2 = ListLength(List=xy_plane_2)
division_3 = Division(A=list_length_2, B=2)
series = Series(Start=0, Step="2", Count=division_3)
# VERTIKÁNÍ KŘIVKY
curve_3 = Curve(c_script.top)
brep_plane = BrepPlane(Brep=brep_2, Plane=xy_plane_2)  # -> flatten(Curves), Points
list_length_3 = ListLength(List=brep_plane.Curves)
subtraction_3 = Subtraction(A=list_length_3, B=1)
list_item_4 = ListItem(List=xy_plane_2, Index=series, Wrap=True)
construct_domain_2 = ConstructDomain(DomainStart="1", DomainEnd=subtraction_3)
c_script_2 = CSharpScript(points=divide_curve.Points, reach=curve_3)  # -> out, a; inputs points: list of Point3d, reach: list of Curve
# ---------- c_script_2: C# ----------
#region Usings
using System;
using System.Linq;
using System.Collections;
using System.Collections.Generic;
using System.Drawing;

using Rhino;
using Rhino.Geometry;

using Grasshopper;
using Grasshopper.Kernel;
using Grasshopper.Kernel.Data;
using Grasshopper.Kernel.Types;
#endregion

public class Script_Instance : GH_ScriptInstance {
    static double tol=10;

    private void RunScript(List<Point3d> points, List<Curve> reach, ref object a) {
        List<Line> lines=new List<Line>();

        foreach (Point3d pt in points){
            double z=-1e11;
            Point3d use=Point3d.Unset;

            foreach (Curve c in reach) {
                Point3d sameZ=new Point3d(pt.X, pt.Y, c.PointAt(0).Z);

                c.ClosestPoint(sameZ, out double p);
                Point3d closest=c.PointAt(p);
                double dis=sameZ.DistanceTo(closest);
                if (dis<tol) {
                    if (sameZ.Z>z) {
                        z=sameZ.Z;
                        use=closest;
                    }
                }
            }

            lines.Add(new Line(pt, use));
        }
        

        a = lines;
    }
}
# ---------- end c_script_2 ----------
unit_z = UnitZ(Factor="100")
curve_plane = CurvePlane(Curve=flatten(c_script_2.a), Plane=graft(xy_plane_2))  # -> flatten(Points), ParamsC, ParamsP
list_item_5 = ListItem(List=brep_plane.Curves, Index=0, Wrap=True)
multiplication = Multiplication(A=unit_z, B=-1)
sub_list = SubList(List=brep_plane.Curves, Domain=construct_domain_2, Wrap=True)  # -> List, Index
extrude = Extrude(Base=list_item_5, Direction=unit_z)
removeduplicatepts = RemoveDuplicatePts(Points=curve_plane.Points, Tolerance="10")
extrude_2 = Extrude(Base=sub_list.List, Direction=multiplication)
merge_2 = Merge(Data1=extrude, Data2=extrude_2)
offset_surface = OffsetSurface(Surface=brep_2, Distance="10", BothSides="-100", CreateSolid=True)
geometry_pipeline = GeometryPipeline(
    GroupByLayer=False,
    GroupByType=False,
    IncludeHidden=True,
    IncludeLocked=True,
    LayerFilter="lamely",
    NameFilter="*",
    SublayerFiltering=True,
    TypeFilter=1073741848)
multiplication_2 = Multiplication(A=number_2, B="1.1")
nodesfrompoints = NodesFromPoints(Points=removeduplicatepts, Len=multiplication_2)
merge_3 = Merge(Data1=geometry_pipeline, Data2=offset_surface)
bottom = ClusterOutput(c_script.bottom)
nodes = ClusterOutput(nodesfrompoints)
scale = Scale(Geometry=merge_3, Center=Point(0, 0, 0), Factor=0.5)  # -> Geometry, Transform

# ==== cluster Cluster_2
number = ClusterInput()
number_2 = ClusterInput()

number_3 = Number(number)
list_length = ListLength(List=number_3)
sum = CSharpScript(values=number_3)  # -> a; inputs values: list of Double
# ---------- sum: C# ----------
#region Usings
using System;
using System.Linq;
using System.Collections;
using System.Collections.Generic;
using System.Drawing;

using Rhino;
using Rhino.Geometry;

using Grasshopper;
using Grasshopper.Kernel;
using Grasshopper.Kernel.Data;
using Grasshopper.Kernel.Types;
#endregion

public class Script_Instance : GH_ScriptInstance {
    private void RunScript(List<double> values, ref object a) {
        double sum=0;
        foreach (double d in values) {
            sum+=d;
        }
        a = sum;
    }
}
# ---------- end sum ----------
division = Division(A=sum, B=list_length)

number_4 = Number(number_2)
list_length_2 = ListLength(List=number_4)
sum_2 = CSharpScript(values=number_4)  # -> a; inputs values: list of Double; same code as sum
division_2 = Division(A=sum_2, B=list_length_2)

# ----
# PO
# PŘED
division_3 = Division(A=division, B=division_2)
subtraction = Subtraction(A="1", B=division_3)
multiplication = Multiplication(A=subtraction, B=100)

result = ClusterOutput(multiplication)

# ==== cluster Cluster_3
filter = ClusterInput()
query_elements = QueryElements(Filter=filter, Limit="200")  # -> Elements, Count
analyze_wall = AnalyzeWall(Wall=query_elements.Elements)  # -> WallSystemFamily, WallType, ParentStackedWall, BaseLevel, BaseLevelOffset, BottomIsAttached, TopLevel, TopLevelOffset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
element_curve = ElementCurve(Element=query_elements.Elements)  # -> Element, Curve
unit_z = UnitZ(Factor=analyze_wall.BaseLevelOffset)
end_points = EndPoints(Curve=element_curve.Curve)  # -> Start, End
brep = ClusterInput()
move = Move(Geometry=element_curve.Curve, Motion=unit_z)  # -> Geometry, Transform
unit_z_2 = UnitZ(Factor=analyze_wall.Height)
brep_closest_point = BrepClosestPoint(Point=end_points.Start, Brep=brep)  # -> Point, Normal, Distance
extrude = Extrude(Base=move.Geometry, Direction=unit_z_2)
multiplication = Multiplication(A=brep_closest_point.Distance, B=-1)
offset_surface = OffsetSurface(Surface=extrude, Distance=multiplication, Retrim=True)
surface = ClusterOutput(offset_surface)

# ==== cluster ToDomain01
number = ClusterInput()
number_2 = Number(number)
max = CSharpScript(x=number_2)  # -> a; inputs x: list of Double
# ---------- max: C# ----------
// Grasshopper Script Instance
#region Usings
using System;
using System.Linq;
using System.Collections;
using System.Collections.Generic;
using System.Drawing;

using Rhino;
using Rhino.Geometry;

using Grasshopper;
using Grasshopper.Kernel;
using Grasshopper.Kernel.Data;
using Grasshopper.Kernel.Types;
#endregion

public class Script_Instance : GH_ScriptInstance
{
    #region Notes
    /* 
      Members:
        RhinoDoc RhinoDocument
        GH_Document GrasshopperDocument
        IGH_Component Component
        int Iteration

      Methods (Virtual & overridable):
        Print(string text)
        Print(string format, params object[] args)
        Reflect(object obj)
        Reflect(object obj, string method_name)
    */
    #endregion

    private void RunScript(List<double> x, ref object a)
    {
        double max=-1e10;
        foreach (double d in x){
            if (max<d){
                max=d;
            }
        }
        a = max;
    }
}
# ---------- end max ----------
construct_domain = ConstructDomain(DomainStart=0, DomainEnd=max)
remap_numbers = RemapNumbers(Value=number_2, Source=construct_domain, Target=Domain(0, 1))  # -> Mapped, Clipped
mapped = ClusterOutput(remap_numbers.Mapped)

# ==== cluster Cluster_4
vertices = ClusterInput()
polyline = PolyLine(Vertices=vertices, Closed=False)  # -> flatten(Polyline)
clean_tree = CleanTree(RemoveNulls="true", RemoveInvalid="true", RemoveEmpty="true", Tree=polyline)
reparameterize_curve = ReparameterizeCurve(Curve=clean_tree)  # -> Reparameterized, Original
reparameterized = ClusterOutput(reparameterize_curve.Reparameterized)

# ==== cluster Filter
min = ClusterInput()
curve = ClusterInput()
north = ClusterInput()
seed = ClusterInput()
curve_2 = Curve(curve)
list_length = ListLength(List=curve_2)
random = Random(Range=Domain(0, 1), Number=list_length, Seed=seed)
vážení = CSharpScript(rnd=random, north=north, min=min)  # -> a; inputs rnd: Double, north: Double, min: Double
# ---------- vážení: C# ----------
#region Usings
using System;
using System.Linq;
using System.Collections;
using System.Collections.Generic;
using System.Drawing;

using Rhino;
using Rhino.Geometry;

using Grasshopper;
using Grasshopper.Kernel;
using Grasshopper.Kernel.Data;
using Grasshopper.Kernel.Types;
#endregion

public class Script_Instance : GH_ScriptInstance {
    private void RunScript(double rnd, double north, double min, ref object a) {
        a = north<rnd+min;
    }
}
# ---------- end vážení ----------
dispatch = Dispatch(List=curve_2, DispatchPattern=vážení)  # -> ListA, ListB
list_a = ClusterOutput(dispatch.ListA)
