# Grasshopper definition sasi.gh (Grasshopper 1.0.8)
# plug-ins: Pufferfish, Rhino.Inside for Autodesk Revit, Weaverbird

geometry_pipeline = GeometryPipeline(
    GroupByLayer=False,
    GroupByType=False,
    IncludeHidden=True,
    IncludeLocked=True,
    LayerFilter="fasada_podklad::other",
    NameFilter="*",
    SublayerFiltering=True,
    TypeFilter=1073741848)
geometry_pipeline_2 = GeometryPipeline(
    GroupByLayer=False,
    GroupByType=False,
    IncludeHidden=True,
    IncludeLocked=True,
    LayerFilter="fasada_podklad::spodek",
    NameFilter="*",
    SublayerFiltering=True,
    TypeFilter=1073741848)
# GEOMETRIE
geometry_pipeline_3 = GeometryPipeline(
    GroupByLayer=False,
    GroupByType=False,
    IncludeHidden=True,
    IncludeLocked=True,
    LayerFilter="fasada_podklad::main",
    NameFilter="*",
    SublayerFiltering=True,
    TypeFilter=1073741848)
geometry_pipeline_4 = GeometryPipeline(
    GroupByLayer=False,
    GroupByType=False,
    IncludeHidden=True,
    IncludeLocked=True,
    LayerFilter="fasada_podklad::balkonova",
    NameFilter="*",
    SublayerFiltering=True,
    TypeFilter=1073741848)
merge = Merge(Data1=geometry_pipeline_3, Data2=geometry_pipeline_4, Data3=geometry_pipeline_2, Data4=geometry_pipeline)

file_path = FilePath("C:\Users\geftg\Desktop\dp2\praha epw\CZE_PM_Praha-Karlov-Klementinum.115190_TMYx.epw")
# SVĚTELNÁ ANALÝZA
importepw = LBImportEPW(epw_file=file_path)  # -> location, dry_bulb_temperature, dew_point_temperature, relative_humidity, wind_speed, wind_direction, direct_normal_rad, diffuse_horizontal_rad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; plug-in component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

# ----
# KRITICKÉ OBDOBÍ PŘED PRÁZDNINAMI
analysisperiod = LBAnalysisPeriod(start_month=Slider(1, range=1..12), start_day=1, start_hour=0, end_month=Slider(7, range=1..12))  # -> period, hoys, dates; plug-in component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

number = Number("0.4")

geometry_pipeline_5 = GeometryPipeline(
    GroupByLayer=False,
    GroupByType=False,
    IncludeHidden=True,
    IncludeLocked=True,
    LayerFilter="strecha",
    NameFilter="*",
    SublayerFiltering=True,
    TypeFilter=1073741848)
geometry_pipeline_6 = GeometryPipeline(
    GroupByLayer=False,
    GroupByType=False,
    IncludeHidden=True,
    IncludeLocked=True,
    LayerFilter="fasada",
    NameFilter="*",
    SublayerFiltering=True,
    TypeFilter=1073741848)
geometry = Geometry([<mesh referenced from the Rhino model> x11])
merge_2 = Merge(Data1=geometry, Data2=geometry_pipeline_5, Data3=geometry_pipeline_6)

brep_join = BrepJoin(Breps=merge)  # -> Breps, Closed
vector = Vector(Vector(0, 0, 6000))

geometry_pipeline_7 = GeometryPipeline(
    GroupByLayer=False,
    GroupByType=False,
    IncludeHidden=True,
    IncludeLocked=True,
    LayerFilter="win types 3D::kancelare top::mid",
    NameFilter="*",
    SublayerFiltering=True,
    TypeFilter=4)
geometry_pipeline_8 = GeometryPipeline(
    GroupByLayer=False,
    GroupByType=False,
    IncludeHidden=True,
    IncludeLocked=True,
    LayerFilter="win types 3D::kancelare::mid",
    NameFilter="*",
    SublayerFiltering=True,
    TypeFilter=4)

# ----
# OŘÍZNOUT OKRAJE KŘIVKY
# AKTRAKTOR
geometry_pipeline_9 = GeometryPipeline(
    GroupByLayer=False,
    GroupByType=False,
    IncludeHidden=True,
    IncludeLocked=True,
    LayerFilter="win types 3D::chodby::mid",
    NameFilter="*",
    SublayerFiltering=True,
    TypeFilter=4)
dis_ends = Slider(2586, range=0..4000)
cluster = Cluster_12(curve=geometry_pipeline_9, number=dis_ends)

# ----
# KŘIVKY OKEN
# OŘÍZNOUT OKRAJE KŘIVKY
geometry_pipeline_10 = GeometryPipeline(
    GroupByLayer=False,
    GroupByType=False,
    IncludeHidden=True,
    IncludeLocked=True,
    LayerFilter="win types 3D::ucebny top sever::mid",
    NameFilter="*",
    SublayerFiltering=True,
    TypeFilter=4)
cluster_2 = Cluster_11(curve=geometry_pipeline_10, number=Slider(1273, range=0..2000))

velikost = Slider(2000, range=0..5000)
max_distance = Slider(500, range=0..2000)
number_slider = Slider(0.999, range=0..1)
název_funkce = Panel("stamp_wryp")

# ----
# KŘIVKY OKEN
# OŘÍZNOUT OKRAJE KŘIVKY
# AKTRAKTOR
geometry_pipeline_11 = GeometryPipeline(
    GroupByLayer=False,
    GroupByType=False,
    IncludeHidden=True,
    IncludeLocked=True,
    LayerFilter="win types 3D::velka prednaskova",
    NameFilter="*",
    SublayerFiltering=True,
    TypeFilter=4)
cluster_3 = Cluster_10(curve=geometry_pipeline_11, A=velikost, B=Slider(1.438, range=1..2))

size = Slider(3783, range=0..5000)

len = Slider(900, range=0..2000)
len_2 = Slider(650, range=0..2000)

# ----
# ZÁKLADOVÉ KŘIVKY OKEN
# OŘÍZNOUT OKRAJE KŘIVKY
# AKTRAKTOR
ends_trim = Slider(906, range=0..1000)
cluster_4 = Cluster_13(number=ends_trim, curve=geometry_pipeline_7)
cluster_5 = Cluster_14(number=ends_trim, curve=geometry_pipeline_8)
divide_window = Slider(1900, range=500..2500)
divide_length = DivideLength(Curve=cluster_5, Length=divide_window)  # -> Points, Tangents, Parameters
divide_length_2 = DivideLength(Curve=cluster_4, Length=divide_window)  # -> Points, Tangents, Parameters
cluster_6 = Cluster_15(point=divide_length.Points, factor=len)
cluster_7 = Cluster_15(point=divide_length_2.Points, factor=len_2)

number_slider_2 = Slider(0.99, range=0..1)
max_distance_2 = Slider(524, range=0..2000)
size_2 = Slider(4000, range=0..5000)
c_script = CSharpScript(curve=cluster, area=size_2, strength=max_distance_2, math_type="stamp_wryp", trim=number_slider_2)  # -> a; inputs curve: Curve, area: Double, strength: Double, math_type: String, trim: Double
# ---------- c_script: C# ----------
#region Usings
using System;
using System.Linq;
using System.Collections;
using System.Collections.Generic;
using System.Drawing;

using Rhino;
using Rhino.Geometry;

using Grasshopper;
using Grasshopper.Kernel;
using Grasshopper.Kernel.Data;
using Grasshopper.Kernel.Types;
#endregion

public class Script_Instance : GH_ScriptInstance {
    private void RunScript(
		Curve curve,
		double area,
		double strength,
		string math_type,
		double trim,
		ref object a) {

        mAttractor atractorSetting = new mAttractor() {
            type = math_type,
            strength = strength,
            area = area,
            trim=trim,
            curve=curve
        };

        a = atractorSetting;
    } 
}

public struct mAttractor{
    public string type;
    public double strength;
    public double area;
    public double trim;
    public Curve curve;
}
# ---------- end c_script ----------

c_script_2 = CSharpScript(curve=cluster_3, area=velikost, strength=max_distance, math_type=název_funkce, trim=number_slider)  # -> a; inputs curve: Curve, area: Double, strength: Double, math_type: String, trim: Double; same code as c_script

# ----
# ATRAKTOR PŘEDNÁŠKOVÉ
# ATRAKTOR CHODBY
# ATRAKTOR VELKÉ PŘEDNÁŠKOVÉ UČEBNY
# ATRAKTORY KANCELÁŘSKÝCH OKEN
# ATRAKTORY UČEBEN
# ATRAKTORY UČEBEN - SEVER
merge_3 = Merge(Data1=cluster_6, Data2=cluster_7)

size_3 = Slider(700, range=0..5000)
max_distance_3 = Slider(524, range=0..2000)
number_slider_3 = Slider(0.5, range=0..1)
c_script_3 = CSharpScript(curve=merge_3, area=size_3, strength=max_distance_3, math_type="angHoleY", trim=number_slider_3)  # -> a; inputs curve: Curve, area: Double, strength: Double, math_type: String, trim: Double; same code as c_script

max_distance_4 = Slider(524, range=0..2000)  # disabled
number_slider_4 = Slider(0.5, range=0..1)  # disabled
panel = Panel("angHoleY")  # disabled
c_script_4 = CSharpScript(curve=cluster_7, area=size_3, strength=max_distance_4, math_type=panel, trim=number_slider_4)  # -> a; inputs curve: Curve, area: Double, strength: Double, math_type: String, trim: Double; disabled; same code as c_script

počet_face_meshe = Slider(20000, range=0..50000)
# PŘEVÉST BREP NA MESH
cluster_8 = Cluster(breps=merge, target_count=počet_face_meshe)

# ---- group: draft preview
# SPOČÍTAT POVRCH
colour_swatch = ColourSwatch(SwatchColor=RGB(178, 178, 178))
custom_preview = CustomPreview(Geometry=cluster_8, Material=colour_swatch)  # disabled

# ----
geometry_pipeline_12 = GeometryPipeline(
    GroupByLayer=False,
    GroupByType=False,
    IncludeHidden=True,
    IncludeLocked=True,
    LayerFilter="win types 3D::end",
    NameFilter="*",
    SublayerFiltering=True,
    TypeFilter=4)
quality = Slider(16, range=0..16)
curve = Curve(<curve referenced from the Rhino model>)  # disabled
control_points = ControlPoints(Curve=curve)  # -> Points, Weights, Knots; disabled
deconstruct_mesh = DeconstructMesh(Mesh=cluster_8)  # -> Vertices, Faces, Colours, Normals; disabled
plane_fit = PlaneFit(Points=control_points.Points)  # -> flatten(Plane), Deviation; disabled
panel_2 = Panel("0")  # disabled
scale_nu = ScaleNU(Geometry=curve, Plane=plane_fit.Plane, ScaleX=1, ScaleY=1, ScaleZ=panel_2)  # -> graft(Geometry), Transform; disabled
close_curve = CloseCurve(Curve=scale_nu.Geometry, CloseType=0, Bulge=0.5, Tolerance=0)  # -> Closed, ResultBoolean; disabled
boundary_surfaces = BoundarySurfaces(Edges=close_curve.Closed)  # disabled

# ---- group: hodinove obdobi
number_slider_5 = Slider(8, range=1..12)
number_slider_6 = Slider(17, range=1..24)

# ---- group: to brep / slow
merge_faces = MergeFaces()  # -> Breps, Before, After; disabled

# ---- group: to brep
brep = Brep()  # disabled
deconstruct_brep = DeconstructBrep(Brep=merge_faces.Breps)  # -> Faces, Edges, Vertices; disabled

# ----
tickness = Slider(100, range=1..700)

file_path_2 = FilePath("C:\Users\geftg\Desktop\dp2\praha epw\CZE_PM_Praha-Karlov-Klementinum.115190_TMYx.epw")
# SOLÁRNÍ ANALÝZA
importepw_2 = LBImportEPW(epw_file=file_path_2)  # -> location, dry_bulb_temperature, dew_point_temperature, relative_humidity, wind_speed, wind_direction, direct_normal_rad, diffuse_horizontal_rad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; plug-in component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

detail_level = DetailLevel({"Coarse": 1, "Medium": 2, "Fine": 3}, selected="Coarse")  # disabled
wall = Wall([<wall referenced from the Revit model> x2])  # disabled
wall_2 = Wall([<wall referenced from the Revit model> x12])  # disabled
colour_swatch_2 = ColourSwatch(SwatchColor=RGB(74, 31, 31))  # disabled
category = Category(<category referenced from the Revit model>)  # disabled
element_geometry = ElementGeometry(Elements=wall_2, DetailLevel=detail_level)  # disabled
category_filter = CategoryFilter(Categories=category, Inverted=False)  # disabled
query_elements = QueryElements(Filter=category_filter, Limit=100)  # -> Elements, Count; disabled
custom_preview_2 = CustomPreview(Geometry=element_geometry, Material=colour_swatch_2)  # disabled
mesh = Mesh()

# ---- group: extrude
boolean_toggle = BooleanToggle(True)  # disabled
boolean_toggle_2 = BooleanToggle(False)  # disabled
boolean_toggle_3 = BooleanToggle(True)  # disabled
mesh_offset_extrude = MeshOffsetExtrude(M=mesh, B=boolean_toggle_2, E=boolean_toggle, C0=boolean_toggle_3, C1=True, D=1)  # -> out, A; inputs M: Mesh, V: list of Vector3d, D: list; disabled
# ---------- mesh_offset_extrude: VB usings ----------
Imports System.IO
Imports System.Linq
Imports System.Data
Imports System.Drawing
Imports System.Reflection
Imports System.Windows.Forms
Imports System.Xml
Imports System.Xml.Linq
Imports Microsoft.VisualBasic
Imports System.Runtime.InteropServices

Imports Rhino.DocObjects
Imports Rhino.Collections
Imports GH_IO
Imports GH_IO.Serialization
# ---------- mesh_offset_extrude: VB ----------
    Component.Params.Input(0).Name = "Mesh"
    Component.Params.Input(0).Description = "Open or closed mesh"
    Component.Params.Input(1).Name = "Both Sides"
    Component.Params.Input(1).Description = "If true the mesh is offset in both directions along the vertex normals"
    Component.Params.Input(2).Name = "Edges"
    Component.Params.Input(2).Description = "If true the mesh will contain faces on the edges between the two offset mesh faces"
    Component.Params.Input(3).Name = "Closed Bottom"
    Component.Params.Input(3).Description = "If true the mesh will be closed on the origin face"
    Component.Params.Input(4).Name = "Closed Top"
    Component.Params.Input(4).Description = "If true the mesh will be closed on the offset face"
    Component.Params.Input(5).Name = "Vector [Vertex]"
    Component.Params.Input(5).Description = "An optional vector that sets the direction of extrusion, if empty, the new mesh will be offset along the vertex normals"
    Component.Params.Input(6).Name = "Distance [Vertex, Rh Units]"
    Component.Params.Input(6).Description = "A single number or list of numbers corresponding to each vertex of a mesh which sets the Rhino unit based distance that the new geometry is offset from each mesh face"

    Component.Params.Output(1).Name = "Mesh"
    Component.Params.Output(1).Description = "If successful, a valid mesh"

    If m IsNot Nothing Then

      Dim mf As Rhino.Geometry.Collections.MeshFaceList = Nothing
      Dim mv As Rhino.Geometry.Collections.MeshVertexList = Nothing
      Dim mtv As Rhino.Geometry.Collections.MeshTopologyVertexList = Nothing
      Dim mte As Rhino.Geometry.Collections.MeshTopologyEdgeList = Nothing
      Dim mn As Rhino.Geometry.Collections.MeshVertexNormalList = Nothing
      Dim mc As Rhino.Geometry.Collections.MeshVertexColorList = Nothing

      mf = m.Faces
      mv = m.Vertices
      mtv = m.TopologyVertices
      mte = m.TopologyEdges
      mn = m.Normals
      mc = m.VertexColors

      Dim clrB As Boolean = False
      If mc.count() > 0 Then clrB = True

      Dim i,cv,cf,u(1),hd As Integer
      Dim blnV As Boolean
      Dim vec As vector3d
      Dim ova, ovb As New list(Of point3d)
      Dim vf As New list(Of Vector3f)
      Dim ofc As New list(Of MeshFace)
      If b Then hd = 2 Else hd = 1

      cv = mv.count()
      cf = mf.count()

      If (D.count() - 1) < cv Then D = matchDbl(D, cv)

      If v.count() > 0 Then
        blnV = True
        If (V.count() - 1) < cv Then V = matchVec(V, cv)
      End If

      'Define Base Vertices
      For i = 0 To cv - 1 Step 1
        If blnV Then vec = V(i) Else vec = mn(i)
        vec.Unitize()
        vec *= (D(i) / hd)

        ovb.add(New point3d(mv(i)) + vec)
        If Not b Then vec *= 0
        vec.Reverse()
        ova.add(New point3d(mv(i)) + vec)
      Next

      If (c0 Or (((Not c0) And (Not e)) And c1)) Then ofc = mf.ToList()

      If ((e or c0) And c1) Then
        For i = 0 To cf - 1 Step 1
          If mf(i).isquad() Then
            ofc.add(New meshface(mf(i).A + cv, mf(i).B + cv, mf(i).C + cv, mf(i).D + cv))
          Else
            ofc.add(New meshface(mf(i).A + cv, mf(i).B + cv, mf(i).C + cv))
          End If
        Next
      End If

      If e Then
        For i = 0 To mte.count() - 1 Step 1

          u(0) = mtv.MeshVertexIndices(mte.GetTopologyVertices(i).I)(0)
          u(1) = mtv.MeshVertexIndices(mte.GetTopologyVertices(i).J)(0)

          If (mte.GetConnectedFaces(i).Length - 1) < 1 Then
            ofc.add(New meshface(u(0), u(1), u(1) + cv, u(0) + cv))
          End If
        Next
      End If

      Dim mo As New mesh

      If (c0 Or e) Then
        mo.Vertices.AddVertices(ova.toarray())
        If clrB Then mo.VertexColors.AppendColors(mc.ToArray())
      End If
      If (c1 Or e) Then
        mo.Vertices.AddVertices(ovb.toarray())
        If clrB Then mo.VertexColors.AppendColors(mc.ToArray())
      End If

      mo.Faces.AddFaces(ofc)

      A = mo
    End If
# ---------- mesh_offset_extrude: VB additional code ----------
  Private Function matchDbl(ByVal a As list(Of Double), ByVal t As Integer)
    Dim i,k As Integer
    k = a.count()
    For i = 0 To ((t + 1) - k) - 1 Step 1
      a.add(a.item(k - 1))
    Next
    Return a
  End Function

  Private Function matchVec(ByVal a As list(Of vector3d), ByVal t As Integer)
    Dim i,k As Integer
    k = a.count()
    For i = 0 To ((t + 1) - k) - 1 Step 1
      a.add(a.item(k - 1))
    Next
    Return a
  End Function
# ---------- end mesh_offset_extrude ----------

# ----
weaverbird_s_bevel_vertices = WeaverbirdsBevelVertices(MeshPolylines=mesh, Distance=5, InsetType=0, OutputGeometryAsMesh=True)  # disabled
weaverbird_s_blur_mesh = WeaverbirdsBlurMesh(MeshCurves=mesh, Level=Slider(2, range=0..2), Thin=1)  # disabled
weaverbird_s_sierpinski_carpet = WeaverbirdsSierpinskiCarpet(MeshPolylines=mesh, Distance=5, InsetType=0)  # disabled
weaverbird_s_sierpinski_triangles_subdiv = WeaverbirdsSierpinskiTrianglesSubdivision(Level=Slider(10, range=10..1000))  # disabled
weaverbird_s_stellate_cumulation = WeaverbirdsStellateCumulation(Distance=Slider(1000, range=10..1000))  # disabled
weaverbird_s_dual_graph = WeaverbirdsDualGraph(MeshCurves=mesh, DualMode=Slider(1, range=0..1))  # disabled
weaverbird_s_vertices_component = WeaverbirdsVerticesComponent(MeshClosedPolylinesGroup=mesh, Weld=True)  # disabled
deconstruct_mesh_2 = DeconstructMesh(Mesh=weaverbird_s_bevel_vertices)  # -> Vertices, Faces, Colours, Normals; disabled
mesh_naked_edges = MeshNakedEdges(Mesh=mesh)  # -> Naked, ResultBoolean; disabled
multipipe = MultiPipe(
    Curves=weaverbird_s_dual_graph,
    NodeSize=Slider(393, range=0..1000),
    EndOffset=1,
    StrutSize=1,
    Segment=0,
    KinkAngle=0.6,
    CubeFit=0,
    Caps=0)  # disabled

# ----
# LOKACE
# SOLÁRNÍ ANALÝZA
skymatrix = LBCumulativeSkyMatrix(
    location=importepw.location,
    direct_rad=importepw.direct_normal_rad,
    diffuse_rad=importepw.diffuse_horizontal_rad,
    hoys=analysisperiod.hoys)  # -> out, sky_mtx; plug-in component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

number_slider_7 = Slider(1500, range=1..10000)
incidentradiation = LBIncidentRadiation(
    sky_mtx=skymatrix.sky_mtx,
    geometry=flatten(brep_join.Breps),
    context=flatten(merge_2),
    grid_size=number_slider_7,
    offset_dist=Slider(1, range=1..10000),
    run=Toggle(True))  # -> out, points, results, total, mesh, legend, title, int_mtx; plug-in component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

max = CSharpScript(x=incidentradiation.results)  # -> a; inputs x: list of Double
# ---------- max: C# ----------
// Grasshopper Script Instance
#region Usings
using System;
using System.Linq;
using System.Collections;
using System.Collections.Generic;
using System.Drawing;

using Rhino;
using Rhino.Geometry;

using Grasshopper;
using Grasshopper.Kernel;
using Grasshopper.Kernel.Data;
using Grasshopper.Kernel.Types;
#endregion

public class Script_Instance : GH_ScriptInstance
{
    #region Notes
    /* 
      Members:
        RhinoDoc RhinoDocument
        GH_Document GrasshopperDocument
        IGH_Component Component
        int Iteration

      Methods (Virtual & overridable):
        Print(string text)
        Print(string format, params object[] args)
        Reflect(object obj)
        Reflect(object obj, string method_name)
    */
    #endregion

    private void RunScript(List<double> x, ref object a)
    {
        a = x.OrderBy(i=>i).ToArray()[x.Count-1];
    }
}
# ---------- end max ----------
construct_domain = ConstructDomain(DomainStart="150", DomainEnd=max)
division = Division(A=number_slider_7, B=2)

move = Move(Geometry=incidentradiation.legend, Motion=vector)  # -> Geometry, Transform

# ----
# OŘÍZNOUT OKRAJE KŘIVKY
# AKTRAKTOR
geometry_pipeline_13 = GeometryPipeline(
    GroupByLayer=False,
    GroupByType=False,
    IncludeHidden=True,
    IncludeLocked=True,
    LayerFilter="win types 3D::ucebny sever::mid",
    NameFilter="*",
    SublayerFiltering=True,
    TypeFilter=4)
reparameterize_curve = ReparameterizeCurve(Curve=geometry_pipeline_13)  # -> Reparameterized, Original

qulity = Slider(5, range=2..6)
c_script_5 = CSharpScript(
    curve=reparameterize_curve.Reparameterized,
    pts=incidentradiation.points,
    vals=incidentradiation.results,
    q=qulity,
    tol=division)  # -> a; inputs curve: Curve, pts: list of Point3d, vals: list of Double, q: Int32, tol: Double
# ---------- c_script_5: C# ----------
#region Usings
using System;
using System.Linq;
using System.Collections;
using System.Collections.Generic;
using System.Drawing;

using Rhino;
using Rhino.Geometry;

using Grasshopper;
using Grasshopper.Kernel;
using Grasshopper.Kernel.Data;
using Grasshopper.Kernel.Types;
#endregion

public class Script_Instance : GH_ScriptInstance{
    private void RunScript(
		Curve curve,
		List<Point3d> pts,
		List<double> vals,
		int q,
		double tol,
		ref object a)
    {
        Point3d[] ptsC=null;
        curve.DivideByCount(q, true, out ptsC);

        double total=0;
        int cnt=0;
        foreach (Point3d pt in ptsC){ 
            
            double val=0;
            double dismin=1e10;
            double selV=0;
            for (int i=0; i<pts.Count; i++) {
                Point3d p=pts[i];
                double ptVal=vals[i];

                double dis=p.DistanceTo(pt);

                if (dis<tol) {
                    selV=ptVal;
                    break;
                }
                if (dis<dismin) {
                    dismin=dis;
                    selV=ptVal;
                    continue;
                }
            }
            total+=selV;
            cnt++;
        }


        a = total/cnt;
    }
}
# ---------- end c_script_5 ----------

remap = Remap(value=c_script_5, source=construct_domain)

multiplication = Multiplication(A=remap, B=Slider(1373, range=0..2000))
ending_curve_trim = EndingCurveTrim(number=multiplication, curve=reparameterize_curve.Reparameterized)

size_4 = Slider(2000, range=0..5000)
number_slider_8 = Slider(0.5, range=0..1)
max_distance_5 = Slider(524, range=0..2000)
c_script_6 = CSharpScript(curve=ending_curve_trim, area=size_4, strength=max_distance_5, math_type="angHoleZ", trim=number_slider_8)  # -> a; inputs curve: Curve, area: Double, strength: Double, math_type: String, trim: Double; same code as c_script

# ----
# AKTRAKTOR
# OŘÍZNOUT OKRAJE KŘIVKY
geometry_pipeline_14 = GeometryPipeline(
    GroupByLayer=False,
    GroupByType=False,
    IncludeHidden=True,
    IncludeLocked=True,
    LayerFilter="win types 3D::prednaskovky::mid",
    NameFilter="*",
    SublayerFiltering=True,
    TypeFilter=4)
# ATRAKTORY OKEN
reparameterize_curve_2 = ReparameterizeCurve(Curve=geometry_pipeline_14)  # -> Reparameterized, Original
division_2 = Division(A=size, B=Slider(1.4, range=1..2))

qulity_2 = Slider(3, range=2..6)
c_script_7 = CSharpScript(
    curve=reparameterize_curve_2.Reparameterized,
    pts=incidentradiation.points,
    vals=incidentradiation.results,
    q=qulity_2,
    tol=division)  # -> a; inputs curve: Curve, pts: list of Point3d, vals: list of Double, q: Int32, tol: Double; same code as c_script_5
remap_numbers = RemapNumbers(Value=c_script_7, Source=construct_domain, Target=Domain(0, 1))  # -> Mapped, Clipped
division_3 = Division(A=remap_numbers.Clipped, B=number)

multiplication_2 = Multiplication(A=division_3, B=division_2)
cluster_9 = Cluster_16(curve=reparameterize_curve_2.Reparameterized, number=multiplication_2)

number_slider_9 = Slider(0.999, range=0..1)
max_distance_6 = Slider(500, range=0..2000)
c_script_8 = CSharpScript(curve=cluster_9, area=size, strength=max_distance_6, math_type="stamp_wryp", trim=number_slider_9)  # -> a; inputs curve: Curve, area: Double, strength: Double, math_type: String, trim: Double; same code as c_script

# ----
# OŘÍZNOUT OKRAJE KŘIVKY
geometry_pipeline_15 = GeometryPipeline(
    GroupByLayer=False,
    GroupByType=False,
    IncludeHidden=True,
    IncludeLocked=True,
    LayerFilter="win types 3D::top ucebny::mid",
    NameFilter="*",
    SublayerFiltering=True,
    TypeFilter=4)
reparameterize_curve_3 = ReparameterizeCurve(Curve=geometry_pipeline_15)  # -> Reparameterized, Original
number_2 = Number(Slider(1412, range=0..2000))

qulity_3 = Slider(3, range=2..6)
c_script_9 = CSharpScript(
    curve=reparameterize_curve_3.Reparameterized,
    pts=incidentradiation.points,
    vals=incidentradiation.results,
    q=qulity_3,
    tol=division)  # -> a; inputs curve: Curve, pts: list of Point3d, vals: list of Double, q: Int32, tol: Double; same code as c_script_5
remap_numbers_2 = RemapNumbers(Value=c_script_9, Source=construct_domain, Target=Domain(0, 1))  # -> Mapped, Clipped
division_4 = Division(A=remap_numbers_2.Clipped, B=number)

multiplication_3 = Multiplication(A=number_2, B=division_4)
cluster_10 = Cluster_17(number=multiplication_3, curve=reparameterize_curve_3.Reparameterized)

# ----
# OŘÍZNOUT OKRAJE KŘIVKY
geometry_pipeline_16 = GeometryPipeline(
    GroupByLayer=False,
    GroupByType=False,
    IncludeHidden=True,
    IncludeLocked=True,
    LayerFilter="win types 3D::ucebny::mid",
    NameFilter="*",
    SublayerFiltering=True,
    TypeFilter=4)
reparameterize_curve_4 = ReparameterizeCurve(Curve=geometry_pipeline_16)  # -> Reparameterized, Original

qulity_4 = Slider(4, range=2..6)
c_script_10 = CSharpScript(
    curve=reparameterize_curve_4.Reparameterized,
    pts=incidentradiation.points,
    vals=incidentradiation.results,
    q=qulity_4,
    tol=division)  # -> a; inputs curve: Curve, pts: list of Point3d, vals: list of Double, q: Int32, tol: Double; same code as c_script_5
remap_numbers_3 = RemapNumbers(Value=c_script_10, Source=construct_domain, Target=Domain(0, 1))  # -> Mapped, Clipped
division_5 = Division(A=remap_numbers_3.Clipped, B=number)

multiplication_4 = Multiplication(A=Slider(1500, range=0..1500), B=division_5)
cluster_11 = Cluster_17(curve=reparameterize_curve_4.Reparameterized, number=multiplication_4)

number_slider_10 = Slider(0.5, range=0..1)
# AKTRAKTOR
size_5 = Slider(2000, range=0..5000)
max_distance_7 = Slider(524, range=0..2000)
c_script_11 = CSharpScript(
    curve=[cluster_2, cluster_10, cluster_11],
    area=size_5,
    strength=max_distance_7,
    math_type="angHoleZ",
    trim=number_slider_10)  # -> a; inputs curve: Curve, area: Double, strength: Double, math_type: String, trim: Double; same code as c_script

merge_4 = Merge(
    Data1=cluster_9,
    Data2=cluster,
    Data3=cluster_3,
    Data4=merge_3,
    Data5=cluster_10,
    Data6=ending_curve_trim,
    Data7=cluster_11,
    Data8=cluster_2)
merge_5 = Merge(
    Data1=c_script_8,
    Data2=c_script,
    Data3=c_script_3,
    Data4=c_script_4,
    Data5=c_script_6,
    Data6=c_script_11,
    Data7=c_script_2)
c_script_12 = CSharpScript(mesh=cluster_8, atractor_settings=merge_5, quality=quality, endings=geometry_pipeline_12)  # -> a; inputs mesh: Mesh, atractor_settings: list, quality: Int32, endings: list of Curve
# ---------- c_script_12: C# ----------
#region Usings
using System;
using System.Linq;
using System.Collections;
using System.Collections.Generic;
using System.Drawing;

using Rhino;
using Rhino.Geometry;

using Grasshopper;
using Grasshopper.Kernel;
using Grasshopper.Kernel.Data;
using Grasshopper.Kernel.Types;
#endregion

public class Script_Instance : GH_ScriptInstance{
    static List<mAttractor> atractors;
    static bool[] removeMask;
    static Mesh newMesh;

    static Point3f[] notMovedVerts;
    static int iterations;
    static List<Curve> c_endings;
    private void RunScript(
		Mesh mesh,
		List<object> atractor_settings,
		int quality,
		List<Curve> endings,
		ref object a) {
        c_endings=endings;

        // cast atractors
        atractors=new List<mAttractor>();
        foreach (object at in atractor_settings) {
            atractors.Add(new mAttractor(at));
        }
        
        iterations=quality;

        newMesh = mesh.DuplicateMesh();
        newMesh.Normals.ComputeNormals();

        removeMask = new bool[newMesh.Vertices.Count];
        notMovedVerts = new Point3f[newMesh.Vertices.Count];

        // loop verticles, move with them
        for (int i = 0; i < newMesh.Vertices.Count; i++)  {
            Point3d pt = newMesh.Vertices[i];
            Vector3d normal=newMesh.Normals[i];

            Point3f movedPt;
            bool rem = calcVertex2(pt, normal, out movedPt);

            notMovedVerts[i] = newMesh.Vertices[i];
            newMesh.Vertices[i] += movedPt;//result.Item2;
            removeMask[i] = rem;//result.Item1;
        }

        // --- REMOVE FACES USING DELETED VERTICES ---
        List<MeshFace> newFaces = new List<MeshFace>();
        for (int f = 0; f < newMesh.Faces.Count; f++) {
            var face = newMesh.Faces[f];

            bool isQuad = face.IsQuad;
            int[] verts = isQuad ?
                new int[] { face.A, face.B, face.C, face.D } :
                new int[] { face.A, face.B, face.C };

            List<int> alive = new List<int>();
            foreach (int v in verts) {
                if (!removeMask[v]){
                    alive.Add(v);
                }
            }

            // not trimmed
            if (isQuad && alive.Count==4) {
                newFaces.Add(new MeshFace(alive[0], alive[1], alive[2], alive[3])); //full ok                
            } else if (!isQuad && alive.Count==3) {
                newFaces.Add(new MeshFace(alive[0], alive[1], alive[2]));
            }else if (alive.Count==0) {
                // nothing
            } else {
               // continue;
                //trim
                if (isQuad){
                    if (alive.Count==3) {
                        // look up for possible pts

                        // Find which vertex is removed
                        int removed = verts.First(v => removeMask[v]);

                        // Find its neighbors in quad order
                        int i = Array.IndexOf(verts, removed);
                        int vPrev = verts[i-1>=0 ? i-1 : verts.Length-1];
                        int vNext = verts[i+1<=verts.Length-1 ? i+1 : 0];
                        int oppositeOfRemoved = verts[i+2<=verts.Length-1 ? i+2 : i-2];

                        // Intersection points
                        Point3f p1 = GetTrimEstLoc(vPrev, removed/*, out bool isvertex*/);
                        Point3f p2 = GetTrimEstLoc(vNext, removed/*, out bool isvertex2*/);

                        int i1 = AddIntersectionSafe(p1);
                        int i2 = AddIntersectionSafe(p2);

                        // Create triangles - not great
                        /* newFaces.Add(new MeshFace(oppositeOfRemoved, vPrev, i1));
                        newFaces.Add(new MeshFace(oppositeOfRemoved, i1, i2));
                        newFaces.Add(new MeshFace(oppositeOfRemoved, i2, vNext)); */
                         
                        // for compare
                        newFaces.Add(new MeshFace(oppositeOfRemoved, vPrev, vNext)); // works
                        newFaces.Add(new MeshFace(vPrev, i1, i2, vNext));// works
                    }else if (alive.Count==2) {
                        // todo try to add pts on edges and check, if it's possible add subdivision
                        // look up GetTrimEstLoc() for possible third pt

                        int aa = alive[0];
                        int bb = alive[1];

                        // Removed vertices based on original face order
                        int[] removed = verts.Where(v => removeMask[v]).ToArray();

                        // next each ones
                        Point3f pA1, pA2;
                        if (removeMask[verts[0]] && removeMask[verts[1]] && !removeMask[verts[2]] && !removeMask[verts[3]]){
                            pA1 = GetTrimEstLoc(verts[2], verts[1]/*, out bool isvertex*/);
                            pA2 = GetTrimEstLoc(verts[3], verts[0]/*, out bool isvertex2*/);
                            
                          //  if (isvertex) continue;
                        //    if (isvertex2) continue;

                            int iA1 = AddIntersectionSafe(pA1);
                            int iA2 = AddIntersectionSafe(pA2);
                            
                            newFaces.Add(new MeshFace(iA2, iA1, verts[2], verts[3]));
                        }else if (removeMask[verts[0]] && !removeMask[verts[1]] && !removeMask[verts[2]] && removeMask[verts[3]]){
                            pA1 = GetTrimEstLoc(verts[1], verts[0]/*, out bool isvertex*/);
                            pA2 = GetTrimEstLoc(verts[2], verts[3]/*, out bool isvertex2*/);

                           // if (isvertex) continue;
                          //  if (isvertex2) continue;

                            int iA1 = AddIntersectionSafe(pA1);
                            int iA2 = AddIntersectionSafe(pA2);

                            newFaces.Add(new MeshFace(iA1, verts[1], verts[2], iA2));
                        }else if (!removeMask[verts[0]] && !removeMask[verts[1]] && removeMask[verts[2]] && removeMask[verts[3]]){
                            pA1 = GetTrimEstLoc(verts[0], verts[3]/*, out bool isvertex*/);
                            pA2 = GetTrimEstLoc(verts[1], verts[2]/*, out bool isvertex2*/);

                            int iA1 = AddIntersectionSafe(pA1);
                            int iA2 = AddIntersectionSafe(pA2);

                          //  if (isvertex) continue;
                          //  if (isvertex2) continue;

                            newFaces.Add(new MeshFace(verts[0], verts[1], iA2, iA1));
                        }else if (!removeMask[verts[0]] && removeMask[verts[1]] && removeMask[verts[2]] && !removeMask[verts[3]]){
                            pA1 = GetTrimEstLoc(verts[0], verts[1]/*, out bool isvertex*/);
                            pA2 = GetTrimEstLoc(verts[3], verts[2]/*, out bool isvertex2*/);

                            int iA1 = AddIntersectionSafe(pA1);
                            int iA2 = AddIntersectionSafe(pA2);

                         //   if (isvertex) continue;
                          //  if (isvertex2) continue;

                            newFaces.Add(new MeshFace(verts[0], iA1, iA2, verts[3]));
                        }else{
                            // cross
                            if (!removeMask[verts[0]] && removeMask[verts[1]] && !removeMask[verts[2]] && removeMask[verts[3]]){
                                Point3f pA3, pA4;
                                pA1 = GetTrimEstLoc(verts[0], verts[1]/*, out bool isvertex*/);
                                pA2 = GetTrimEstLoc(verts[2], verts[1]/*, out bool isvertex2*/);
                                pA3 = GetTrimEstLoc(verts[2], verts[3]/*, out bool isvertex3*/);
                                pA4 = GetTrimEstLoc(verts[0], verts[3]/*, out bool isvertex4*/);

                                int iA1 = AddIntersectionSafe(pA1);
                                int iA2 = AddIntersectionSafe(pA2);
                                int iA3 = AddIntersectionSafe(pA3);
                                int iA4 = AddIntersectionSafe(pA4);

                              //  if (isvertex) continue;
                              //  if (isvertex2) continue;
                               // if (isvertex3) continue;
                               // if (isvertex4) continue;

                                newFaces.Add(new MeshFace(verts[0], iA1, iA3, iA4));
                                newFaces.Add(new MeshFace(iA1, iA2, verts[2],iA3));
                            }else if (removeMask[verts[0]] && !removeMask[verts[1]] && removeMask[verts[2]] && !removeMask[verts[3]]){
                                Point3f pA3, pA4;
                                pA1 = GetTrimEstLoc(verts[0], verts[1]/*, out bool isvertex */);
                                pA2 = GetTrimEstLoc(verts[2], verts[1]/*, out bool isvertex2*/);
                                pA3 = GetTrimEstLoc(verts[2], verts[3]/*, out bool isvertex3*/);
                                pA4 = GetTrimEstLoc(verts[0], verts[3]/*, out bool isvertex4*/);

                                int iA1 = AddIntersectionSafe(pA1);
                                int iA2 = AddIntersectionSafe(pA2);
                                int iA3 = AddIntersectionSafe(pA3);
                                int iA4 = AddIntersectionSafe(pA4);

                               //if (isvertex) continue;
                               //if (isvertex2) continue;
                               //if (isvertex3) continue;
                               //if (isvertex4) continue;

                                newFaces.Add(new MeshFace(verts[1], iA2, iA3, iA1));
                                newFaces.Add(new MeshFace(iA1, iA3, verts[3],iA4));
                            }
                            continue;
                        }

                    }else if (alive.Count==1) {
                        int alived = verts.First(v => !removeMask[v]);

                        // Find its neighbors in quad order
                        int i = Array.IndexOf(verts, alived);
                        int vPrev = verts[i-1>=0 ? i-1 : verts.Length-1];//removed before
                        int vNext = verts[i+1<=verts.Length-1 ? i+1 : 0];// removed after

                        // Intersection points
                        Point3f p1 = GetTrimEstLoc(alived, vPrev/*, out bool isvertex */);
                        Point3f p2 = GetTrimEstLoc(alived, vNext/*,  out bool isvertex2*/);

                        //if (isvertex) continue;// looks line every one, need to be fix
                        //if (isvertex2) continue;// looks line every one, need to be fix

                        int i1 = AddIntersectionSafe(p1);
                        int i2 = AddIntersectionSafe(p2);


                        // Create one triangle
                        newFaces.Add(new MeshFace(alive[0], i1, i2)); // do not adding for some reason
                    }
                }else{//I use only quadrs, but ...
                   /* if (alive.Count == 2) {
                       //todo try to add pts on edges and check, if it's possible add subdivision
                        // look up GetTrimEstLoc() for possible third pt

                         // removed vertex
                        int removed = verts.First(v => removeMask[v]);

                        // find intersection point
                        Point3f p = GetTrimEstLoc(alive[0], removed);
                        int ip = AddIntersectionSafe(p);

                        // new triangle
                        newFaces.Add(new MeshFace(alive[0], alive[1], ip)); 
                    } */
                }              
            }
        }

        newMesh.Faces.Clear();
        newMesh.Faces.AddFaces(newFaces);
   
        // remove vertices not used by any face
        newMesh.Vertices.CullUnused();

        newMesh.Normals.ComputeNormals();
        newMesh.Vertices.CombineIdentical(true, true);
        newMesh.Compact();

        a = newMesh;
    }
 
    /// <summary>Find estimated intersection between verticles, by iterations</summary>
    /// <returns>Moved pt</returns>
    public Point3f GetTrimEstLoc(int vertex1, int vertex2/*, out bool isvertex*/) {
        //Vector3d normal=newMesh.Normals[vertex1]; // face normal, or better arithmetics vertex normal with weights?

        bool r1 = removeMask[vertex1], r2 = removeMask[vertex2];
        if (r1 == r2) throw new Exception("Edge must be between alive and removed vertex.");
        
      //  false;
        bool flip=(r1 && !r2);// flip=true;
        
        //Point3d pA, pB; 
        
        Point3d alivePt,// = pA,
         deadPt;//  = pB;    
        Vector3d aliveN;
       Vector3d deadN;
        // Start & end
        if (flip){
            alivePt = notMovedVerts[vertex2];
            deadPt = notMovedVerts[vertex1];
            
            aliveN=newMesh.Normals[vertex2];
            deadN=newMesh.Normals[vertex1];
        }else{
            alivePt = notMovedVerts[vertex1];
            deadPt = notMovedVerts[vertex2];

            aliveN=newMesh.Normals[vertex1];
            deadN=newMesh.Normals[vertex2];         
        }
        

      //  Vector3d nA = newMesh.Normals[flip?vertex2:vertex1];
       // Vector3d nB = newMesh.Normals[flip?vertex1:vertex2];
            
   

        // or use: segment as v1-v2 line | strength/atr_used.strength?
        Point3f ret=newMesh.Vertices[vertex2];//moved
        // Binary search along the segment
        double t = 0.5;
        for (int i = 0; i < iterations; i++) {
            Point3d mid = alivePt + (deadPt - alivePt) * t;
            Vector3d midN = aliveN + (deadN - aliveN) * t;
          //  midN.Unitize();

            bool midRemove = calcVertex2(mid, midN/*normal*/, out Point3f offset);

            if (midRemove) {
                // The trim boundary is closer to the alive side
                deadPt = mid;
             //  
                deadN = midN;//midN;
            } else {
                // The trim boundary is closer to the removed side
                alivePt = mid;
                aliveN = midN;//midN;
            //   ret=(Point3f)mid+offset;
            } 
            ret=(Point3f)mid+offset;
        }

       // double tol=1e-6;// only one vertex from 50t, useless optimalization
              
        // Point3f a = newMesh.Vertices[flip?vertex2:vertex1],
        //     b = newMesh.Vertices[flip?vertex1:vertex2];

        // If the intersection collapses onto A or B, skip creating a new point
       //  if (ret.DistanceTo(a) < tol) { isvertex=true; return a;}
       // if (ret.DistanceTo(b) < tol) { isvertex=true; return b;}
       // isvertex=false; 

        // return new pos
        return ret;
    }

    /// <summary>
    /// Adds intersection point safely: checks if IP is identical/near existing vertices.
    /// Returns the index of either an existing vertex or a new one.
    /// </summary>
    int AddIntersectionSafe(Point3f ip) {
        const double tol = 1e-6;
        // Prevent adding duplicates: compare to all existing vertices
        for (int i = 0; i < newMesh.Vertices.Count; i++) {
            if (newMesh.Vertices[i].DistanceTo(ip) < tol) return i;
        }

        // Add as new vertex
        return newMesh.Vertices.Add(ip);
    }

    public bool calcVertex2(Point3d pt, Vector3d normal, out Point3f offset) {
        bool _remove = false;
        Vector3d sumOffset = Vector3d.Zero;

        foreach (mAttractor atr in atractors) {
            if (atr.curve==null) continue;
            if (!atr.curve.ClosestPoint(pt, out double t)) continue;

            Point3d cp = atr.curve.PointAt(t);
            double dis = cp.DistanceTo(pt);

            // optimize too far
            if (dis>atr.area*2) continue;

            // main relative distance parameter
            double c = (atr.area - dis) / atr.area;
            if (c < 0) c = 0;
            else if (c > 1) c = 1;

            double strength = 0;
            bool localRemove = false;

            switch (atr.type) {
                case "wave_wryp": {
                    strength = -Math.Cos(5 * Math.PI * (1 - c)) * c * atr.strength;
                    break;
                }

                case "sin": {
                    strength = ((Math.Sin(c / (Math.PI * 0.1) + Math.PI * 1.5) + 1) / 2.0) * atr.strength;
                    break;
                }

                case "stamp": {
                    c += 0.9;
                    if (c > 1) c = 1;
                    strength = Math.Pow(c, 15) * atr.strength;
                    break;
                }

                case "stamp_wryp": {
                    c += 0.5;
                    if (c > 1) c = 1;
                    strength = -Math.Pow(c, 12) * atr.strength;
                    break;
                }

                case "exp": {
                    strength = c * c * c * c * atr.strength;
                    break;
                }

                case "exp_wryp": {
                    strength = -(c * c) * atr.strength;
                    break;
                }

                case "angHoleY": {
                  //  Point3d pc = atr.curve.PointAt(0);
                    double dy = (cp.Y - pt.Y) / atr.area;

                    if (dy < 0) {
                        strength = -c * atr.strength;
                        if (strength / atr.strength/**(c*5)*/ <dy*atr.trim /*(1-c)*1000*/ /*-atr.trim/2*/ ) localRemove = true;
                    } else {
                        strength = c * atr.strength;
                        if (strength / atr.strength > dy*atr.trim/*atr.trim*/)  localRemove = true;
                    }
                    break;
                }

                case "angHoleZY": {
                  //  Point3d pc = atr.curve.PointAt(0);
                    double dz = (cp.Z - pt.Z) / atr.area;
                    double dy = (cp.Y - pt.Y) / atr.area;

                    if (dz-dy > 0) {
                        strength = -c * atr.strength;
                        if (strength / atr.strength < -atr.trim / 2.0) localRemove = true;
                    } else {
                        strength = c * atr.strength;
                        if (strength / atr.strength > atr.trim)  localRemove = true;
                    }
                    break;
                }

                case "angHoleZ": {
                  //  Point3d pc = atr.curve.PointAt(0);
                    double dz = (cp.Z - pt.Z) / atr.area;
                //    double dy = (cp.Y - pt.Y) / atr.area;

                 //   if (dz > 0) {
                    /*    strength = -c * atr.strength;
                        if (strength / atr.strength < -atr.trim / 2.0) localRemove = true;
                    } else {*/
                        strength = c * atr.strength;
                        if (strength / atr.strength > atr.trim)  localRemove = true;
                  //  }
                    break;
                }

                default: {
                    throw new Exception("type of setting not found '" + atr.type + "'");
                }
            }

            // too small to eye catch, can later optimize by mesh reduce
            if (strength >= 10 && strength <= -10) strength = 0;

            sumOffset += normal * strength;

            if (!double.IsNaN(atr.trim)) {
                if (atr.type.Contains("wryp")) {
                    if (strength / atr.strength < -atr.trim) localRemove = true;
                } else {
                    if (strength / atr.strength > atr.trim) localRemove = true;
                }
            }

            if (localRemove) _remove = true;
        }

        // some endings curves
        double closest_dis_endings=1e10;
        foreach (Curve c in c_endings) {
            if (!c.ClosestPoint(pt, out double t)) continue;

            Point3d cp = c.PointAt(t);
            double dis = cp.DistanceTo(pt);
            if (dis<closest_dis_endings)closest_dis_endings=dis;
        }

        if (closest_dis_endings<100){
            sumOffset.X=0;
            sumOffset.Y=0;
            sumOffset.Z=0;            
        }else if (closest_dis_endings<500){
            double maxdis=300;
            sumOffset*=(maxdis+100-closest_dis_endings)/maxdis;
        }

        offset=new Point3f(
            (float)sumOffset.X,
            (float)sumOffset.Y,
            (float)sumOffset.Z
        );
        return _remove;
    }
}

public class mAttractor{
    public string type;
    public double strength;
    public double area;
    public Curve curve;
    public double trim;

    // convert from another component structure
    public mAttractor(object obj) {
        if (obj == null) throw new Exception("Attractor is null.");
        var t = obj.GetType();

       // mAttractor atr = new mAttractor();
        type = (string)t.GetField("type").GetValue(obj);
        strength = (double)t.GetField("strength").GetValue(obj);
        area = (double)t.GetField("area").GetValue(obj);
        trim = (double)t.GetField("trim").GetValue(obj);
        curve = (Curve)t.GetField("curve").GetValue(obj);
       
       // return atr;
    }
}
# ---------- end c_script_12 ----------
mesh_2 = Mesh(c_script_12)

# ---- group: draft preview
custom_preview_3 = CustomPreview(Geometry=c_script_12, Material=ColourSwatch(SwatchColor=RGB(178, 178, 178)))  # disabled

# ---- group: smooth
# VYHLAZENÍ POVRCHU
subd_from_mesh = SubDFromMesh(Mesh=mesh_2, Creases=Slider(2, range=0..2), Corners=Slider(2, range=0..2), Interpolate=Toggle(False))
mesh_from_subd = MeshFromSubD(SubD=subd_from_mesh, Density=Slider(1, range=0..5))

# ---- group: draft preview
colour_swatch_3 = ColourSwatch(SwatchColor=RGB(178, 178, 178))
custom_preview_4 = CustomPreview(Geometry=mesh_from_subd, Material=colour_swatch_3)

# ---- group: reduce
mesh_3 = Mesh(mesh_from_subd)
deconstruct_mesh_3 = DeconstructMesh(Mesh=mesh_3)  # -> Vertices, Faces, Colours, Normals
number_slider_11 = Slider(0.9, range=0..1)
list_length = ListLength(List=deconstruct_mesh_3.Faces)
multiplication_5 = Multiplication(A=list_length, B=number_slider_11)
reduce_mesh = ReduceMesh(Mesh=mesh_3, FaceCount=multiplication_5, Accuracy=Slider(10, range=0..10), FaceType=0, Distort=True, Normalize=False)  # -> Reduced, CountDifference

# ---- group: create mass
# HMOTA PLÁŠTĚ
multiplication_6 = Multiplication(A=tickness, B=-1)
both_sides = BothSides(100)
offset_mesh = OffsetMesh(Mesh=reduce_mesh.Reduced, Distance=multiplication_6, BothSides=both_sides, CreateSolid=True)

# ----
geometry_pipeline_17 = GeometryPipeline(
    GroupByLayer=False,
    GroupByType=False,
    IncludeHidden=True,
    IncludeLocked=True,
    LayerFilter="fasada",
    NameFilter="*",
    SublayerFiltering=True,
    TypeFilter=1073741848)
geometry_pipeline_18 = GeometryPipeline(
    GroupByLayer=False,
    GroupByType=False,
    IncludeHidden=True,
    IncludeLocked=True,
    LayerFilter="strecha",
    NameFilter="*",
    SublayerFiltering=True,
    TypeFilter=1073741848)
geometry_2 = Geometry([<mesh referenced from the Rhino model> x11])
merge_6 = Merge(Data1=mesh_2, Data2=geometry_2, Data3=geometry_pipeline_18, Data4=geometry_pipeline_17)

# ---- group: draft preview
# EXPORTOVAT DO BIMU
colour_swatch_4 = ColourSwatch(SwatchColor=RGB(178, 178, 178))
custom_preview_5 = CustomPreview(Geometry=offset_mesh, Material=colour_swatch_4)

# ----
geometry_3 = Geometry(offset_mesh)

# ----
# PRO RHINO
colour_swatch_5 = ColourSwatch(SwatchColor=RGB(201, 201, 201))
custom_preview_6 = CustomPreview(Geometry=geometry_3, Material=colour_swatch_5)

# ---- group: bim fasada
# PRO REVIT
nazev = Panel("navrh2_fasada")
category_2 = Category(<category referenced from the Revit model>)
material = Material(<material referenced from the Revit model>)
add_directshape_geometry = AddDirectShapeGeometry(Name=nazev, Category=category_2, Geometry=geometry_3, Material=material, TrackingMode=2)

# ----
mesh_naked_edges_2 = MeshNakedEdges(Mesh=mesh_2)  # -> Naked, ResultBoolean
cluster_12 = Cluster_9(curve=mesh_naked_edges_2.Naked)  # -> list_a, result, list_a_2

# ---- group: male rovinne
# OKNA
curve_2 = Curve(cluster_12.list_a)

# ---- group: move bit
cluster_13 = Cluster_7(curve=curve_2, mesh=mesh_2)

# ----
# LOFT OKEN
# OPTIMALIZACE VELIKOSTI GEOMETRIE
# FILTOVÁNÍ OKRAJŮ OKEN
# MESH NORMAL
# ZASADIT KŘIVKU DO ROVINY
merge_7 = Merge(Data1=cluster_11, Data2=cluster_10, Data3=ending_curve_trim)
curve_3 = Curve(cluster_9)
curve_4 = Curve(cluster_12.list_a_2)
cluster_14 = Cluster_3(curve=curve_4)

c_script_13 = CSharpScript(curves=flatten(cluster_12.result), win_mid_p=curve_3, win_mid_u=merge_7)  # -> prednaskovky, ucebny; inputs curves: list of Curve, win_mid_p: list of Curve, win_mid_u: list of Curve
# ---------- c_script_13: C# ----------
#region Usings
using System;
using System.Linq;
using System.Collections;
using System.Collections.Generic;
using System.Drawing;

using Rhino;
using Rhino.Geometry;

using Grasshopper;
using Grasshopper.Kernel;
using Grasshopper.Kernel.Data;
using Grasshopper.Kernel.Types;
#endregion

public class Script_Instance : GH_ScriptInstance{
    private void RunScript(
		List<Curve> curves,
		List<Curve> win_mid_p,
		List<Curve> win_mid_u,
		ref object prednaskovky,
		ref object ucebny) {
        List<Curve> p=new List<Curve>(), u=new List<Curve>();

        foreach (Curve curve in curves){
            double min_dis_p=1e10, min_dis_u=1e10;

            foreach (Curve cmid in win_mid_p){
                Point3d end=cmid.PointAt(0.5);
                if (curve.ClosestPoint(end, out double par)){
                    Point3d closest=curve.PointAt(par);
                    double dis=end.DistanceTo(closest);
                    if (dis<min_dis_p){
                        min_dis_p=dis;
                    }
                }
            }
            foreach (Curve cmid in win_mid_u) {
                Point3d end=cmid.PointAt(0.5);
                if (curve.ClosestPoint(end, out double par)){
                    Point3d closest=curve.PointAt(par);
                    double dis=end.DistanceTo(closest);
                    if (dis<min_dis_u){
                        min_dis_u=dis;
                    }
                }
            }

            if (min_dis_u<min_dis_p){
                u.Add(curve);
            }else{
                p.Add(curve);
            }
        }
        
        prednaskovky=p;
        ucebny=u;
    }
}
# ---------- end c_script_13 ----------
curve_5 = Curve(c_script_13.prednaskovky)

# ---- group: smooth
control_points_2 = ControlPoints(Curve=c_script_13.ucebny)  # -> Points, Weights, Knots
nurbs_curve = NurbsCurve(Vertices=control_points_2.Points, Degree=3, Periodic=False)  # -> flatten(Curve), Length, Domain

# ---- group: velke okno
boundary_surfaces_2 = BoundarySurfaces(Edges=cluster_14)

# ----
# HEXAGONY NA VERTIKÁLNÍM PROSKLENÍ
cluster_15 = Cluster_2(curve=cluster_14)

# ---- group: preview pipes
mesh_4 = Mesh(cluster_15)
custom_preview_7 = CustomPreview(Geometry=mesh_4, Material=ColourSwatch(SwatchColor=RGB(186, 186, 186)))

# ---- group: bim fasada
nazev_2 = Panel("navrh2_deleni")
category_3 = Category(<category referenced from the Revit model>)
material_2 = Material(<material referenced from the Revit model>)
add_directshape_geometry_2 = AddDirectShapeGeometry(Name=nazev_2, Category=category_3, Geometry=cluster_15, Material=material_2, TrackingMode=2)

# ----
control_points_3 = ControlPoints(Curve=nurbs_curve.Curve)  # -> Points, Weights, Knots

dis = Slider(300, range=0..1000)
mesh_normal = MeshNormal(mesh=cluster_8, point=control_points_3.Points, B=dis)

polyline = PolyLine(Vertices=mesh_normal, Closed="true")
merge_8 = Merge(Data1=flatten(polyline), Data2=curve_5)

# ---- group: smooth
control_points_4 = ControlPoints(Curve=flatten(polyline))  # -> Points, Weights, Knots; disabled

# ----
# LOFT ROVINNÉ
# LOFT CURVED
cluster_16 = Cluster_4(list=merge_8)  # -> flat, curved
merge_9 = Merge(Data1=cluster_13, Data2=cluster_16.flat)  # -> flatten(Result)
cluster_17 = Cluster_6(curve=merge_9)  # -> graft(polyline_2)
cluster_18 = Cluster_5(curve=cluster_16.curved)
boundary_surfaces_3 = BoundarySurfaces(Edges=cluster_17)  # -> flatten(Surfaces)
merge_10 = Merge(Data1=boundary_surfaces_3, Data2=cluster_18, Data3=boundary_surfaces_2)

list_length_2 = ListLength(List=control_points_4.Points)

# ---- group: loft
merge_11 = Merge(Data1=polyline)
loft_options = LoftOptions(Closed=False, Adjust=False, Rebuild=list_length_2, Refit=0, Type=Slider(3, range=0..30))
loft = Loft(Curves=merge_11, Options={Adjust=False, Closed=False, LoftEnds=0, LoftSimp=0, LoftType=0, Rebuild=10, Refit=0.01})  # -> flatten(Loft)

# ----
custom_preview_8 = CustomPreview(Geometry=loft, Material=colour_swatch_3)

# ----
# MESH NA BREP
# REDUKCE MESHE
kvalita = Slider(19, range=1..20)
cluster_19 = Cluster_19(geometry=merge_10, B=kvalita)
kvalita_2 = Slider(14, range=1..50)
cluster_20 = Cluster_18(mesh=cluster_19, B=kvalita_2)

mesh_join = MeshJoin(Meshes=cluster_19)  # disabled

# ---- group: BIM okna
nazev_3 = Panel("navrh2_okna")
material_3 = Material(<material referenced from the Revit model>)
category_4 = Category(<category referenced from the Revit model>)
add_directshape_geometry_3 = AddDirectShapeGeometry(Name=nazev_3, Category=category_4, Geometry=cluster_19, Material=material_3, TrackingMode=2)

# ---- group: okna
custom_preview_9 = CustomPreview(Geometry=merge_10, Material=ColourSwatch(SwatchColor=RGB(53, 93, 105)))

# ---- group: to mesh
deconstruct_brep_2 = DeconstructBrep(Brep=loft)  # -> Faces, Edges, Vertices; disabled
panel_3 = Panel("1")  # disabled
mesh_surface = MeshSurface(Surface=deconstruct_brep_2.Faces, UCount=panel_3, VCount=panel_3, Overhang=True, Equalize=False)  # disabled
mesh_join_2 = MeshJoin(Meshes=flatten(mesh_surface))  # -> flatten(Mesh); disabled

# ----
# PAPRSKY
# SOLÁRNÍ ANALÝZA
# LOKACE
# KRITICKÉ OBDOBÍ PŘED PRÁZDNINAMI
number_slider_12 = Slider(9, range=1..12)
analysisperiod_2 = LBAnalysisPeriod(
    start_month=Slider(1, range=1..12),
    start_day=Slider(1, range=1..12),
    start_hour=number_slider_5,
    end_month=Slider(6, range=1..12),
    end_day="30",
    end_hour=number_slider_6)  # -> period, hoys, dates; plug-in component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
panel_4 = Panel("0")
geometry_4 = Geometry(cluster_19)
vector_2 = Vector(Vector(0, 0, -7000))

point = Point(Point(-707798.0382, 104040.6802, 216367.3504))
sunpath = LBSunPath(location=importepw_2.location, hoys=analysisperiod_2.hoys, center_pt=point, scale=1)  # -> out, vectors, altitudes, azimuths, hoys, sun_pts, analemma, daily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; plug-in component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

number_slider_13 = Slider(1, range=1..10000)
directsunhours = LBDirectSunHours(
    vectors=flatten(sunpath.vectors),
    geometry=flatten(geometry_4),
    context=flatten(merge_6),
    grid_size=Slider(2000, range=1..10000),
    geo_block=Toggle(False),
    run=Toggle(True))  # -> out, points, results, mesh, legend, title, int_mtx; disabled; plug-in component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

geometry_5 = Geometry(directsunhours.legend)
move_2 = Move(Geometry=geometry_5, Motion=vector_2)  # -> Geometry, Transform
point_2 = Point(directsunhours.points)
geometry_6 = Geometry(directsunhours.mesh)

# ==== cluster Cluster
target_count = ClusterInput()
breps = ClusterInput()

# ---- group: brep to mesh
quality = Slider(500, range=200..3000)  # disabled
deconstruct_brep = DeconstructBrep()  # -> flatten(Faces), Edges, Vertices; disabled
dimensions = Dimensions(Surface=deconstruct_brep.Faces)  # -> UDimension, VDimension; disabled
boolean_toggle = BooleanToggle(True)  # disabled
boolean_toggle_2 = BooleanToggle(True)  # disabled
division = Division(A=dimensions.UDimension, B=quality)  # disabled
division_2 = Division(A=dimensions.VDimension, B=quality)  # disabled
mesh_surface = MeshSurface(Surface=deconstruct_brep.Faces, UCount=division, VCount=division_2, Overhang=boolean_toggle, Equalize=boolean_toggle_2)  # disabled
mesh_join = MeshJoin(Meshes=mesh_surface)  # disabled

# ---- group: v2
brep_join = BrepJoin(Breps=breps)  # -> Breps, Closed
quad_remesh_settings = QuadRemeshSettings(
    TargetCount=target_count,
    AdaptiveSize=Slider(50, range=0..100),
    AdaptiveCount=Toggle(True),
    HardEdges=False,
    SeamEdges=Slider(0, range=0..2),
    Symmetry=0,
    GuideCurves=Slider(0, range=0..2))
quad_remesh = QuadRemesh(Geometry=brep_join.Breps, Settings=quad_remesh_settings)

# ----
mesh = ClusterOutput(quad_remesh)

# ==== cluster Cluster_2
curve = ClusterInput()

# ---- group: okraje
offset_curve = OffsetCurve(Curve=curve, Distance="50", Corners=1)

# ----
hexagon_velikost = Slider(637, range=100..1000)

# ---- group: hexagon
boundary_surfaces = BoundarySurfaces(Edges=offset_curve)
dimensions = Dimensions(Surface=boundary_surfaces)  # -> UDimension, VDimension
multiplication = Multiplication(A="2/3", B=dimensions.VDimension)
division = Division(A=dimensions.UDimension, B=hexagon_velikost)
division_2 = Division(A=multiplication, B=hexagon_velikost)
hexagonal_structure = HexagonalStructure(Surface=boundary_surfaces, UDivisions=division, VDivisions=division_2, AdjustShape=0.3, Type=False)  # -> StructureLines, StructureNodes
surface_curve = SurfaceCurve(Surface=boundary_surfaces, Curve=hexagonal_structure.StructureLines)  # -> flatten(Curves), Points, UVPoints, Normals, Parameters, Tangents

# ---- group: radius
number_slider = Slider(30, range=0..100)

# ---- group: trubky
multipipe = MultiPipe(
    Curves=surface_curve.Curves,
    NodeSize=number_slider,
    EndOffset=1,
    StrutSize=1,
    Segment=0,
    KinkAngle=0.6,
    CubeFit=0,
    Caps=Toggle(True))

# ----
pipe = ClusterOutput(multipipe)

# ==== cluster Cluster_3
curve = ClusterInput()
control_points = ControlPoints(Curve=curve)  # -> Points, Weights, Knots
# ROVINA KŘIVKY
plane_fit = PlaneFit(Points=control_points.Points)  # -> Plane, Deviation
# NĚCO JAKO V RHINU SetPt
panel = Panel("1")
scale_nu = ScaleNU(Geometry=control_points.Points, Plane=plane_fit.Plane, ScaleX=panel, ScaleY=panel, ScaleZ="0")  # -> Geometry, Transform
polyline = PolyLine(Vertices=scale_nu.Geometry, Closed="true")  # -> flatten(Polyline)
polyline_2 = ClusterOutput(polyline)

# ==== cluster Cluster_4
práh_pro_skororovinnaté_okna = Slider(100, range=0..1000)
list = ClusterInput()

# ---- group: filter oken
control_points = ControlPoints(Curve=list)  # -> Points, Weights, Knots
plane_fit = PlaneFit(Points=control_points.Points)  # -> Plane, flatten(Deviation)
smaller_than = SmallerThan(FirstNumber=plane_fit.Deviation, SecondNumber=práh_pro_skororovinnaté_okna)  # -> SmallerThan, OrEqualTo
dispatch = Dispatch(List=list, DispatchPattern=smaller_than.SmallerThan)  # -> ListA, ListB

# ---- group: dev tag
colour_swatch = ColourSwatch(SwatchColor=RGB(255, 255, 255))  # disabled
average = Average(Input=control_points.Points)  # disabled
round = Round(Number=plane_fit.Deviation)  # -> Nearest, Floor, Ceiling; disabled
text_tag = TextTag(Location=flatten(average), Text=round.Nearest, Colour=colour_swatch)  # disabled

# ---- group: filter oken / skoro rovinnaté
curve = Curve(dispatch.ListA)

# ---- group: filter oken / křivkovité
curve_2 = Curve(dispatch.ListB)

# ----
curved = ClusterOutput(curve_2)
flat = ClusterOutput(curve)

# ==== cluster Cluster_5
curve = ClusterInput()

# ---- group: rozdelit na 2 casti
curve_2 = Curve(graft(curve))
control_points = ControlPoints(Curve=curve_2)  # -> Points, Weights, Knots
average = Average(Input=control_points.Points)
xy_plane = XYPlane(Origin=average)
curve_plane = CurvePlane(Curve=curve_2, Plane=xy_plane)  # -> Points, ParamsC, ParamsP
shatter = Shatter(Curve=curve_2, Parameters=curve_plane.ParamsC)
list_item = ListItem(List=shatter, Index=0, Wrap=True)
list_item_2 = ListItem(List=shatter, Index="1", Wrap=True)

# ----
list_length = ListLength(List=control_points.Points)  # -> flatten(Length)

# ---- group: loft
flip_curve = FlipCurve(Curve=list_item)  # -> Curve, Flag
merge = Merge(Data1=flip_curve.Curve, Data2=list_item_2)
loft_options = LoftOptions(Closed=False, Adjust=False, Rebuild=list_length, Refit=0, Type=0)  # -> graft(Options)
loft = Loft(Curves=merge, Options=loft_options)  # -> flatten(Loft)

# ----
loft_2 = ClusterOutput(loft)

# ==== cluster Cluster_6
curve = ClusterInput()

# ---- group: flat curve
control_points = ControlPoints(Curve=curve)  # -> Points, Weights, Knots
plane_fit = PlaneFit(Points=control_points.Points)  # -> Plane, Deviation
scale_nu = ScaleNU(Geometry=control_points.Points, Plane=plane_fit.Plane, ScaleX="1", ScaleY="1", ScaleZ="0")  # -> Geometry, Transform
polyline = PolyLine(Vertices=scale_nu.Geometry, Closed="true")  # -> flatten(Polyline)

# ----
polyline_2 = ClusterOutput(polyline)

# ==== cluster Cluster_7
mesh = ClusterInput()
curve = ClusterInput()

# ---- group: move bit
# Křivku zasadit do roviny
mesh_2 = Mesh(mesh)
control_points = ControlPoints(Curve=curve)  # -> Points, Weights, Knots
average = Average(Input=control_points.Points)  # -> flatten(ArithmeticMean)
plane_fit = PlaneFit(Points=control_points.Points)  # -> flatten(Plane), Deviation
mesh_closest_point = MeshClosestPoint(Point=average, Mesh=mesh_2)  # -> Point, Index, Parameter
plane_origin = PlaneOrigin(Base=plane_fit.Plane, Origin=average)
mesh_eval = MeshEval(Mesh=mesh_2, Parameter=mesh_closest_point.Parameter)  # -> Point, Normal, Colour
deconstruct_plane = DeconstructPlane(Plane=plane_origin)  # -> Origin, XAxis, YAxis, ZAxis
angle = Angle(VectorA=deconstruct_plane.ZAxis, VectorB=mesh_eval.Normal)  # -> Angle, Reflex
smaller_than = SmallerThan(FirstNumber=angle.Angle, SecondNumber="pi/2")  # -> flatten(SmallerThan), OrEqualTo
number = Number(smaller_than.SmallerThan)
multiplication = Multiplication(A=number, B=2)
subtraction = Subtraction(A=multiplication, B=1)
multiplication_2 = Multiplication(A=deconstruct_plane.ZAxis, B=subtraction)
multiplication_3 = Multiplication(A=multiplication_2, B=Slider(-87, range=-500..0))
move = Move(Geometry=curve, Motion=multiplication_3)  # -> Geometry, Transform

# ----
multiplication_4 = Multiplication(A=multiplication_3, B="100")

# ---- group: move bit (continued)
vector_display = VectorDisplay(Anchor=average, Vector=multiplication_4)

# ----
geometry = ClusterOutput(move.Geometry)

# ==== cluster Cluster_9
curve = ClusterInput()

# ---- group: filtrovani
length = Length(Curve=curve)
smaller_than = SmallerThan(FirstNumber=length, SecondNumber=Slider(8289, range=0..12000))  # -> SmallerThan, OrEqualTo
dispatch = Dispatch(List=curve, DispatchPattern=smaller_than.SmallerThan)  # -> ListA, ListB

# ---- group: velke?
curve_2 = Curve(dispatch.ListB)

# ---- group: obvodové hrany jsou nejdelší
length_2 = Length(Curve=curve_2)
smaller_than_2 = SmallerThan(FirstNumber=length_2, SecondNumber=Slider(47271, range=0..100000))  # -> SmallerThan, OrEqualTo
dispatch_2 = Dispatch(List=curve_2, DispatchPattern=smaller_than_2.SmallerThan)  # -> ListA, ListB

length_3 = Length(Curve=dispatch_2.ListB)
smaller_than_3 = SmallerThan(FirstNumber=length_3, SecondNumber=Slider(53375, range=0..100000))  # -> SmallerThan, OrEqualTo
dispatch_3 = Dispatch(List=dispatch_2.ListB, DispatchPattern=smaller_than_3.SmallerThan)  # -> ListA, ListB

# ----
# FIX OKNA U HRANY
cluster = Cluster_8(curve=dispatch_3.ListB)  # disabled
merge = Merge(Data1=dispatch_2.ListA, Data2=flatten(cluster))
list_a = ClusterOutput(dispatch.ListA)
result = ClusterOutput(merge)
list_a_2 = ClusterOutput(dispatch_3.ListA)

# ==== cluster Cluster_10
curve = ClusterInput()
A = ClusterInput()
B = ClusterInput()

reparameterize_curve = ReparameterizeCurve(Curve=curve)  # -> Reparameterized, Original
division = Division(A=A, B=B)
end_points = EndPoints(Curve=reparameterize_curve.Reparameterized)  # -> Start, End
number = Number(division)
circle = Circle(Plane=end_points.Start, Radius=number)
circle_2 = Circle(Plane=end_points.End, Radius=number)
curve_curve = CurveCurve(CurveA=reparameterize_curve.Reparameterized, CurveB=circle)  # -> Points, ParamsA, ParamsB
curve_curve_2 = CurveCurve(CurveA=reparameterize_curve.Reparameterized, CurveB=circle_2)  # -> Points, ParamsA, ParamsB
merge = Merge(Data1=curve_curve.ParamsA, Data2=curve_curve_2.ParamsA)
shatter = Shatter(Curve=graft(reparameterize_curve.Reparameterized), Parameters=merge)
list_item = ListItem(List=shatter, Index="1", Wrap=True)  # -> flatten(Item)
curve_2 = Curve(list_item)

curve_3 = ClusterOutput(curve_2)

# ==== cluster Cluster_11
curve = ClusterInput()
number = ClusterInput()

reparameterize_curve = ReparameterizeCurve(Curve=curve)  # -> Reparameterized, Original
end_points = EndPoints(Curve=reparameterize_curve.Reparameterized)  # -> Start, End
number_2 = Number(number)
circle = Circle(Plane=end_points.Start, Radius=number_2)
circle_2 = Circle(Plane=end_points.End, Radius=number_2)
curve_curve = CurveCurve(CurveA=reparameterize_curve.Reparameterized, CurveB=circle)  # -> Points, ParamsA, ParamsB
curve_curve_2 = CurveCurve(CurveA=reparameterize_curve.Reparameterized, CurveB=circle_2)  # -> Points, ParamsA, ParamsB
merge = Merge(Data1=curve_curve.ParamsA, Data2=curve_curve_2.ParamsA)
shatter = Shatter(Curve=graft(reparameterize_curve.Reparameterized), Parameters=merge)
list_item = ListItem(List=shatter, Index="1", Wrap=True)  # -> flatten(Item)

i = ClusterOutput(list_item)

# ==== cluster Cluster_12
curve = ClusterInput()
number = ClusterInput()
curve_2 = Curve(curve)

# ---- group: curve endings
end_points = EndPoints(Curve=curve_2)  # -> Start, End
number_2 = Number(number)
sphere = Sphere(Base=end_points.Start, Radius=number_2)
sphere_2 = Sphere(Base=end_points.End, Radius=number_2)
brep_curve = BrepCurve(Brep=sphere, Curve=curve_2)  # -> Curves, Points
brep_curve_2 = BrepCurve(Brep=sphere_2, Curve=curve_2)  # -> Curves, Points
curve_closest_point = CurveClosestPoint(Point=brep_curve.Points, Curve=curve_2)  # -> Point, Parameter, Distance

# ----
curve_closest_point_2 = CurveClosestPoint(Point=brep_curve_2.Points, Curve=curve_2)  # -> Point, Parameter, Distance

# ---- group: curve endings (continued)
merge = Merge(Data1=curve_closest_point_2.Parameter, Data2=curve_closest_point.Parameter)
shatter = Shatter(Curve=graft(curve_2), Parameters=merge)
list_item = ListItem(List=shatter, Index="1", Wrap=True)  # -> flatten(Item)
curve_3 = Curve(list_item)

# ----
curve_4 = ClusterOutput(curve_3)

# ==== cluster Cluster_13
curve = ClusterInput()
number = ClusterInput()

# ---- group: curve endings
reparameterize_curve = ReparameterizeCurve(Curve=curve)  # -> Reparameterized, Original
end_points = EndPoints(Curve=reparameterize_curve.Reparameterized)  # -> Start, End
number_2 = Number(number)
circle = Circle(Plane=end_points.Start, Radius=number_2)
circle_2 = Circle(Plane=end_points.End, Radius=number_2)
curve_curve = CurveCurve(CurveA=reparameterize_curve.Reparameterized, CurveB=circle)  # -> Points, ParamsA, ParamsB
curve_curve_2 = CurveCurve(CurveA=reparameterize_curve.Reparameterized, CurveB=circle_2)  # -> Points, ParamsA, ParamsB
merge = Merge(Data1=curve_curve.ParamsA, Data2=curve_curve_2.ParamsA)
shatter = Shatter(Curve=graft(reparameterize_curve.Reparameterized), Parameters=merge)
list_item = ListItem(List=shatter, Index="1", Wrap=True)  # -> flatten(Item)

# ----
i = ClusterOutput(list_item)

# ==== cluster Cluster_14
curve = ClusterInput()
number = ClusterInput()

# ---- group: curve endings
reparameterize_curve = ReparameterizeCurve(Curve=curve)  # -> Reparameterized, Original
number_2 = Number(number)
end_points = EndPoints(Curve=reparameterize_curve.Reparameterized)  # -> Start, End
circle = Circle(Plane=end_points.Start, Radius=number_2)
circle_2 = Circle(Plane=end_points.End, Radius=number_2)
curve_curve = CurveCurve(CurveA=reparameterize_curve.Reparameterized, CurveB=circle)  # -> Points, ParamsA, ParamsB
curve_curve_2 = CurveCurve(CurveA=reparameterize_curve.Reparameterized, CurveB=circle_2)  # -> Points, ParamsA, ParamsB
merge = Merge(Data1=curve_curve.ParamsA, Data2=curve_curve_2.ParamsA)
shatter = Shatter(Curve=graft(reparameterize_curve.Reparameterized), Parameters=merge)
list_item = ListItem(List=shatter, Index="1", Wrap=True)  # -> flatten(Item)

# ----
i = ClusterOutput(list_item)

# ==== cluster Cluster_15
factor = ClusterInput()
point = ClusterInput()

# ---- group: generate lines of win
unit_z = UnitZ(Factor=factor)
point_2 = Point(flatten(point))
multiplication = Multiplication(A=unit_z, B=-1)
move = Move(Geometry=point_2, Motion=multiplication)  # -> Geometry, Transform
move_2 = Move(Geometry=point_2, Motion=unit_z)  # -> Geometry, Transform
line = Line(StartPoint=move.Geometry, EndPoint=move_2.Geometry)

# ----
line_2 = ClusterOutput(line)

# ==== cluster Cluster_16
curve = ClusterInput()
number = ClusterInput()
curve_2 = Curve(curve)
number_2 = Number(number)

# ---- group: curve endings
end_points = EndPoints(Curve=curve_2)  # -> Start, End
circle = Circle(Plane=end_points.Start, Radius=number_2)
circle_2 = Circle(Plane=end_points.End, Radius=number_2)
curve_curve = CurveCurve(CurveA=curve_2, CurveB=circle_2)  # -> Points, ParamsA, ParamsB
curve_curve_2 = CurveCurve(CurveA=curve_2, CurveB=circle)  # -> Points, ParamsA, ParamsB
merge = Merge(Data1=curve_curve_2.ParamsA, Data2=curve_curve.ParamsA)
shatter = Shatter(Curve=graft(curve_2), Parameters=merge)
list_item = ListItem(List=shatter, Index="1", Wrap=True)  # -> flatten(Item)
curve_3 = Curve(list_item)

# ----
curve_4 = ClusterOutput(curve_3)

# ==== cluster Cluster_17
curve = ClusterInput()
curve_2 = Curve(curve)
number = ClusterInput()
number_2 = Number(number)

# ---- group: curve endings
end_points = EndPoints(Curve=curve_2)  # -> Start, End
circle = Circle(Plane=end_points.Start, Radius=number_2)
circle_2 = Circle(Plane=end_points.End, Radius=number_2)
curve_curve = CurveCurve(CurveA=curve_2, CurveB=circle)  # -> Points, ParamsA, ParamsB
curve_curve_2 = CurveCurve(CurveA=curve_2, CurveB=circle_2)  # -> Points, ParamsA, ParamsB
merge = Merge(Data1=curve_curve.ParamsA, Data2=curve_curve_2.ParamsA)
shatter = Shatter(Curve=graft(curve_2), Parameters=merge)
list_item = ListItem(List=shatter, Index="1", Wrap=True)  # -> flatten(Item)

# ----
i = ClusterOutput(list_item)

# ==== cluster EndingCurveTrim
curve = ClusterInput()
curve_2 = Curve(curve)
number = ClusterInput()
number_2 = Number(number)

# ---- group: curve endings
end_points = EndPoints(Curve=curve_2)  # -> Start, End

# ----
xy_plane = XYPlane(Origin=end_points.End)
scale_nu = ScaleNU(Geometry=curve_2, Plane=xy_plane, ScaleX=1, ScaleY=1, ScaleZ="0")  # -> Geometry, Transform
end_points_2 = EndPoints(Curve=scale_nu.Geometry)  # -> Start, End
xy_plane_2 = XYPlane(Origin=end_points_2.Start)
xy_plane_3 = XYPlane(Origin=end_points_2.End)

# ---- group: curve endings (continued)
circle = Circle(Plane=xy_plane_2, Radius=number_2)
circle_2 = Circle(Plane=xy_plane_3, Radius=number_2)
curve_curve = CurveCurve(CurveA=scale_nu.Geometry, CurveB=circle)  # -> Points, ParamsA, ParamsB
curve_curve_2 = CurveCurve(CurveA=scale_nu.Geometry, CurveB=circle_2)  # -> Points, ParamsA, ParamsB
merge = Merge(Data1=curve_curve.ParamsA, Data2=curve_curve_2.ParamsA)
shatter = Shatter(Curve=graft(curve_2), Parameters=merge)
list_item = ListItem(List=shatter, Index="1", Wrap=True)  # -> flatten(Item)

# ----
i = ClusterOutput(list_item)

# ==== cluster MeshNormal
point = ClusterInput()
mesh = ClusterInput()
point_2 = Point(point)
B = ClusterInput()

# ---- group: mesh normal
mesh_2 = Mesh(mesh)
mesh_closest_point = MeshClosestPoint(Point=point_2, Mesh=mesh_2)  # -> Point, Index, Parameter
mesh_eval = MeshEval(Mesh=mesh_2, Parameter=mesh_closest_point.Parameter)  # -> Point, Normal, Colour
multiplication = Multiplication(A=mesh_eval.Normal, B=B)
multiplication_2 = Multiplication(A=multiplication, B="-1")
move = Move(Geometry=point_2, Motion=multiplication_2)  # -> Geometry, Transform

# ----
geometry = ClusterOutput(move.Geometry)

# ==== cluster Cluster_18
mesh = ClusterInput()
B = ClusterInput()

mesh_2 = Mesh(mesh)
deconstruct_mesh = DeconstructMesh(Mesh=mesh_2)  # -> Vertices, Faces, Colours, Normals
list_length = ListLength(List=deconstruct_mesh.Faces)
division = Division(A=list_length, B=B)  # -> flatten(Result)
reduce_mesh = ReduceMesh(Mesh=mesh_2, FaceCount=division, Accuracy=Slider(10, range=0..10), FaceType=0, Distort=True, Normalize=False)  # -> Reduced, CountDifference

reduced = ClusterOutput(reduce_mesh.Reduced)

# ==== cluster Cluster_19
geometry = ClusterInput()
geometry_2 = Geometry(geometry)
simple_mesh = SimpleMesh(Brep=geometry_2)  # disabled
B = ClusterInput()
mesh_brep = MeshBrep(
    Brep=geometry_2,
    Settings={GridMaxCount=0, GridMinCount=16, JaggedSeams=False, MaxEdgeLength=0, MinEdgeLength=0.0001, MinTolerance=0, Refine=True, RefineAngle=0, RelativeTolerance=0.65, SimplePlanes=True, Tolerance=0})
mesh = ClusterOutput(mesh_brep)

area = Area(Geometry=geometry_2)  # -> Area, Centroid
number_slider = Slider(30, range=0..100)
division = Division(A=area.Area, B="1e6")
multiplication = Multiplication(A=division, B=B)

maximum = Maximum(A="20", B=multiplication)

quad_remesh_settings = QuadRemeshSettings(
    TargetCount=maximum,
    AdaptiveSize=0,
    AdaptiveCount=Toggle(True),
    HardEdges=Toggle(True),
    SeamEdges=Slider(2, range=0..2),
    Symmetry=0,
    GuideCurves=Slider(0, range=0..2))
quad_remesh = QuadRemesh(Geometry=geometry_2, Settings=quad_remesh_settings)  # disabled

# ==== cluster Remap
value = ClusterInput()
source = ClusterInput()
remap_numbers = RemapNumbers(Value=value, Source=source, Target=Domain(0, 1))  # -> Mapped, Clipped
c_script = CSharpScript(x=remap_numbers.Clipped)  # -> a; inputs x: Double
# ---------- c_script: C# ----------
// Grasshopper Script Instance
#region Usings
using System;
using System.Linq;
using System.Collections;
using System.Collections.Generic;
using System.Drawing;

using Rhino;
using Rhino.Geometry;

using Grasshopper;
using Grasshopper.Kernel;
using Grasshopper.Kernel.Data;
using Grasshopper.Kernel.Types;
#endregion

public class Script_Instance : GH_ScriptInstance
{
    #region Notes
    /* 
      Members:
        RhinoDoc RhinoDocument
        GH_Document GrasshopperDocument
        IGH_Component Component
        int Iteration

      Methods (Virtual & overridable):
        Print(string text)
        Print(string format, params object[] args)
        Reflect(object obj)
        Reflect(object obj, string method_name)
    */
    #endregion

    private void RunScript(double x, ref object a)
    {
        
        a=x<0.3?0.3: x;
    }
}
# ---------- end c_script ----------
min = CSharpScript(x=c_script)  # -> a; inputs x: list of Double
# ---------- min: C# ----------
// Grasshopper Script Instance
#region Usings
using System;
using System.Linq;
using System.Collections;
using System.Collections.Generic;
using System.Drawing;

using Rhino;
using Rhino.Geometry;

using Grasshopper;
using Grasshopper.Kernel;
using Grasshopper.Kernel.Data;
using Grasshopper.Kernel.Types;
#endregion

public class Script_Instance : GH_ScriptInstance
{
    #region Notes
    /* 
      Members:
        RhinoDoc RhinoDocument
        GH_Document GrasshopperDocument
        IGH_Component Component
        int Iteration

      Methods (Virtual & overridable):
        Print(string text)
        Print(string format, params object[] args)
        Reflect(object obj)
        Reflect(object obj, string method_name)
    */
    #endregion

    private void RunScript(List<double> x, ref object a)
    {
        a =  x.OrderBy(i=>i).ToArray()[0];
    }
}
# ---------- end min ----------
division = Division(A=c_script, B=min)
result = ClusterOutput(division)

# ==== cluster Cluster_8
curve = ClusterInput()
curve_self = CurveSelf(Curve=curve)  # -> Points, Params
shatter = Shatter(Curve=curve, Parameters=curve_self.Params)
geometry_pipeline = GeometryPipeline(
    GroupByLayer=False,
    GroupByType=False,
    IncludeHidden=True,
    IncludeLocked=True,
    LayerFilter="win types 3D::ucebny sever::mid",
    NameFilter="*",
    SublayerFiltering=True,
    TypeFilter=4)

curve_2 = Curve(shatter)
length = Length(Curve=curve_2)
sort_list = SortList(Keys=length, ValuesValuesA=curve_2)  # -> Keys, ValuesValuesA

smaller_than = SmallerThan(FirstNumber=length, SecondNumber=Slider(100000, range=0..100000))  # -> SmallerThan, OrEqualTo
dispatch = Dispatch(List=curve_2, DispatchPattern=smaller_than.SmallerThan)  # -> ListA, ListB
curve_3 = Curve(dispatch.ListA)
c_script = CSharpScript(shorts=curve_3, all=geometry_pipeline, dis_max=Slider(3000, range=0..3000))  # -> blizko, daleko; inputs shorts: list of Curve, all: list of Curve, dis_max: Double
# ---------- c_script: C# ----------
#region Usings
using System;
using System.Linq;
using System.Collections;
using System.Collections.Generic;
using System.Drawing;

using Rhino;
using Rhino.Geometry;

using Grasshopper;
using Grasshopper.Kernel;
using Grasshopper.Kernel.Data;
using Grasshopper.Kernel.Types;
#endregion

public class Script_Instance : GH_ScriptInstance{
    private void RunScript(
		List<Curve> shorts,
		List<Curve> all,
		double dis_max,
		ref object blizko,
		ref object daleko) {
        List<Curve> b=new List<Curve>(), d=new List<Curve>();

        foreach (Curve curve in shorts){
            double min_dis=1e10;

            foreach (Curve cmid in all){
                Point3d end=cmid.PointAt(0.5);
                if (curve.ClosestPoint(end, out double par)){
                    Point3d closest=curve.PointAt(par);
                    double dis=end.DistanceTo(closest);
                    if (dis<min_dis){
                        min_dis=dis;
                    }
                }
            }

            if (min_dis<dis_max){
                b.Add(curve);
            }else{
                d.Add(curve);
            }
        }
        
        blizko=b;
        daleko=d;
    }
}
# ---------- end c_script ----------
curve_4 = Curve(c_script.daleko)
join_curves = JoinCurves(Curves=curve_3, Preserve=False)

list_item = ListItem(List=join_curves, Index=0, Wrap=True)
control_points = ControlPoints(Curve=list_item)  # -> Points, Weights, Knots
average = Average(Input=control_points.Points)
unit_z = UnitZ(Factor=Slider(-1000, range=-1000..0))
move = Move(Geometry=average, Motion=unit_z)  # -> Geometry, Transform

curve_5 = Curve(c_script.blizko)
list_item_2 = ListItem(List=join_curves, Index="1", Wrap=True)

# ---- group: filter out bottom
curve_plane = CurvePlane(Curve=list_item, Plane=move.Geometry)  # -> Points, ParamsC, ParamsP
shatter_2 = Shatter(Curve=list_item, Parameters=curve_plane.ParamsC)
list_item_3 = ListItem(List=shatter_2, Index="1", Wrap=True)

# ---- group: filter out shorter
average_2 = Average(Input=control_points.Points)
xy_plane = XYPlane(Origin=average_2)
scale_nu = ScaleNU(Geometry=list_item, Plane=xy_plane, ScaleX=1, ScaleY=1, ScaleZ="0")  # -> Geometry, Transform
curve_self_2 = CurveSelf(Curve=scale_nu.Geometry)  # -> Points, Params
shatter_3 = Shatter(Curve=list_item_3, Parameters=curve_self_2.Params)
list_length = ListLength(List=shatter_3)
length_2 = Length(Curve=shatter_3)
subtraction = Subtraction(A=list_length, B=Slider(2, range=0..10))
construct_domain = ConstructDomain(DomainStart=0, DomainEnd=subtraction)
sort_list_2 = SortList(Keys=length_2, ValuesValuesA=shatter_3)  # -> Keys, ValuesValuesA
sub_list = SubList(List=sort_list_2.ValuesValuesA, Domain=construct_domain, Wrap=True)  # -> List, Index
join_curves_2 = JoinCurves(Curves=flatten(sub_list.List), Preserve=False)

# ---- group: rozdelit na 2 casti
curve_6 = Curve(graft(join_curves_2))
control_points_2 = ControlPoints(Curve=curve_6)  # -> Points, Weights, Knots
average_3 = Average(Input=control_points_2.Points)
xy_plane_2 = XYPlane(Origin=average_3)

# ---- group: filterout far
plane_closest_point = PlaneClosestPoint(Point=control_points_2.Points, Plane=xy_plane_2)  # -> Point, UVPoint, Distance
distance = Distance(PointA=control_points_2.Points, PointB=plane_closest_point.Point)
smaller_than_2 = SmallerThan(FirstNumber=distance, SecondNumber=Slider(1131, range=0..3000))  # -> SmallerThan, OrEqualTo
dispatch_2 = Dispatch(List=control_points_2.Points, DispatchPattern=smaller_than_2.SmallerThan)  # -> ListA, ListB
polyline = PolyLine(Vertices=dispatch_2.ListA, Closed="true")  # -> flatten(Polyline)

# ----
polyline_2 = ClusterOutput(polyline)
