# Grasshopper definition triangualce.gh (Grasshopper 1.0.8)
# plug-ins: MeshEdit Components, Pufferfish, Rhino.Inside for Autodesk Revit, LunchBox, DendroGH

# ----
# SEŘADIT PODLE VELIKOSTI
# 3D FASÁDA
# SEŘADIT PODLE VELIKOSTI
geometry_pipeline = GeometryPipeline(
    GroupByLayer=False,
    GroupByType=False,
    IncludeHidden=True,
    IncludeLocked=True,
    LayerFilter="gForTriangulation",
    NameFilter="*",
    SublayerFiltering=True,
    TypeFilter=1073741848)
# 2D FASÁDA
geometry_pipeline_2 = GeometryPipeline(
    GroupByLayer=False,
    GroupByType=False,
    IncludeHidden=True,
    IncludeLocked=True,
    LayerFilter="map",
    NameFilter="*",
    SublayerFiltering=True,
    TypeFilter=4)

# ----
# SEŘADIT PODLE VELIKOSTI
# 3D FASÁDA
# SEŘADIT PODLE VELIKOSTI
# 2D FASÁDA
geometry_pipeline_3 = GeometryPipeline(
    GroupByLayer=False,
    GroupByType=False,
    IncludeHidden=True,
    IncludeLocked=True,
    LayerFilter="grtriangulation2",
    NameFilter="*",
    SublayerFiltering=True,
    TypeFilter=1073741848)
geometry_pipeline_4 = GeometryPipeline(
    GroupByLayer=False,
    GroupByType=False,
    IncludeHidden=True,
    IncludeLocked=True,
    LayerFilter="map2",
    NameFilter="*",
    SublayerFiltering=True,
    TypeFilter=4)

vzdálenost_bodů_od_fasády = Slider(500, range=0..1000)
# NÁHODNOST FASÁDY
hustota_bodů = Slider(100, range=0..300)

postupně_od_sousední_budovy = Slider(2000, range=0..3000)
# DIMENZE NOSNÝCH PRVKŮ
# MEZERA MEZI NOSNÝMI PRVKY
# A SEKUNDÉRNÍM PLÁŠTĚM
poloměr_nosných_profilů = Slider(25, range=0..100)

# ---- group: převrátit podle x
boolean = Boolean([False, True, True])

# ---- group: převrátit podle y
boolean_2 = Boolean([False, False, False])

# ---- group: PŘEVRÁTIT SMĚR PLOCHY
boolean_3 = Boolean([True, False, False])

# ---- group: převrátit podle x
boolean_4 = Boolean([False, False, False, False, False, True, True, False, True, True, True, False, True, True, False, True, False])

# ---- group: hranice generování
curve = Curve(<curve referenced from the Rhino model>)

# ---- group: převrátit podle y
boolean_5 = Boolean([False, False, False, False, False, False, False, True, False, False, False, False, False, False, False, False, False])

# ---- group: Převrátit směr plochy
boolean_6 = Boolean([True, False, False, False, False, True, True, True, True, True, True, False, True, True, False, True, False])

# ----
area = Area(Geometry=geometry_pipeline_4)  # -> Area, Centroid
sort_list = SortList(Keys=area.Area, ValuesValuesA=geometry_pipeline_4)  # -> Keys, ValuesValuesA

area_2 = Area(Geometry=geometry_pipeline_3)  # -> Area, Centroid
sort_list_2 = SortList(Keys=area_2.Area, ValuesValuesA=geometry_pipeline_3)  # -> Keys, ValuesValuesA

# ----
# VSTUP
area_3 = Area(Geometry=geometry_pipeline)  # -> Area, Centroid
sort_list_3 = SortList(Keys=area_3.Area, ValuesValuesA=geometry_pipeline)  # -> Keys, ValuesValuesA

area_4 = Area(Geometry=geometry_pipeline_2)  # -> Area, Centroid
sort_list_4 = SortList(Keys=area_4.Area, ValuesValuesA=geometry_pipeline_2)  # -> Keys, ValuesValuesA

# ---- group: order
geometry = Geometry(sort_list_3.ValuesValuesA)  # disabled
list_length = ListLength(List=geometry)  # disabled
area_5 = Area(Geometry=geometry)  # -> Area, Centroid; disabled
series = Series(Start=0, Step=1, Count=list_length)  # disabled
text_tag = TextTag(Location=area_5.Centroid, Text=series)  # disabled

geometry_2 = Geometry(sort_list_4.ValuesValuesA)  # disabled
# voronoi reverse cut
# add delaunay
list_length_2 = ListLength(List=geometry_2)  # disabled
area_6 = Area(Geometry=geometry_2)  # -> Area, Centroid; disabled
series_2 = Series(Start=0, Step=1, Count=list_length_2)  # disabled
# delanuay 3D
text_tag_2 = TextTag(Location=area_6.Centroid, Text=series_2)  # disabled

# ----
def6 = Slider(1, range=0..10)

# ----
# TRIANGULACE
merge = Merge(Data1=sort_list_4.ValuesValuesA, Data2=sort_list.ValuesValuesA)
# VYGENEROVÁNÍ ZÁKLADNÍ HMOTY
# PLANÁR
cluster = Cluster_3(
    areawheretogeneratepts=merge,
    disfromfacade=vzdálenost_bodů_od_fasády,
    smoothdisneighbor=postupně_od_sousední_budovy,
    seed=def6)
region_union = RegionUnion(Curves=sort_list.ValuesValuesA)
cluster_2 = Cluster_2(boundary1=curve, points=cluster, boundary2=region_union)  # -> surfaces_2, surfaces

merge_2 = Merge(Data1=cluster_2.surfaces, Data2=cluster_2.surfaces_2)  # disabled
colour_swatch = ColourSwatch(SwatchColor=RGBA(255, 36, 36, 142))  # disabled
brep_edges = BrepEdges(Brep=merge_2)  # -> Naked, Interior, NonManifold; disabled
deconstruct_brep = DeconstructBrep(Brep=merge_2)  # -> Faces, Edges, Vertices; disabled
colour_swatch_2 = ColourSwatch(SwatchColor=RGB(99, 0, 0))  # disabled
custom_preview = CustomPreview(Geometry=merge_2, Material=colour_swatch)  # disabled

# ----
# NAMAPOVAT BODY
cluster_3 = Cluster_5(
    brep=cluster_2.surfaces_2,
    rectangle=sort_list_4.ValuesValuesA,
    surface=sort_list_3.ValuesValuesA,
    xflip=boolean_4,
    yflip=boolean_5,
    dirflip=boolean_6)  # -> surfaces, lines
cluster_4 = Cluster_4(
    triangles=cluster_2.surfaces,
    surfstoadd=sort_list_2.ValuesValuesA,
    rectangle=sort_list.ValuesValuesA,
    xflip=boolean,
    yflip=boolean_2,
    dirflip=boolean_3)  # -> surfaces, lines

custom_preview_2 = CustomPreview(Geometry=flatten(deconstruct_brep.Vertices), Material=colour_swatch_2)  # disabled
point = Point(deconstruct_brep.Vertices)  # disabled
merge_3 = Merge(Data1=cluster_3.lines, Data2=cluster_4.lines)

analysisperiod = LBAnalysisPeriod(start_month=Slider(1, range=1..12), start_day=1, start_hour=0, end_month=Slider(7, range=1..12))  # -> period, hoys, dates; plug-in component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

file_path = FilePath("C:\Users\geftg\Desktop\dp2\praha epw\CZE_PM_Praha-Karlov-Klementinum.115190_TMYx.epw")
# SOLÁRNÍ ANALÝZA
importepw = LBImportEPW(epw_file=file_path)  # -> location, dry_bulb_temperature, dew_point_temperature, relative_humidity, wind_speed, wind_direction, direct_normal_rad, diffuse_horizontal_rad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; plug-in component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

point_2 = Point(Point(-707798.0382, 104040.6802, 216367.3504))
sunpath = LBSunPath(location=importepw.location, hoys=analysisperiod.hoys, center_pt=point_2, scale=1)  # -> out, vectors, altitudes, azimuths, hoys, sun_pts, analemma, daily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; plug-in component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

geometry_pipeline_5 = GeometryPipeline(
    GroupByLayer=False,
    GroupByType=False,
    IncludeHidden=True,
    IncludeLocked=True,
    LayerFilter="strecha",
    NameFilter="*",
    SublayerFiltering=True,
    TypeFilter=1073741848)
geometry_3 = Geometry([<mesh referenced from the Rhino model> x24])
brep_join = BrepJoin(Breps=geometry_pipeline_5)  # -> Breps, Closed
merge_faces = MergeFaces(Brep=brep_join.Breps)  # -> Breps, Before, After
merge_4 = Merge(Data1=geometry_3, Data2=merge_faces.Breps)

brep = Brep([geometry_pipeline, geometry_pipeline_3])  # disabled
brep_join_2 = BrepJoin(Breps=brep)  # -> Breps, Closed; disabled
panel = Panel("-500")  # disabled
mesh_brep = MeshBrep(
    Brep=brep_join_2.Breps,
    Settings={GridMaxCount=0, GridMinCount=16, JaggedSeams=False, MaxEdgeLength=0, MinEdgeLength=0.0001, MinTolerance=0, Refine=True, RefineAngle=0, RelativeTolerance=0.65, SimplePlanes=True, Tolerance=0})  # disabled
panel_2 = Panel("false")  # disabled
offset_mesh = OffsetMesh(Mesh=mesh_brep, Distance=panel, BothSides=0, CreateSolid=panel_2)  # -> flatten(Offset); disabled
colour_swatch_3 = ColourSwatch(SwatchColor=RGBA(217, 217, 217, 161))  # disabled
colour_swatch_4 = ColourSwatch(SwatchColor=RGB(214, 214, 214))  # disabled
custom_preview_3 = CustomPreview(Geometry=brep_join_2.Breps, Material=colour_swatch_3)  # disabled
custom_preview_4 = CustomPreview(Geometry=offset_mesh, Material=colour_swatch_4)  # disabled

type = Type(<hostobjecttype referenced from the Revit model>, SelectedBuiltInCategory="autodesk.revit.category.local:walls")
type_2 = Type(<hostobjecttype referenced from the Revit model>, SelectedBuiltInCategory="autodesk.revit.category.local:walls")
type_3 = Type(<hostobjecttype referenced from the Revit model>, SelectedBuiltInCategory="autodesk.revit.category.local:walls")

colour_swatch_5 = ColourSwatch(SwatchColor=RGB(255, 156, 156))  # disabled

název = Panel("konstrukce_fasada")
category = Category(<category referenced from the Revit model>)
# RHINO
material = Material(<material referenced from the Revit model>)

query_design_options = QueryDesignOptions(Name=["Main Model", "fasada_triangulation", "CHIPSET"])  # -> flatten(DesignOptions)

název_2 = Panel("fasada_okna")
material_2 = Material(<material referenced from the Revit model>)

název_3 = Panel("fasada_okna2")
material_3 = Material(<material referenced from the Revit model>)

design_option_filter = DesignOptionFilter(DesignOption=query_design_options, Inverted=False)
# rnd list of pts on brep
# input brep
panel_3 = Panel("false")

# ----
# HLAVNÍ FASÁDA
# NÁHODNÉ BODY
# HRANICE GENEROVÁNÍ PRO 2
# ČÁST FASÁDY 0-2NP
merge_5 = Merge(Data1=cluster_3.surfaces, Data2=cluster_4.surfaces)

brep_2 = Brep(merge_5)

clean_tree = CleanTree(RemoveNulls="true", RemoveInvalid=True, RemoveEmpty="true", Tree=brep_2)

custom_preview_5 = CustomPreview(
    Geometry=clean_tree,
    Material={diffuse=RGB(221, 160, 221), emission=RGB(66, 48, 66), shine=0.5, specular=RGB(255, 255, 255), transparency=0})  # disabled
# PODPORNÁ KONSTRUKCE FASÁDY
cluster_5 = Cluster_6(surface=clean_tree, radius=poloměr_nosných_profilů, lines=merge_3)  # -> geometry_2, geometry_3, geometry

# ----
# PAPRSKY
# SOLÁRNÍ ANALÝZA
# LOKACE
# KRITICKÉ OBDOBÍ PŘED PRÁZDNINAMI
boolean_toggle = BooleanToggle(True)
panel_4 = Panel("0")
geometry_4 = Geometry(clean_tree)

directsunhours = LBDirectSunHours(
    vectors=flatten(sunpath.vectors),
    geometry=flatten(geometry_4),
    context=flatten(merge_4),
    grid_size=Slider(4000, range=1..10000),
    offset_dist=Slider(1, range=1..10000),
    geo_block=boolean_toggle,
    run=Toggle(True))  # -> out, points, results, mesh, legend, title, int_mtx; plug-in component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

geometry_5 = Geometry(directsunhours.legend)  # disabled
vector = Vector(Vector(0, 0, -7000))  # disabled
move = Move(Geometry=geometry_5, Motion=vector)  # -> Geometry, Transform; disabled

# ----
# ROZDĚLENÍ BODŮ
prah = Slider(650, range=0..1000)
c_script = CSharpScript(pts=directsunhours.points, res=directsunhours.results, geo=clean_tree, x=prah)  # -> more, less, all; inputs pts: list of Point3d, res: list of Double, geo: list of Brep, x: Double
# ---------- c_script: C# ----------
// Grasshopper Script Instance
#region Usings
using System;
using System.Linq;
using System.Collections;
using System.Collections.Generic;
using System.Drawing;

using Rhino;
using Rhino.Geometry;

using Grasshopper;
using Grasshopper.Kernel;
using Grasshopper.Kernel.Data;
using Grasshopper.Kernel.Types;
#endregion

public class Script_Instance : GH_ScriptInstance
{
    private void RunScript(
		List<Point3d> pts,
		List<double> res,
		List<Brep> geo,
		double x,
		ref object more,
		ref object less,
		ref object all)
    {
        double tol=10;
        List<Brep> listLess=new List<Brep>();
        List<Brep> listMore=new List<Brep>();
        
        foreach (Brep g in geo) {
            double sum=0;
            int cnt=0;
            for (int i=0; i<pts.Count; i++) {
                Point3d pt=pts[i];
                Point3d closest = g.ClosestPoint(pt); 
                double dis=closest.DistanceTo(pt);
                if (dis<tol) {
                    sum+=res[i];
                    cnt++;
                    break;
                }
            }

            if (sum/cnt>x) listMore.Add(g); else listLess.Add(g);
        }

        more = listMore;
        less = listLess;
        
        all=geo;
    }
}
# ---------- end c_script ----------

parameter_pipe_mesh = ParameterPipeMesh(
    Curve=cluster_5.geometry_3,
    Radius="100",
    ParametersU=[0, 0.1, 0.2, 0.3, 0.4, 0.5, 0.6, 0.7, 0.8, 0.9, 1],
    ParametersV=[0, 0.25, 0.5, 0.75, 1],
    Weighted=False,
    Lengths=False,
    Angle="0",
    Rotation="0",
    EndType="0",
    Triangulate=False)  # disabled
custom_preview_6 = CustomPreview(
    Geometry=c_script.all,
    Material={diffuse=RGB(221, 160, 221), emission=RGB(66, 48, 66), shine=0.5, specular=RGB(255, 255, 255), transparency=0})  # disabled
brep_join_3 = BrepJoin(Breps=c_script.more)  # -> Breps, Closed
simple_mesh = SimpleMesh(Brep=cluster_5.geometry_2)  # disabled
mesh_brep_2 = MeshBrep(
    Brep=cluster_5.geometry_2,
    Settings={GridMaxCount=0, GridMinCount=16, JaggedSeams=False, MaxEdgeLength=0, MinEdgeLength=0.0001, MinTolerance=0, Refine=True, RefineAngle=0, RelativeTolerance=0.65, SimplePlanes=True, Tolerance=0})
brep_join_4 = BrepJoin(Breps=c_script.less)  # -> Breps, Closed
simple_mesh_2 = SimpleMesh(Brep=brep_join_4.Breps)  # disabled
simple_mesh_3 = SimpleMesh(Brep=brep_join_3.Breps)  # disabled

# ----
# TYPY OKEN
# OŘEZ GEOMETRIE
merge_6 = Merge(Data1=type, Data2=type_2, Data3=type_3)
panel_5 = Panel(merge_6)
# nearest triangulation
cluster_6 = Cluster(windowtypes=merge_6, breps=clean_tree)  # disabled

mesh_join = MeshJoin(Meshes=simple_mesh)  # disabled
mesh_flip = MeshFlip(Mesh=simple_mesh_2)  # disabled
mesh_join_2 = MeshJoin(Meshes=mesh_brep_2)

# ----
# PRO 3D TISK
mesh = Mesh([<mesh referenced from the Rhino model> x2])  # disabled
mesh_union = MeshUnion(Meshes=mesh)  # disabled
panel_6 = Panel("1")  # disabled
panel_7 = Panel("2")  # disabled
list_item = ListItem(Index=0, Wrap=True)  # disabled
panel_8 = Panel("4")  # disabled
is_mesh_closed = IsMeshClosed(Mesh=mesh_union)  # disabled
panel_9 = Panel("3")  # disabled
surface = Surface(clean_tree)  # disabled
deconstruct_brep_2 = DeconstructBrep(Brep=surface)  # -> flatten(Faces), Edges, Vertices; disabled
list_length_3 = ListLength(List=deconstruct_brep_2.Vertices)  # disabled
equality = Equality(FirstNumber=list_length_3, SecondNumber=panel_8)  # -> Equality, Inequality; disabled
equality_2 = Equality(FirstNumber=list_length_3, SecondNumber=panel_9)  # -> Equality, Inequality; disabled
curve_2 = Curve(cluster_5.geometry_3)  # disabled
end_points = EndPoints(Curve=curve_2)  # -> Start, End; disabled
control_points = ControlPoints(Curve=curve_2)  # -> Points, Weights, Knots; disabled
curve_closest_point = CurveClosestPoint(Point=control_points.Points, Curve=curve_2)  # -> Point, Parameter, Distance; disabled
line = Line(StartPoint=end_points.Start, EndPoint=end_points.End)  # disabled
shatter = Shatter(Curve=curve_2)  # disabled
panel_10 = Panel("true")  # disabled
mesh_quad = MeshQuad(CornerA=list_item, CornerB=1, CornerC=2, CornerD=3)  # disabled
panel_11 = Panel(is_mesh_closed)  # disabled
brep_join_5 = BrepJoin(Breps=surface)  # -> Breps, Closed; disabled
dispatch = Dispatch(List=deconstruct_brep_2.Vertices, DispatchPattern=equality_2.Equality)  # -> ListA, ListB; disabled
list_item_2 = ListItem(List=dispatch.ListA, Index=panel_7, Wrap=True)  # disabled
list_item_3 = ListItem(List=dispatch.ListA, Index=panel_6, Wrap=True)  # disabled
list_item_4 = ListItem(List=dispatch.ListA, Index=0, Wrap=True)  # disabled
mesh_triangle = MeshTriangle(CornerA=list_item_4, CornerB=list_item_3, CornerC=list_item_2)  # -> flatten(Face); disabled
dispatch_2 = Dispatch(List=dispatch.ListB, DispatchPattern=equality.Equality)  # -> ListA, ListB; disabled
clean_tree_2 = CleanTree(RemoveNulls=True, RemoveInvalid=True, RemoveEmpty=panel_10, Tree=dispatch_2.ListA)  # disabled
line_2 = Line(line)  # disabled
construct_mesh = ConstructMesh(Vertices=clean_tree_2, Faces=mesh_triangle)  # disabled
panel_12 = Panel("5")  # disabled
number_slider = Slider(120, range=0..1000)  # disabled
panel_13 = Panel("2")  # disabled
mesh_surface = MeshSurface(Surface=dispatch_2.ListB, UCount=panel_12, VCount=panel_12, Overhang=True, Equalize=False)  # disabled
mesh_surface_2 = MeshSurface(Surface=dispatch_2.ListA, UCount=panel_13, VCount=panel_13, Overhang=True, Equalize=False)  # disabled
mesh_surface_3 = MeshSurface(Surface=dispatch.ListA, UCount=panel_13, VCount=panel_13, Overhang=True, Equalize=False)  # disabled
construct_mesh_2 = ConstructMesh(Vertices=clean_tree_2, Faces={A=0, B=1, C=2, D=3})  # disabled
mesh_brep_3 = MeshBrep(
    Brep=brep_join_5.Breps,
    Settings={GridMaxCount=0, GridMinCount=16, JaggedSeams=False, MaxEdgeLength=0, MinEdgeLength=0.0001, MinTolerance=0, Refine=True, RefineAngle=0, RelativeTolerance=0.65, SimplePlanes=True, Tolerance=0})  # disabled
mesh_2 = Mesh([<mesh referenced from the Rhino model> x4481])  # disabled
boolean_toggle_2 = BooleanToggle(True)  # disabled
control_points_2 = ControlPoints(Curve=curve_2)  # -> Points, Weights, Knots; disabled
number_slider_2 = Slider(60, range=0..300)  # disabled
is_mesh_closed_2 = IsMeshClosed(Mesh=mesh_2)  # disabled
join_curves = JoinCurves(Curves=curve_2, Preserve=False)  # disabled
polyline = PolyLine(Vertices=control_points_2.Points, Closed=False)  # disabled
panel_14 = Panel("10")  # disabled
pipe = Pipe(Curve=join_curves, Radius=number_slider_2, Caps=boolean_toggle_2)  # -> flatten(Pipe); disabled
offset_mesh_2 = OffsetMesh(Mesh=mesh_brep_3, Distance=number_slider, BothSides=0, CreateSolid=True)  # -> flatten(Offset); disabled
panel_15 = Panel("40")  # disabled
radians = Radians(Degrees=panel_15)  # disabled
brep_join_with_tolerance = BrepJoinWithTolerance(Brep=surface, Tolerance=panel_14)  # disabled
mesh_brep_4 = MeshBrep(
    Brep=brep_join_with_tolerance,
    Settings={GridMaxCount=0, GridMinCount=16, JaggedSeams=False, MaxEdgeLength=0, MinEdgeLength=0.0001, MinTolerance=0, Refine=True, RefineAngle=0, RelativeTolerance=0.65, SimplePlanes=True, Tolerance=0})  # disabled
merge_7 = Merge(Data1=mesh_surface_3, Data2=mesh_surface_2, Data3=mesh_brep_4)  # -> flatten(Result); disabled
mesh_join_3 = MeshJoin(Meshes=merge_7)  # disabled
panel_16 = Panel("1")  # disabled
parameter_pipe_mesh_2 = ParameterPipeMesh(
    Curve=curve_2,
    Radius=number_slider_2,
    ParametersU=[0, 0.1, 0.2, 0.3, 0.4, 0.5, 0.6, 0.7, 0.8, 0.9, 1],
    ParametersV=[0, 0.25, 0.5, 0.75, 1],
    Weighted=False,
    Lengths=False,
    Angle=radians,
    Rotation=radians,
    EndType=panel_16,
    Triangulate=False)  # disabled
panel_17 = Panel("1/150")  # disabled
panel_18 = Panel("1/150")  # disabled
curve_3 = Curve()  # disabled
scale = Scale(Geometry=offset_mesh_2, Center=Point(0, 0, 0), Factor=panel_17)  # -> Geometry, Transform; disabled
panel_19 = Panel("100")  # disabled
brep_3 = Brep(brep_join_5.Breps)  # disabled
is_polysurface_closed = IsPolysurfaceClosed()  # disabled
point_3 = Point(Point(-5925.922747, 625.1720095, 1436.669183))  # disabled
point_4 = Point(Point(-687587.4837, 93818.74162, 215320.7591))  # disabled
scale_2 = Scale(Geometry=brep_join_5.Breps, Center=point_4, Factor=panel_18)  # -> Geometry, Transform; disabled
scale_3 = Scale(Geometry=brep_join_5.Breps, Center=point_4, Factor=panel_18)  # -> Geometry, Transform; disabled
panel_20 = Panel("true")  # disabled
vector_2pt = Vector2Pt(PointA=point_4, PointB=point_3, Unitize=False)  # -> Vector, Length; disabled
point_5 = Point(Point(-4582.699578, 625.1720095, 1435.751103))  # disabled
point_6 = Point(Point(-687587.4837, 93818.74162, 215320.7591))  # disabled
offset_surface = OffsetSurface(Surface=brep_3, Distance=panel_19, BothSides=0, CreateSolid=True)  # disabled
move_to_point = MoveToPoint(Geometry=scale.Geometry, PointA=point_6, PointB=point_5)  # -> Moved, Vector, Transform; disabled
move_2 = Move(Geometry=scale_3.Geometry, Motion=vector_2pt.Vector)  # -> Geometry, Transform; disabled
brep_4 = Brep(move_2.Geometry)  # disabled
move_3 = Move(Geometry=scale_2.Geometry, Motion=vector_2pt.Vector)  # -> Geometry, Transform; disabled
geometry_6 = Geometry(<brep referenced from the Rhino model>)  # disabled
deconstruct_brep_3 = DeconstructBrep(Brep=brep_4)  # -> Faces, Edges, Vertices; disabled
geometry_7 = Geometry(move_to_point.Moved)  # disabled
brep_5 = Brep(move_2.Geometry)  # disabled
simple_mesh_4 = SimpleMesh(Brep=move_3.Geometry)  # disabled
removeduplicatepts = RemoveDuplicatePts(Points=flatten(deconstruct_brep_3.Vertices), Tolerance=0.01)  # disabled
simple_mesh_5 = SimpleMesh(Brep=brep_4)  # disabled
mesh_edges = MeshEdges(Mesh=simple_mesh_5)  # -> NakedEdges, InteriorEdges, NonManifoldEdges; disabled
brep_6 = Brep(<brep referenced from the Rhino model>)  # disabled
brep_closest_point = BrepClosestPoint(Point=removeduplicatepts, Brep=brep_6)  # -> Point, Normal, Distance; disabled
mesh_3 = Mesh(simple_mesh_5)  # disabled
mesh_naked_edges = MeshNakedEdges(Mesh=mesh_3)  # -> Naked, ResultBoolean; disabled
line_3 = Line(StartPoint=removeduplicatepts, EndPoint=brep_closest_point.Point)  # disabled
merge_8 = Merge(Data1=mesh_edges.NakedEdges, Data2=mesh_edges.InteriorEdges, Data3=line_3)  # disabled
panel_21 = Panel("0.5")  # disabled
create_settings = CreateSettings(VoxelSize=panel_21, Bandwidth=1, Isovalue=0, Adaptivity=0.1)  # disabled
panel_22 = Panel("0.75")  # disabled
number_slider_3 = Slider(2.5, range=1..3)  # disabled
curve_to_volume = CurveToVolume(Curves=flatten(merge_8), CurveRadius=panel_22, Settings=create_settings)  # disabled
offset_mesh_3 = OffsetMesh(Mesh=simple_mesh_4, Distance=number_slider_3, BothSides=0, CreateSolid=True)  # disabled
custom_preview_7 = CustomPreview(
    Geometry=offset_mesh_3,
    Material={diffuse=RGB(221, 160, 221), emission=RGB(66, 48, 66), shine=0.5, specular=RGB(255, 255, 255), transparency=0})  # disabled
custom_preview_8 = CustomPreview(
    Geometry=curve_to_volume,
    Material={diffuse=RGB(221, 160, 221), emission=RGB(66, 48, 66), shine=0.5, specular=RGB(255, 255, 255), transparency=0})  # disabled
volume_to_mesh = VolumeToMesh(Volume=curve_to_volume, VolumeSettings=create_settings)  # disabled
panel_23 = Panel("10")  # disabled
panel_24 = Panel("50000")  # disabled
reduce_mesh = ReduceMesh(Mesh=volume_to_mesh, FaceCount=panel_24, Accuracy=panel_23, FaceType=0, Distort=True, Normalize=False)  # -> Reduced, CountDifference; disabled
is_mesh_closed_3 = IsMeshClosed(Mesh=reduce_mesh.Reduced)  # disabled
merge_9 = Merge(Data1=offset_mesh_3, Data2=reduce_mesh.Reduced)  # -> flatten(Result); disabled

mesh_flip_2 = MeshFlip(Mesh=simple_mesh_3)  # disabled

colour_swatch_6 = ColourSwatch(SwatchColor=RGB(255, 115, 115))  # disabled
custom_preview_9 = CustomPreview(Geometry=[mesh_flip_2, simple_mesh_3, mesh_flip, simple_mesh_2], Material=colour_swatch_6)  # disabled
custom_preview_10 = CustomPreview(Geometry=[simple_mesh_2, mesh_flip], Material=colour_swatch_5)  # disabled

brep_edges_2 = BrepEdges(Brep=[brep_join_3.Breps, brep_join_4.Breps])  # -> Naked, Interior, NonManifold; disabled
custom_preview_11 = CustomPreview(Geometry=parameter_pipe_mesh, Material=colour_swatch_6)  # disabled

# ----
# PODPORNÉ PRVKY
add_directshape_geometry = AddDirectShapeGeometry(Name=název, Category=category, Geometry=mesh_join_2, Material=material, TrackingMode=2)

brep_7 = Brep(clean_tree)
brep_join_6 = BrepJoin(Breps=brep_7)  # -> Breps, Closed

# ----
# OPRAVA ENSCAPE
# backface culling
simple_mesh_6 = SimpleMesh(Brep=brep_join_3.Breps)

# ----
# BIM
mesh_join_4 = MeshJoin(Meshes=simple_mesh_6)

# ----
# PRŮSVITNÁ FASÁDA
category_2 = Category(<category referenced from the Revit model>)
add_directshape_geometry_2 = AddDirectShapeGeometry(Name=název_2, Category=category_2, Geometry=mesh_join_4, Material=material_2, TrackingMode=2)

geometry_8 = Geometry(mesh_join_4)

mesh_flip_3 = MeshFlip(Mesh=geometry_8)

merge_10 = Merge(Data1=geometry_8, Data2=mesh_flip_3)

# ----
# OPRAVA ENSCAPE
# backface culling
simple_mesh_7 = SimpleMesh(Brep=brep_join_4.Breps)

mesh_join_5 = MeshJoin(Meshes=simple_mesh_7)

# ----
# PRŮSVITNÁ SEVERNÍ FASÁDA - PRŮHLEDNĚJŠÍ
category_3 = Category(<category referenced from the Revit model>)
add_directshape_geometry_3 = AddDirectShapeGeometry(Name=název_3, Category=category_3, Geometry=mesh_join_5, Material=material_3, TrackingMode=2)

geometry_9 = Geometry(mesh_join_5)

mesh_flip_4 = MeshFlip(Mesh=geometry_9)

merge_11 = Merge(Data1=geometry_9, Data2=mesh_flip_4)

# ----
# VÝBĚR PRVKŮ Z REVITU
type_filter = TypeFilter(Types=merge_6, Inverted=False)

logical_and_filter = LogicalAndFilter(FilterA=type_filter, FilterB=design_option_filter)

query_elements = QueryElements(Filter=logical_and_filter, Limit=100)  # -> Elements, Count

# ----
# VYTVOŘENÍ OŘEZUJÍCÍ HMOTY OKEN
analyze_wall = AnalyzeWall(Wall=query_elements.Elements)  # -> WallSystemFamily, WallType, ParentStackedWall, BaseLevel, BaseLevelOffset, BottomIsAttached, TopLevel, TopLevelOffset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
bounding_box = BoundingBox(Content=query_elements.Elements, Plane=PlaneXY(0, 0, 0))  # -> Box, Box_2
volume = Volume(Geometry=bounding_box.Box_2)  # -> Volume, Centroid
plane_normal = PlaneNormal(Origin=volume.Centroid, ZAxis=analyze_wall.Orientation)
scale_nu = ScaleNU(Geometry=bounding_box.Box_2, Plane=plane_normal, ScaleX="1", ScaleY="1", ScaleZ="4")  # -> Geometry, Transform
solid_union = SolidUnion(Breps=flatten(scale_nu.Geometry))

# ----
# OŘÍZNOUT GEOMETRII OKEN
split_brep_multiple = SplitBrepMultiple(Brep=graft(brep_7), Cutters=scale_nu.Geometry)  # -> flatten(Result)
deconstruct_brep_4 = DeconstructBrep(Brep=flatten(split_brep_multiple))  # -> Faces, Edges, Vertices
curve_middle = CurveMiddle(Curve=deconstruct_brep_4.Edges)

# ---- group: RYCHLÝ TRIM
c_script_2 = CSharpScript(windows=flatten(scale_nu.Geometry), breps=flatten(split_brep_multiple), pts=curve_middle)  # -> insi, outs; inputs windows: list of Brep, breps: list of Brep, pts: tree of Point3d; same code as c_script

# ----
simple_mesh_8 = SimpleMesh(Brep=c_script_2.outs)
mesh_join_6 = MeshJoin(Meshes=simple_mesh_8)

# ----
# OŘEZ OKEN
# hrana brepu na ořezující geometrii
addition = Addition(A=poloměr_nosných_profilů)
multiplication = Multiplication(A=addition, B="-1")
offset_surface_2 = OffsetSurface(Surface=c_script_2.outs, Distance=multiplication, BothSides=0, CreateSolid="false")  # -> flatten(Offset); disabled
geometry_10 = Geometry(offset_surface_2)
flip = Flip(Surface=geometry_10)  # -> Surface, Result
merge_12 = Merge(Data1=geometry_10, Data2=flip.Surface)
název_4 = Panel("fasada_2")
# convert to surfaces
# trim fasade
material_4 = Material(<material referenced from the Revit model>)
category_4 = Category(<category referenced from the Revit model>)

# ----
# nearest triangulation
# create mesh
# pseudo rnd list of numbers
offset_mesh_4 = OffsetMesh(Mesh=mesh_join_6, Distance=multiplication, BothSides=0, CreateSolid=panel_3)

add_directshape_geometry_4 = AddDirectShapeGeometry(Name=název_4, Category=category_4, Geometry=offset_mesh_4, Material=material_4, TrackingMode=2)

# ==== cluster Cluster
breps = ClusterInput()

# ----
# VÝBĚR PRVKŮ Z REVITU
windowtypes = ClusterInput()
type_filter = TypeFilter(Types=windowtypes, Inverted=False)
query_elements = QueryElements(Filter=type_filter, Limit=100)  # -> Elements, Count

element_geometry = ElementGeometry(Elements=query_elements.Elements, DetailLevel=1)  # disabled

# ----
# VYTVOŘENÍ OŘEZUJÍCÍ HMOTY OKEN
analyze_wall = AnalyzeWall(Wall=query_elements.Elements)  # -> WallSystemFamily, WallType, ParentStackedWall, BaseLevel, BaseLevelOffset, BottomIsAttached, TopLevel, TopLevelOffset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
bounding_box = BoundingBox(Content=query_elements.Elements, Plane=PlaneXY(0, 0, 0))  # -> Box, Box_2
volume = Volume(Geometry=bounding_box.Box_2)  # -> Volume, Centroid
plane_normal = PlaneNormal(Origin=volume.Centroid, ZAxis=analyze_wall.Orientation)
scale_nu = ScaleNU(Geometry=bounding_box.Box_2, Plane=plane_normal, ScaleX="1", ScaleY="1", ScaleZ="3")  # -> Geometry, Transform
solid_union = SolidUnion(Breps=scale_nu.Geometry)

brep_join = BrepJoin(Breps=breps)  # -> Breps, Closed

# ----
# OŘÍZNOUT GEOMETRII OKEN
split_brep_multiple = SplitBrepMultiple(Brep=graft(brep_join.Breps), Cutters=solid_union)
deconstruct_brep = DeconstructBrep(Brep=flatten(split_brep_multiple))  # -> Faces, Edges, Vertices
# hrana brepu na ořezující geometrii
curve_middle = CurveMiddle(Curve=deconstruct_brep.Edges)

# ---- group: RYCHLÝ TRIM
c_script = CSharpScript(windows=flatten(solid_union), breps=flatten(split_brep_multiple), pts=curve_middle)  # -> insi, outs; inputs windows: list of Brep, breps: list of Brep, pts: tree of Point3d
# ---------- c_script: C# ----------
// Grasshopper Script Instance
#region Usings
using System;
using System.Linq;
using System.Collections;
using System.Collections.Generic;
using System.Drawing;

using Rhino;
using Rhino.Geometry;

using Grasshopper;
using Grasshopper.Kernel;
using Grasshopper.Kernel.Data;
using Grasshopper.Kernel.Types;
#endregion

public class Script_Instance : GH_ScriptInstance
{
    #region Notes
    /* 
      Members:
        RhinoDoc RhinoDocument
        GH_Document GrasshopperDocument
        IGH_Component Component
        int Iteration

      Methods (Virtual & overridable):
        Print(string text)
        Print(string format, params object[] args)
        Reflect(object obj)
        Reflect(object obj, string method_name)
    */
    #endregion

    private void RunScript(
		List<Brep> windows,
		List<Brep> breps,
		DataTree<Point3d> pts,
		ref object insi,
		ref object outs)
    {
        double tol=1;

        List<Brep> inside=new List<Brep>();
        List<Brep> outside=new List<Brep>();
        for (int i=0; i<breps.Count; i++){
           List<Point3d> pt = pts.Branch(i);
            Brep b = breps[i];

           // bool found=false;
          /*  int verticles_inside=0;
            foreach (var v in b.Vertices.ToList()) {
                bool pt_inside=false; 
                foreach (var w in windows){
                  /*   if (w.IsPointInside(p, tol, true)) {
                        pt_inside=true;
                        break;
                    }
                    if (bbox.Contains(v.Location)){
                        pt_inside=true;
                        break;
                    }*/
                 /* if (w.IsPointInside(v.Location, tol, false)) {
                        pt_inside=true;
                       break;
                    }

                   /* if (Rhino.Geometry.Intersect.Intersection.BrepSurface(w, b.Surfaces[0], tol, out Curve[] intersectionCurves, out Point3d[] intersectionPoints)){
                        pt_inside=true;
                        break;
                    }*/
              /*  }


                if (pt_inside){
                    verticles_inside++;
                 //   found=true;
                }
            }*/
          

          /*  foreach (var s in windows){
                if (s.IsPointInside(p, tol, true)) {
                    found=true;
                    break;
                }
            }*/

            int middlePts=0;
            foreach (var p in pt){
                bool inside2=false;
                foreach (var w in windows) {
                    if (w.IsPointInside(p, tol, false)) {
                        inside2=true;
                        break;
                    }
                } 
                if (inside2)middlePts++;
            }

            if (/*verticles_inside==b.Vertices.Count && */middlePts==pt.Count) {
                inside.Add(b);
            }else{
                outside.Add(b);
            }


        }
        insi = inside;
        outs = outside;
    }
}
# ---------- end c_script ----------

# ----
outsidewindows = ClusterOutput(c_script.outs)

# ==== cluster Cluster_2
points = ClusterInput()
# TRIANGULACE V ROVINĚ
delaunay_mesh = DelaunayMesh(Points=points, Plane=PlaneXY(0, 0, 0))

deconstruct_mesh = DeconstructMesh(Mesh=delaunay_mesh)  # -> Vertices, Faces, Colours, Normals
# PŘEVÉST MESH NA BREP
deconstruct_face = DeconstructFace(Face=deconstruct_mesh.Faces)  # -> CornerA, CornerB, CornerC, CornerD
list_item = ListItem(List=deconstruct_mesh.Vertices, Index=deconstruct_face.CornerA, Wrap=True)
list_item_2 = ListItem(List=deconstruct_mesh.Vertices, Index=deconstruct_face.CornerB, Wrap=True)
list_item_3 = ListItem(List=deconstruct_mesh.Vertices, Index=deconstruct_face.CornerC, Wrap=True)
_4point_surface = _4PointSurface(CornerA=list_item, CornerB=list_item_2, CornerC=list_item_3)

vector = Vector(Vector(0, 0, -10))
deconstruct_brep = DeconstructBrep(Brep=_4point_surface)  # -> Faces, Edges, Vertices
mesh = Mesh(delaunay_mesh)

# ----
# 0-2NP
panel = Panel("0")
# PLOCHÝ MESH
scale_nu = ScaleNU(Geometry=delaunay_mesh, Plane=PlaneXY(0, 0, 0), ScaleX=1, ScaleY=1, ScaleZ=panel)  # -> Geometry, Transform

# ----
# KŘIVKY UVNITŘ
# SPOJENÉ PLOCHY
# ROZDĚLIT OKRAJE
boundary2 = ClusterInput()
curve = Curve(boundary2)

unit_z = UnitZ(Factor=1)
# OBLAST USEKNUTÍ
boundary_surfaces = BoundarySurfaces(Edges=boundary2)
multiplication = Multiplication(A=unit_z, B="3000")
extrude = Extrude(Base=boundary_surfaces, Direction=multiplication)

trim_with_brep = TrimWithBrep(Curve=deconstruct_brep.Edges, Brep=extrude)  # -> Inside, Outside
path_mapper = PathMapper(trim_with_brep.Inside, source="{A;B;C;D}", target="{A;B;C}")

# ----
# SPOJIT VNITŘNÍ KŘIVKY
join_curves = JoinCurves(Curves=path_mapper, Preserve=False)

# ----
# OBLAST USEKNUTÍ
# ROZDĚLIT OKRAJE
boundary1 = ClusterInput()
curve_2 = Curve(boundary1)

move = Move(Geometry=boundary1, Motion=vector)  # -> Geometry, Transform

unit_z_2 = UnitZ(Factor=1)
boundary_surfaces_2 = BoundarySurfaces(Edges=move.Geometry)
multiplication_2 = Multiplication(A=unit_z_2, B="3000")
extrude_2 = Extrude(Base=boundary_surfaces_2, Direction=multiplication_2)

# ----
# KŘIVKY UVNITŘ
trim_with_brep_2 = TrimWithBrep(Curve=deconstruct_brep.Edges, Brep=extrude_2)  # -> Inside, Outside
# HLAVNÍ FASÁDA
path_mapper_2 = PathMapper(trim_with_brep_2.Inside, source="{A;B;C;D}", target="{A;B;C}")

# ----
# SPOJIT VNITŘNÍ KŘIVKY
join_curves_2 = JoinCurves(Curves=path_mapper_2, Preserve=False)

end_points = EndPoints(Curve=flatten(path_mapper))  # -> Start, End
merge = Merge(Data1=end_points.Start, Data2=end_points.End)

# ---- group: Body na křice
c_script = CSharpScript(pts=merge, curve=curve)  # -> parameters; inputs pts: list of Point3d, curve: Curve
# ---------- c_script: C# ----------
#region Usings
using System;
using System.Linq;
using System.Collections;
using System.Collections.Generic;
using System.Drawing;

using Rhino;
using Rhino.Geometry;

using Grasshopper;
using Grasshopper.Kernel;
using Grasshopper.Kernel.Data;
using Grasshopper.Kernel.Types;
#endregion

public class Script_Instance : GH_ScriptInstance {
    private void RunScript(List<Point3d> pts, Curve curve, ref object parameters) {
        // Seznam provýstup parametrů
        List<double> list=new List<double>();

        foreach (Point3d pt in pts) {
            if (curve.ClosestPoint(pt, out double p)) {
                var closest=curve.PointAt(p);

                // Rovinná vzdálenost
                double dx=closest.X-pt.X, dy=closest.Y-pt.Y;
                if (Math.Sqrt(dx*dx+dy*dy)<1)list.Add(p);
            }            
        }
        parameters = list;
    }
}
# ---------- end c_script ----------

# ----
end_points_2 = EndPoints(Curve=flatten(path_mapper_2))  # -> Start, End
merge_2 = Merge(Data1=end_points_2.Start, Data2=end_points_2.End)

# ---- group: Body na křivce
c_script_2 = CSharpScript(pts=merge_2, curve=curve_2)  # -> parameters; inputs pts: list of Point3d, curve: Curve
# ---------- c_script_2: C# ----------
#region Usings
using System;
using System.Linq;
using System.Collections;
using System.Collections.Generic;
using System.Drawing;

using Rhino;
using Rhino.Geometry;

using Grasshopper;
using Grasshopper.Kernel;
using Grasshopper.Kernel.Data;
using Grasshopper.Kernel.Types;
#endregion

public class Script_Instance : GH_ScriptInstance {
    static double tol=1;

    // Body na křivce
    private void RunScript(List<Point3d> pts, Curve curve, ref object parameters) {
        // Seznam parametrů
        List<double> list=new List<double>();

        // Prohledat body
        foreach (Point3d pt in pts) {
            // Nejbižší bod na křice
            if (curve.ClosestPoint(pt, out double p)) {
                var closest=curve.PointAt(p);

                // Rovinná vzdálenost k bodu
                double dx=closest.X-pt.X, dy=closest.Y-pt.Y;
                if (Math.Sqrt(dx*dx+dy*dy)<tol) list.Add(p);
            }            
        }
        parameters = list;
    }
}
# ---------- end c_script_2 ----------

# ----
shatter = Shatter(Curve=curve, Parameters=c_script)
control_points = ControlPoints(Curve=shatter)  # -> Points, Weights, Knots

# ---- group: KANGAROO - Mesh Map
mesh_map = MeshMap(MeshFrom=scale_nu.Geometry, MeshTo=mesh, Points=control_points.Points, Distance="10000", Project=Toggle(True))

# ----
polyline = PolyLine(Vertices=mesh_map, Closed=False)

c_script_3 = CSharpScript(inners=flatten(join_curves), edges=flatten(polyline))  # -> a; inputs inners: list of Curve, edges: list of Curve
# ---------- c_script_3: C# ----------
// Grasshopper Script Instance
#region Usings
using System;
using System.Linq;
using System.Collections;
using System.Collections.Generic;
using System.Drawing;

using Rhino;
using Rhino.Geometry;

using Grasshopper;
using Grasshopper.Kernel;
using Grasshopper.Kernel.Data;
using Grasshopper.Kernel.Types;
#endregion

public class Script_Instance : GH_ScriptInstance
{
    #region Notes
    /* 
      Members:
        RhinoDoc RhinoDocument
        GH_Document GrasshopperDocument
        IGH_Component Component
        int Iteration

      Methods (Virtual & overridable):
        Print(string text)
        Print(string format, params object[] args)
        Reflect(object obj)
        Reflect(object obj, string method_name)
    */
    #endregion

    private void RunScript(List<Curve> inners, List<Curve> edges, ref object a)
    {
        List<Curve> complete=new List<Curve>();
        double tol=1;
        foreach (Curve inner in inners) {
            if (inner.IsClosed) {
                complete.Add(inner);
                continue;
            }
            Point3d end=inner.PointAtEnd;
            Point3d start=inner.PointAtEnd;
            foreach (Curve edge in edges) {
                if (end.DistanceTo(edge.PointAtStart)<tol && end.DistanceTo(edge.PointAtStart)<tol){
                   Curve[] joined= Curve.JoinCurves(new Curve[]{inner,edge});
                    if (joined.Length==1)complete.AddRange(joined);
                    break;
                }
            }
        }
        a = complete;
    }
}
# ---------- end c_script_3 ----------
close_curve = CloseCurve(Curve=c_script_3, CloseType=0, Bulge=0.5, Tolerance=0)  # -> graft(Closed), ResultBoolean
boundary_surfaces_3 = BoundarySurfaces(Edges=close_curve.Closed)  # -> flatten(Surfaces)

surfaces = ClusterOutput(boundary_surfaces_3)

shatter_2 = Shatter(Curve=curve_2, Parameters=c_script_2)
control_points_2 = ControlPoints(Curve=shatter_2)  # -> Points, Weights, Knots

# ---- group: KANGAROO - Mesh Map
mesh_map_2 = MeshMap(MeshFrom=scale_nu.Geometry, MeshTo=mesh, Points=control_points_2.Points, Distance="10000", Project=Toggle(True))

# ----
polyline_2 = PolyLine(Vertices=mesh_map_2, Closed=False)

c_script_4 = CSharpScript(inners=flatten(join_curves_2), edges=flatten(polyline_2))  # -> a; inputs inners: list of Curve, edges: list of Curve; same code as c_script_3
# SPOJENÉ PLOCHY
close_curve_2 = CloseCurve(Curve=c_script_4, CloseType=0, Bulge=0.5, Tolerance=0)  # -> graft(Closed), ResultBoolean
boundary_surfaces_4 = BoundarySurfaces(Edges=close_curve_2.Closed)  # -> flatten(Surfaces)

surfaces_2 = ClusterOutput(boundary_surfaces_4)

# ==== cluster Cluster_3
areawheretogeneratepts = ClusterInput()
xy_plane = XYPlane(Origin=Point(0, 0, 0))

offsetdis = Slider(3000, range=1000..3000)
region_union = RegionUnion(Curves=areawheretogeneratepts, Plane=xy_plane)
xy_plane_2 = XYPlane(Origin=Point(0, 0, 0))
offset_curve = OffsetCurve(Curve=region_union, Distance=offsetdis, Plane=xy_plane_2, Corners=1)

seed = ClusterInput()
smoothdisneighbor = ClusterInput()
xy_plane_3 = XYPlane(Origin=Point(0, 0, 0))
number = Number(seed)

number_slider = Slider(3, range=0..500)  # "m2/pt"
geometry_pipeline = GeometryPipeline(
    GroupByLayer=False,
    GroupByType=False,
    IncludeHidden=True,
    IncludeLocked=True,
    LayerFilter="typy fasady::kancelare",
    NameFilter="*",
    SublayerFiltering=True,
    TypeFilter=4)
boundary_surfaces = BoundarySurfaces(Edges=geometry_pipeline)
area = Area(Geometry=boundary_surfaces)  # -> Area, Centroid
division = Division(A=area.Area, B="1e6")
division_2 = Division(A=division, B=number_slider)
populate_geometry = PopulateGeometry(Geometry=boundary_surfaces, Count=division_2, Seed=number)  # -> flatten(Population)

number_slider_2 = Slider(25, range=0..50)  # "m2/pt"
geometry_pipeline_2 = GeometryPipeline(
    GroupByLayer=False,
    GroupByType=False,
    IncludeHidden=True,
    IncludeLocked=True,
    LayerFilter="typy fasady::chodby",
    NameFilter="*",
    SublayerFiltering=True,
    TypeFilter=4)
boundary_surfaces_2 = BoundarySurfaces(Edges=geometry_pipeline_2)
area_2 = Area(Geometry=boundary_surfaces_2)  # -> Area, Centroid
# OBLAST KE GENEROVÁNÍ BODŮ
panel = Panel("1e6")
division_3 = Division(A=area_2.Area, B=panel)
division_4 = Division(A=division_3, B=number_slider_2)
populate_geometry_2 = PopulateGeometry(Geometry=boundary_surfaces_2, Count=division_4, Seed=number)  # -> flatten(Population)

number_slider_3 = Slider(30, range=0..500)  # "m2/pt"
geometry_pipeline_3 = GeometryPipeline(
    GroupByLayer=False,
    GroupByType=False,
    IncludeHidden=True,
    IncludeLocked=True,
    LayerFilter="typy fasady::velke_ucebny",
    NameFilter="*",
    SublayerFiltering=True,
    TypeFilter=4)
boundary_surfaces_3 = BoundarySurfaces(Edges=geometry_pipeline_3)
area_3 = Area(Geometry=boundary_surfaces_3)  # -> Area, Centroid
division_5 = Division(A=area_3.Area, B="1e6")
division_6 = Division(A=division_5, B=number_slider_3)
populate_geometry_3 = PopulateGeometry(Geometry=boundary_surfaces_3, Count=division_6, Seed=number)  # -> flatten(Population)

disfromfacade = ClusterInput()
xy_plane_4 = XYPlane(Origin=Point(0, 0, 0))
region_union_2 = RegionUnion(Curves=offset_curve, Plane=xy_plane_4)
number_slider_4 = Slider(700, range=0..1000)
point = Point([Point(-25932.18805, 52396.08492, 0), Point(-25835.27074, 50050.68618, 0), Point(-27907.73227, 49914.41847, 0), Point(-27823.97658, 52606.56578, 0), Point(-27094.10553, 50955.3821, 0), Point(-9311.667836, 54242.19001, 0), Point(-10089.39928, 55187.43285, 0), Point(-9048.435655, 56300.18707, 0), Point(-9622.760415, 57652.24327, 0), Point(-9239.877242, 58394.07942, 0), Point(-10292.80597, 58453.90492, 0), Point(-9443.283927, 59746.13563, 0), Point(-10280.84087, 61038.36634, 0)])

více_od_fasady = Slider(0.5, range=0.2..6)
point_2 = Point(populate_geometry)
multiplication = Multiplication(A=disfromfacade, B=více_od_fasady)

více_od_fasady_2 = Slider(1.2, range=0.2..6)
point_3 = Point(populate_geometry_2)
multiplication_2 = Multiplication(A=disfromfacade, B=více_od_fasady_2)

více_od_fasady_3 = Slider(1.5, range=0.2..6)
point_4 = Point(populate_geometry_2)
multiplication_3 = Multiplication(A=disfromfacade, B=více_od_fasady_3)

addition = Addition(A=multiplication_2, B=Slider(112, range=0..1000))
addition_2 = Addition(A=multiplication_3, B=Slider(238, range=0..1000))
min_odsazeni = Slider(70, range=0..100)

number_slider_5 = Slider(7, range=0..500)  # "m2/pt"
merge = Merge(Data1=geometry_pipeline_2, Data2=geometry_pipeline, Data3=geometry_pipeline_3)

region_union_3 = RegionUnion(Curves=merge, Plane=xy_plane_3)

region_difference = RegionDifference(CurvesA=region_union_2, CurvesB=region_union_3)
boundary_surfaces_4 = BoundarySurfaces(Edges=region_difference)
area_4 = Area(Geometry=boundary_surfaces_4)  # -> Area, Centroid
division_7 = Division(A=area_4.Area, B="1e6")
division_8 = Division(A=division_7, B=number_slider_5)
populate_geometry_4 = PopulateGeometry(Geometry=boundary_surfaces_4, Count=division_8, Seed=number)  # -> flatten(Population)

více_od_fasady_4 = Slider(1, range=0.2..6)
point_5 = Point(populate_geometry_4)
multiplication_4 = Multiplication(A=disfromfacade, B=více_od_fasady_4)

number_slider_6 = Slider(7, range=0..50)  # "m2/pt"
geometry_pipeline_4 = GeometryPipeline(
    GroupByLayer=False,
    GroupByType=False,
    IncludeHidden=True,
    IncludeLocked=True,
    LayerFilter="typy fasady::ohyb",
    NameFilter="*",
    SublayerFiltering=True,
    TypeFilter=4)
boundary_surfaces_5 = BoundarySurfaces(Edges=geometry_pipeline_4)
area_5 = Area(Geometry=boundary_surfaces_5)  # -> Area, Centroid
division_9 = Division(A=area_5.Area, B="1e6")
division_10 = Division(A=division_9, B=number_slider_6)

control_points = ControlPoints(Curve=region_union)  # -> Points, Weights, Knots
c_script = CSharpScript(pts_boundary=flatten(control_points.Points), pts_rnd=flatten(point_2), x=smoothdisneighbor)  # -> smoothValues; inputs pts_boundary: list of Point3d, pts_rnd: list of Point3d, x: Double
# ---------- c_script: C# ----------
#region Usings
using System;
using System.Linq;
using System.Collections;
using System.Collections.Generic;
using System.Drawing;

using Rhino;
using Rhino.Geometry;

using Grasshopper;
using Grasshopper.Kernel;
using Grasshopper.Kernel.Data;
using Grasshopper.Kernel.Types;
#endregion

public class Script_Instance : GH_ScriptInstance{
    private void RunScript(
		List<Point3d> pts_boundary,
		List<Point3d> pts_rnd,
		double x,
		ref object smoothValues) {
        double minX=double.PositiveInfinity;

        foreach (Point3d p in pts_boundary) {
            if (p.X<minX) minX=p.X;
        }

        List<double> vals=new List<double>();
        foreach (Point3d p in pts_rnd) {
            double xVal=(p.X-minX)/x;
            if (xVal>=1) vals.Add(1);
            else if (xVal<=0) vals.Add(0);
            else vals.Add(xVal);
        }

        smoothValues = vals;
    }
}
# ---------- end c_script ----------
graph_mapper = GraphMapper(c_script, x0=0, x1=1, y0=0, y1=1, container_name="Sine", Equation_px=[0, 1], Equation_py=[0, 1])

control_points_2 = ControlPoints(Curve=region_union)  # -> Points, Weights, Knots
c_script_2 = CSharpScript(pts_boundary=flatten(control_points_2.Points), pts_rnd=flatten(point_3), x=addition)  # -> smoothValues; inputs pts_boundary: list of Point3d, pts_rnd: list of Point3d, x: Double; same code as c_script
graph_mapper_2 = GraphMapper(c_script_2, x0=0, x1=1, y0=0, y1=1, container_name="Sine", Equation_px=[0, 1], Equation_py=[0, 1])

control_points_3 = ControlPoints(Curve=region_union)  # -> Points, Weights, Knots
c_script_3 = CSharpScript(pts_boundary=flatten(control_points_3.Points), pts_rnd=flatten(point_5), x=smoothdisneighbor)  # -> smoothValues; inputs pts_boundary: list of Point3d, pts_rnd: list of Point3d, x: Double; same code as c_script
graph_mapper_3 = GraphMapper(c_script_3, x0=0, x1=1, y0=0, y1=1, container_name="Sine", Equation_px=[0, 1], Equation_py=[0, 1])

control_points_4 = ControlPoints(Curve=region_union)  # -> Points, Weights, Knots
c_script_4 = CSharpScript(pts_boundary=flatten(control_points_4.Points), pts_rnd=flatten(point_4), x=addition_2)  # -> smoothValues; inputs pts_boundary: list of Point3d, pts_rnd: list of Point3d, x: Double; same code as c_script
graph_mapper_4 = GraphMapper(c_script_4, x0=0, x1=1, y0=0, y1=1, container_name="Sine", Equation_px=[0, 1], Equation_py=[0, 1])

více_od_fasady_5 = Slider(1, range=0.2..6)
multiplication_5 = Multiplication(A=disfromfacade, B=více_od_fasady_5)

addition_3 = Addition(A=multiplication_5, B=Slider(238, range=0..1000))

seed_2 = Slider(0, range=0..1000)
list_length = ListLength(List=point_2)
mindistance = Slider(1, range=0..1000)

# ---- group: NÁHODNÁ ČÍSLA
c_script_5 = CSharpScript(seed=seed_2, count=list_length)  # -> numbers; inputs seed: Int32, count: Int32
# ---------- c_script_5: C# ----------
#region Usings
using System;
using System.Linq;
using System.Collections;
using System.Collections.Generic;
using System.Drawing;

using Rhino;
using Rhino.Geometry;

using Grasshopper;
using Grasshopper.Kernel;
using Grasshopper.Kernel.Data;
using Grasshopper.Kernel.Types;
#endregion

public class Script_Instance : GH_ScriptInstance {

    private void RunScript(int seed, int count, ref object numbers) {
        List<double> rnds=new List<double>();
        Random rnd=new Random(seed);
        for (int i=0; i<count; i++) {
            rnds.Add(rnd.NextDouble());
        }
        numbers = rnds;
    }
}
# ---------- end c_script_5 ----------

# ----
seed_3 = Slider(0, range=0..1000)
list_length_2 = ListLength(List=point_3)
mindistance_2 = Slider(1, range=0..1000)

# ---- group: NÁHODNÁ ČÍSLA
c_script_6 = CSharpScript(seed=seed_3, count=list_length_2)  # -> numbers; inputs seed: Int32, count: Int32; same code as c_script_5

# ----
seed_4 = Slider(0, range=0..1000)
list_length_3 = ListLength(List=point_5)
mindistance_3 = Slider(1, range=0..1000)

# ---- group: NÁHODNÁ ČÍSLA
c_script_7 = CSharpScript(seed=seed_4, count=list_length_3)  # -> numbers; inputs seed: Int32, count: Int32; same code as c_script_5

# ----
seed_5 = Slider(0, range=0..1000)
list_length_4 = ListLength(List=point_4)
mindistance_4 = Slider(1, range=0..1000)

# ---- group: NÁHODNÁ ČÍSLA
c_script_8 = CSharpScript(seed=seed_5, count=list_length_4)  # -> numbers; inputs seed: Int32, count: Int32; same code as c_script_5

# ----
control_points_5 = ControlPoints(Curve=region_union)  # -> Points, Weights, Knots

multiplication_6 = Multiplication(A=c_script_5, B=multiplication)
addition_4 = Addition(A=multiplication_6, B=mindistance)

multiplication_7 = Multiplication(A=addition_4, B=graph_mapper)

c_script_9 = CSharpScript(x=multiplication_7, n=min_odsazeni)  # -> a; inputs x: Double, n: Double
# ---------- c_script_9: C# ----------
// Grasshopper Script Instance
#region Usings
using System;
using System.Linq;
using System.Collections;
using System.Collections.Generic;
using System.Drawing;

using Rhino;
using Rhino.Geometry;

using Grasshopper;
using Grasshopper.Kernel;
using Grasshopper.Kernel.Data;
using Grasshopper.Kernel.Types;
#endregion

public class Script_Instance : GH_ScriptInstance
{
    #region Notes
    /* 
      Members:
        RhinoDoc RhinoDocument
        GH_Document GrasshopperDocument
        IGH_Component Component
        int Iteration

      Methods (Virtual & overridable):
        Print(string text)
        Print(string format, params object[] args)
        Reflect(object obj)
        Reflect(object obj, string method_name)
    */
    #endregion

    private void RunScript(double x, double n, ref object a)
    {
        if (x<n) a=n; else a=x;
    }
}
# ---------- end c_script_9 ----------

unit_z = UnitZ(Factor=c_script_9)

# ----
# NÁHODNÁ VELIKOST VEKTORŮ OD FASÁDY
move = Move(Geometry=point_2, Motion=unit_z)  # -> Geometry, Transform

multiplication_8 = Multiplication(A=c_script_6, B=multiplication_2)
addition_5 = Addition(A=multiplication_8, B=mindistance_2)

multiplication_9 = Multiplication(A=addition_5, B=graph_mapper_2)

c_script_10 = CSharpScript(x=multiplication_9, n=min_odsazeni)  # -> a; inputs x: Double, n: Double; same code as c_script_9

unit_z_2 = UnitZ(Factor=c_script_10)

# ----
# NÁHODNÁ VELIKOST VEKTORŮ OD FASÁDY
move_2 = Move(Geometry=point_3, Motion=unit_z_2)  # -> Geometry, Transform

multiplication_10 = Multiplication(A=c_script_7, B=multiplication_4)
addition_6 = Addition(A=multiplication_10, B=mindistance_3)

multiplication_11 = Multiplication(A=addition_6, B=graph_mapper_3)

c_script_11 = CSharpScript(x=multiplication_11, n=min_odsazeni)  # -> a; inputs x: Double, n: Double; same code as c_script_9

unit_z_3 = UnitZ(Factor=c_script_11)

# ----
# NÁHODNÁ VELIKOST VEKTORŮ OD FASÁDY
move_3 = Move(Geometry=point_5, Motion=unit_z_3)  # -> Geometry, Transform

c_script_12 = CSharpScript(everywhere=move_3.Geometry, notwindows=move_2.Geometry, limit=number_slider_4)  # -> a; inputs everywhere: list of Point3d, notwindows: list of Point3d, limit: Double
# ---------- c_script_12: C# ----------
// Grasshopper Script Instance
#region Usings
using System;
using System.Linq;
using System.Collections;
using System.Collections.Generic;
using System.Drawing;

using Rhino;
using Rhino.Geometry;

using Grasshopper;
using Grasshopper.Kernel;
using Grasshopper.Kernel.Data;
using Grasshopper.Kernel.Types;
#endregion

public class Script_Instance : GH_ScriptInstance
{
    private void RunScript(
		List<Point3d> everywhere,
		List<Point3d> notwindows,
		double limit,
		ref object a)
    {
        List<Point3d> pts=new List<Point3d>();


        foreach (Point3d pnw in notwindows){
            double smallest=1e10;
            foreach (Point3d p in everywhere){
                double d=pnw.DistanceTo(p);
                if (d<smallest) {
                    smallest=d;
                }
            }
            if (smallest>limit) pts.Add(pnw);
        }

        pts.AddRange(everywhere);

        a = pts;
    }
}
# ---------- end c_script_12 ----------
c_script_13 = CSharpScript(everywhere=c_script_12, notwindows=move.Geometry, limit=number_slider_4)  # -> a; inputs everywhere: list of Point3d, notwindows: list of Point3d, limit: Double; same code as c_script_12

multiplication_12 = Multiplication(A=c_script_8, B=multiplication_3)
addition_7 = Addition(A=multiplication_12, B=mindistance_4)

multiplication_13 = Multiplication(A=addition_7, B=graph_mapper_4)

c_script_14 = CSharpScript(x=multiplication_13, n=min_odsazeni)  # -> a; inputs x: Double, n: Double; same code as c_script_9

unit_z_4 = UnitZ(Factor=c_script_14)

# ----
# NÁHODNÁ VELIKOST VEKTORŮ OD FASÁDY
move_4 = Move(Geometry=point_4, Motion=unit_z_4)  # -> Geometry, Transform

# ----
# NÁHODNÉ BODY
c_script_15 = CSharpScript(everywhere=c_script_13, notwindows=move_4.Geometry, limit=number_slider_4)  # -> flatten(a); inputs everywhere: list of Point3d, notwindows: list of Point3d, limit: Double
# ---------- c_script_15: C# ----------
// Grasshopper Script Instance
#region Usings
using System;
using System.Linq;
using System.Collections;
using System.Collections.Generic;
using System.Drawing;

using Rhino;
using Rhino.Geometry;

using Grasshopper;
using Grasshopper.Kernel;
using Grasshopper.Kernel.Data;
using Grasshopper.Kernel.Types;
#endregion

public class Script_Instance : GH_ScriptInstance
{
    private void RunScript(
		List<Point3d> everywhere,
		List<Point3d> notwindows,
		double limit,
		ref object a)
    {
        List<Point3d> pts=new List<Point3d>();


        foreach (Point3d pnw in notwindows){
            double smallest=1e10;
            foreach (Point3d p in everywhere){
                double dx=pnw.X-p.X, dy=pnw.Y-p.Y;
                double d=Math.Sqrt(dx*dx+dy*dy);//pnw.DistanceTo(p);
                if (d<smallest) {
                    smallest=d;
                }
            }
            if (smallest>limit) pts.Add(pnw);
        }

        pts.AddRange(everywhere);

        a = pts;
    }
}
# ---------- end c_script_15 ----------
merge_2 = Merge(Data1=point, Data2=c_script_15)

populate_geometry_5 = PopulateGeometry(Geometry=boundary_surfaces_5, Count=division_10, Seed=number, Points=merge_2)  # -> flatten(Population)

merge_3 = Merge(Data1=populate_geometry_5, Data2=point)

point_6 = Point(merge_3)

seed_6 = Slider(0, range=0..1000)
list_length_5 = ListLength(List=point_6)
mindistance_5 = Slider(1, range=0..1000)

# ---- group: NÁHODNÁ ČÍSLA
c_script_16 = CSharpScript(seed=seed_6, count=list_length_5)  # -> numbers; inputs seed: Int32, count: Int32; same code as c_script_5

# ----
c_script_17 = CSharpScript(pts_boundary=flatten(control_points_5.Points), pts_rnd=flatten(point_6), x=addition_3)  # -> smoothValues; inputs pts_boundary: list of Point3d, pts_rnd: list of Point3d, x: Double; same code as c_script
graph_mapper_5 = GraphMapper(c_script_17, x0=0, x1=1, y0=0, y1=1, container_name="Sine", Equation_px=[0, 1], Equation_py=[0, 1])

multiplication_14 = Multiplication(A=c_script_16, B=multiplication_5)
addition_8 = Addition(A=multiplication_14, B=mindistance_5)

multiplication_15 = Multiplication(A=addition_8, B=graph_mapper_5)

c_script_18 = CSharpScript(x=multiplication_15, n=min_odsazeni)  # -> a; inputs x: Double, n: Double; same code as c_script_9

unit_z_5 = UnitZ(Factor=c_script_18)

# ----
# NÁHODNÁ VELIKOST VEKTORŮ OD FASÁDY
move_5 = Move(Geometry=point_6, Motion=unit_z_5)  # -> Geometry, Transform

c_script_19 = CSharpScript(everywhere=c_script_15, notwindows=move_5.Geometry, limit=Slider(800, range=0..1000))  # -> flatten(a); inputs everywhere: list of Point3d, notwindows: list of Point3d, limit: Double; same code as c_script_15
rndpts = ClusterOutput(c_script_19)

# ==== cluster Cluster_4
dirflip = ClusterInput()
xflip = ClusterInput()
yflip = ClusterInput()
surfstoadd = ClusterInput()
rectangle = ClusterInput()
triangles = ClusterInput()
rectangle_2 = Rectangle(rectangle)
deconstruct_brep = DeconstructBrep(Brep=triangles)  # -> Faces, Edges, Vertices
bounding_box = BoundingBox(Content=rectangle_2, Plane=PlaneXY(0, 0, 0))  # -> Box, Box_2

c_script = CSharpScript(pts=deconstruct_brep.Vertices, surfs=surfstoadd, rec=bounding_box.Box, xFlip=xflip, yFlip=yflip)  # -> inside, u, v, z; inputs pts: list of Point3d, surfs: list of Surface, rec: list, xFlip: list of Boolean, yFlip: list of Boolean
# ---------- c_script: C# ----------
#region Usings
using System;
using System.Linq;
using System.Collections;
using System.Collections.Generic;
using System.Drawing;

using Rhino;
using Rhino.Geometry;

using Grasshopper;
using Grasshopper.Kernel;
using Grasshopper.Kernel.Data;
using Grasshopper.Kernel.Types;
#endregion

public class Script_Instance : GH_ScriptInstance {

    private void RunScript(
		List<Point3d> pts,
		List<Surface> surfs,
		List<object> rec,
		List<bool> xFlip,
		List<bool> yFlip,
		ref object inside,
		ref object u,
		ref object v,
		ref object z)
    {
        
        double tol=1;
        List<Surface> listInside=new List<Surface>();

        // seznamy pro vrácení
        List<object> listU=new List<object>(), 
                     listV=new List<object>(), 
                     listZ=new List<object>();
    
        foreach (Point3d p in pts) {
            Surface seach=null;
            object uu=null, vv=null;

            for (int i=0; i<rec.Count; i++) {
                BoundingBox b = ((Box)rec[i]).BoundingBox;

                // najít bod v mapované oblasti k mapování
                if (p.X<b.Max.X+tol && p.Y<b.Max.Y+tol && p.X>b.Min.X-tol && p.Y>b.Min.Y-tol) {
                    seach=surfs[i];
                    
                    if (xFlip[i]) uu=1-(p.X-b.Min.X)/(b.Max.X-b.Min.X);
                    else uu=(p.X-b.Min.X)/(b.Max.X-b.Min.X); 
                    vv=!yFlip[i] ? (p.Y-b.Min.Y)/(b.Max.Y-b.Min.Y): 1-(p.Y-b.Min.Y)/(b.Max.Y-b.Min.Y);                    
                    break;
                }
            }

            listInside.Add(seach);
            
            listZ.Add(p.Z);
            listU.Add(uu);
            listV.Add(vv);
        }

        u = listU;
        v = listV;
        z = listZ;
        inside = listInside;
    }
}
# ---------- end c_script ----------
parameter_point_on_surface = ParameterPointOnSurface(Surface=c_script.inside, ParameterU=c_script.v, ParameterV=c_script.u)  # -> Point, Normal

# ----
# NAMAPOVAT BODY
# UPRAVIT SMĚR PLOCHY
multiplication = Multiplication(A=parameter_point_on_surface.Normal, B=c_script.z)
c_script_2 = CSharpScript(surfaces=surfstoadd, flips=dirflip, selected=c_script.inside)  # -> a; inputs surfaces: list of Brep, flips: list of Boolean, selected: Brep
# ---------- c_script_2: C# ----------
// Grasshopper Script Instance
#region Usings
using System;
using System.Linq;
using System.Collections;
using System.Collections.Generic;
using System.Drawing;

using Rhino;
using Rhino.Geometry;

using Grasshopper;
using Grasshopper.Kernel;
using Grasshopper.Kernel.Data;
using Grasshopper.Kernel.Types;
#endregion

public class Script_Instance : GH_ScriptInstance
{
    #region Notes
    /* 
      Members:
        RhinoDoc RhinoDocument
        GH_Document GrasshopperDocument
        IGH_Component Component
        int Iteration

      Methods (Virtual & overridable):
        Print(string text)
        Print(string format, params object[] args)
        Reflect(object obj)
        Reflect(object obj, string method_name)
    */
    #endregion

    private void RunScript(
		List<Brep> surfaces,
		List<bool> flips,
		Brep selected,
		ref object a)
    {
        for (int i=0; i<surfaces.Count; i++){
            bool exist=true;
            foreach (var v2 in surfaces[i].Vertices){
                bool found=false;
                foreach (var v1 in selected.Vertices){      
                    if (v1.Location.DistanceTo(v2.Location)<1) {          
                        found=true;
                        break;       
                    }         
                }
                if (!found){
                    exist=false;
                    break;
                }
            }
            
            if (exist) {
                if (flips[i]) a=-1;else a=1;               
                return;
            }
        }
    }
}
# ---------- end c_script_2 ----------
multiplication_2 = Multiplication(A=multiplication, B=c_script_2)

move = Move(Geometry=parameter_point_on_surface.Point, Motion=multiplication_2)  # -> Geometry, Transform

removedups = CSharpScript(pts=flatten(parameter_point_on_surface.Point), vecs=flatten(multiplication_2))  # -> lines; inputs pts: list of Point3d, vecs: list of Vector3d
# ---------- removedups: C# ----------
#region Usings
using System;
using System.Linq;
using System.Collections;
using System.Collections.Generic;
using System.Drawing;

using Rhino;
using Rhino.Geometry;

using Grasshopper;
using Grasshopper.Kernel;
using Grasshopper.Kernel.Data;
using Grasshopper.Kernel.Types;
#endregion

public class Script_Instance : GH_ScriptInstance {
    static double tol=1e-8;

    private void RunScript(List<Point3d> pts, List<Vector3d> vecs, ref object lines) {
        // Kontrola vstupu
        if (pts.Count!=vecs.Count) throw new Exception("Input není souhlasný");

        List<Line> outLines=new List<Line>();

        for (int i=0; i<pts.Count; i++) {
            Point3d pt=pts[i];
            Vector3d vec=vecs[i];
       
            bool exists=false;
            foreach (Line l in outLines) {
                Point3d p=l.From;
                if (p.X-pt.X<tol && p.Y-pt.Y<tol && p.Z-pt.Z<tol) {
                    exists=true;
                    break;
                }
            }

            if (!exists) outLines.Add(new Line(pt, vec));            
        }

        lines = outLines;
    }
}
# ---------- end removedups ----------
lines = ClusterOutput(removedups)

# ---- group: Rozdělit body podle počtu
c_script_3 = CSharpScript(x=move.Geometry)  # -> BasicShapes, AdvancedShapes; inputs x: list of Point3d
# ---------- c_script_3: C# ----------
#region Usings
using System;
using System.Linq;
using System.Collections;
using System.Collections.Generic;
using System.Drawing;

using Rhino;
using Rhino.Geometry;

using Grasshopper;
using Grasshopper.Kernel;
using Grasshopper.Kernel.Data;
using Grasshopper.Kernel.Types;
#endregion

public class Script_Instance : GH_ScriptInstance {
    private void RunScript(
		List<Point3d> x,
		ref object BasicShapes,
		ref object AdvancedShapes) {
        if (x!=null) {
            if (x.Count<=4) BasicShapes = x;
            else AdvancedShapes=x;
        }
    }
}
# ---------- end c_script_3 ----------

# ----
point = Point(c_script_3.BasicShapes)
# PŘEVÉST >4 BODŮ NA PLOCHY
panel = Panel("3")
list_item = ListItem(List=point, Index="0", Wrap=True)
list_item_2 = ListItem(List=point, Index="1", Wrap=True)
list_item_3 = ListItem(List=point, Index="2", Wrap=True)
list_item_4 = ListItem(List=point, Index=panel, Wrap=True)
_4point_surface = _4PointSurface(CornerA=list_item, CornerB=list_item_2, CornerC=list_item_3, CornerD=list_item_4)  # -> flatten(Surface)

clean_tree = CleanTree(RemoveNulls="true", RemoveInvalid=True, RemoveEmpty="true", Tree=c_script_3.AdvancedShapes)
polyline = PolyLine(Vertices=clean_tree, Closed="true")
control_points = ControlPoints(Curve=polyline)  # -> Points, Weights, Knots

average = Average(Input=control_points.Points)  # -> flatten(ArithmeticMean)
# (mimo rovinu)
# NALEZENÍ ROVINY
c_script_4 = CSharpScript(x=control_points.Points, c=graft(average))  # -> a; inputs x: list of Point3d, c: Point3d
# ---------- c_script_4: C# ----------
// Grasshopper Script Instance
#region Usings
using System;
using System.Linq;
using System.Collections;
using System.Collections.Generic;
using System.Drawing;

using Rhino;
using Rhino.Geometry;

using Grasshopper;
using Grasshopper.Kernel;
using Grasshopper.Kernel.Data;
using Grasshopper.Kernel.Types;
#endregion

public class Script_Instance : GH_ScriptInstance
{
    #region Notes
    /* 
      Members:
        RhinoDoc RhinoDocument
        GH_Document GrasshopperDocument
        IGH_Component Component
        int Iteration

      Methods (Virtual & overridable):
        Print(string text)
        Print(string format, params object[] args)
        Reflect(object obj)
        Reflect(object obj, string method_name)
    */
    #endregion

    private void RunScript(List<Point3d> x, Point3d c, ref object a)
    {
        var s= x.OrderBy(i=>c.DistanceTo(i)).Reverse().ToList();
        a=s.GetRange(0, 3);
       // ;
    }
}
# ---------- end c_script_4 ----------
plane_fit = PlaneFit(Points=c_script_4)  # -> Plane, Deviation

plane_closest_point = PlaneClosestPoint(Point=control_points.Points, Plane=plane_fit.Plane)  # -> Point, UVPoint, Distance
polyline_2 = PolyLine(Vertices=plane_closest_point.Point, Closed="true")
boundary_surfaces = BoundarySurfaces(Edges=polyline_2)  # -> flatten(Surfaces)

# ----
# PŘEVÉST 3-4 BODY NA PLOCHY
merge = Merge(Data1=_4point_surface, Data2=boundary_surfaces)

surfaces = ClusterOutput(merge)

# ==== cluster Cluster_5
rectangle = ClusterInput()
brep = ClusterInput()
surface = ClusterInput()
dirflip = ClusterInput()
xflip = ClusterInput()
yflip = ClusterInput()
rectangle_2 = Rectangle(rectangle)
surface_2 = Surface(surface)
deconstruct_brep = DeconstructBrep(Brep=brep)  # -> Faces, Edges, Vertices
bounding_box = BoundingBox(Content=rectangle_2, Plane=PlaneXY(0, 0, 0))  # -> Box, Box_2

# ---- group: MAPOVÁNÍ
c_script = CSharpScript(pts=deconstruct_brep.Vertices, surfs=surface_2, rec=bounding_box.Box, f=xflip, f2=yflip)  # -> inside, u, v, z; inputs pts: list of Point3d, surfs: list of Surface, rec: list, f: list of Boolean, f2: list of Boolean
# ---------- c_script: C# ----------
// Grasshopper Script Instance
#region Usings
using System;
using System.Linq;
using System.Collections;
using System.Collections.Generic;
using System.Drawing;

using Rhino;
using Rhino.Geometry;

using Grasshopper;
using Grasshopper.Kernel;
using Grasshopper.Kernel.Data;
using Grasshopper.Kernel.Types;
#endregion

public class Script_Instance : GH_ScriptInstance
{

    private void RunScript(
		List<Point3d> pts,
		List<Surface> surfs,
		List<object> rec,
		List<bool> f,
		List<bool> f2,
		ref object inside,
		ref object u,
		ref object v,
		ref object z)
    {
      //  Rectangle3d copyRect=new Rectangle3d();
     //  Rectangle3d grec= ((Rectangle3d)rec);
     // 
 double tol=1;
        List<Surface> listInside=new List<Surface>();
        List<object> listU=new List<object>();
        List<object> listV=new List<object>();
        List<object> listZ=new List<object>();
    
         //   Brep loc=null;
         //   int n=-1;
         //   BoundingBox bb=new BoundingBox();

        foreach (Point3d p in pts){
            Surface seach=null;
            object uu=null,vv=null;

            for (int i=0; i<rec.Count; i++){
                BoundingBox b = ((Box)rec[i]).BoundingBox;
                // var b=r.BoundingBox;  
               /* if (p.X<b.Min.X && p.Y<b.Min.Y && p.X>b.Max.X && p.Y>b.Max.Y){
                    seach=surfs[i];
                    if (f[i]) uu=1-(p.X-b.Min.X)/(b.Max.X-b.Min.X);
                    else uu=(p.X-b.Min.X)/(b.Max.X-b.Min.X);
                    vv=!f2[i] ? (p.Y-b.Min.Y)/(b.Max.Y-b.Min.Y): 1-(p.Y-b.Min.Y)/(b.Max.Y-b.Min.Y);
                    break;
                }*/

                if (p.X<b.Max.X+tol && p.Y<b.Max.Y+tol && p.X>b.Min.X-tol && p.Y>b.Min.Y-tol){
                    seach=surfs[i];
                    if (f[i]) uu=1-(p.X-b.Min.X)/(b.Max.X-b.Min.X);
                    else uu=(p.X-b.Min.X)/(b.Max.X-b.Min.X); 
                    vv=!f2[i] ? (p.Y-b.Min.Y)/(b.Max.Y-b.Min.Y): 1-(p.Y-b.Min.Y)/(b.Max.Y-b.Min.Y);
                    
                    break;
                }

              /*  if (p.X<r.X.T0) continue;  
                if (p.Y<r.Y.T0) continue;  
                if (p.X>r.X.T1) continue;  
                if (p.Y>r.Y.T1) continue;  */ 

                //b.
               
              //  Point3d pt=b.ClosestPoint(p);
               // if (pt.DistanceTo(p)<1) {
               //     loc=b;    
              //      break;;
            //    }
            }
         //   ((Surface)surfs[n]).PointAt()listInside.Add(null);
         if (seach != null){
           listInside.Add(seach);
            
        listZ.Add(p.Z);
        listU.Add(uu);
        listV.Add(vv);
         }
     
    }

       u=listU;
       v=listV;
       z= listZ;
        inside = listInside;
      //  x = listInsideX;
      //  y = listInsideY;
    }
}
# ---------- end c_script ----------

# ----
# PŘEVÉST >4 BODŮ NA PLOCHY
number_slider = Slider(9, range=0..10)

# ----
# POSUNUTÍ OD FASÁDY
# UPRAVIT SMĚR PLOCHY
parameter_point_on_surface = ParameterPointOnSurface(Surface=c_script.inside, ParameterU=c_script.u, ParameterV=c_script.v)  # -> Point, Normal

# ----
# NAMAPOVAT BODY
multiplication = Multiplication(A=parameter_point_on_surface.Normal, B=c_script.z)
c_script_2 = CSharpScript(surfaces=surface_2, flips=dirflip, selected=c_script.inside)  # -> a; inputs surfaces: list of Brep, flips: list of Boolean, selected: Brep
# ---------- c_script_2: C# ----------
#region Usings
using System;
using System.Linq;
using System.Collections;
using System.Collections.Generic;
using System.Drawing;

using Rhino;
using Rhino.Geometry;

using Grasshopper;
using Grasshopper.Kernel;
using Grasshopper.Kernel.Data;
using Grasshopper.Kernel.Types;
#endregion

public class Script_Instance : GH_ScriptInstance
{
    private void RunScript(
		List<Brep> surfaces,
		List<bool> flips,
		Brep selected,
		ref object a)
    {
        for (int i=0; i<surfaces.Count; i++){
            bool exist=true;
            foreach (var v2 in surfaces[i].Vertices) {
                bool found=false;
                if (selected==null) throw new Exception("selected is null");
                foreach (var v1 in selected.Vertices) {      
                    if (v1.Location.DistanceTo(v2.Location)<1) {          
                        found=true;
                        break;       
                    }         
                }
                if (!found) {
                    exist=false;
                    break;
                }
            }
            
            if (exist) {
                if (flips[i]) a=-1; else a=1;               
                return;
            }
        }
    }
}
# ---------- end c_script_2 ----------
multiplication_2 = Multiplication(A=multiplication, B=c_script_2)

move = Move(Geometry=parameter_point_on_surface.Point, Motion=multiplication_2)  # -> Geometry, Transform

# ---- group: ODSTUPY OD FASÁDY
removedups = CSharpScript(pts=parameter_point_on_surface.Point, vecs=multiplication_2)  # -> flatten(lines); inputs pts: list of Point3d, vecs: list of Vector3d
# ---------- removedups: C# ----------
#region Usings
using System;
using System.Linq;
using System.Collections;
using System.Collections.Generic;
using System.Drawing;

using Rhino;
using Rhino.Geometry;

using Grasshopper;
using Grasshopper.Kernel;
using Grasshopper.Kernel.Data;
using Grasshopper.Kernel.Types;
#endregion

public class Script_Instance : GH_ScriptInstance {
    static double tol=1e-1;

    private void RunScript(List<Point3d> pts, List<Vector3d> vecs, ref object lines) {
        // Kontrola vstupu
        if (pts.Count!=vecs.Count) throw new Exception("Input není souhlasný");

        List<Line> outLines=new List<Line>();

        for (int i=0; i<pts.Count; i++) {
            Point3d pt=pts[i];
            Vector3d vec=vecs[i];
       
            bool exists=false;
            foreach (Line l in outLines) {
                Point3d p=l.From;
                if (p.X-pt.X<tol && p.Y-pt.Y<tol && p.Z-pt.Z<tol) {
                    exists=true;
                    break;
                }
            }

            if (!exists) outLines.Add(new Line(pt, vec));            
        }

        lines = outLines;
    }
}
# ---------- end removedups ----------

# ----
lines = ClusterOutput(removedups)

# ---- group: Rozdělit body podle počtu
c_script_3 = CSharpScript(x=move.Geometry)  # -> BasicShapes, AdvancedShapes; inputs x: list of Point3d
# ---------- c_script_3: C# ----------
#region Usings
using System;
using System.Linq;
using System.Collections;
using System.Collections.Generic;
using System.Drawing;

using Rhino;
using Rhino.Geometry;

using Grasshopper;
using Grasshopper.Kernel;
using Grasshopper.Kernel.Data;
using Grasshopper.Kernel.Types;
#endregion

public class Script_Instance : GH_ScriptInstance {
    private void RunScript(
		List<Point3d> x,
		ref object BasicShapes,
		ref object AdvancedShapes) {
        if (x!=null) {
            if (x.Count==4 || x.Count==3) BasicShapes = x;
            else AdvancedShapes=x;
        }
    }
}
# ---------- end c_script_3 ----------

# ----
clean_tree = CleanTree(RemoveNulls="true", RemoveInvalid="true", RemoveEmpty="true", Tree=c_script_3.AdvancedShapes)
panel = Panel(clean_tree)

point = Point(c_script_3.BasicShapes)
list_item = ListItem(List=point, Index="0", Wrap=True)
list_item_2 = ListItem(List=point, Index="1", Wrap=True)
list_item_3 = ListItem(List=point, Index="2", Wrap=True)
list_item_4 = ListItem(List=point, Index="3", Wrap=True)
_4point_surface = _4PointSurface(CornerA=list_item, CornerB=list_item_2, CornerC=list_item_3, CornerD=list_item_4)  # -> flatten(Surface)

clean_tree_2 = CleanTree(RemoveNulls="true", RemoveInvalid="true", RemoveEmpty="true", Tree=clean_tree)
polyline = PolyLine(Vertices=clean_tree_2, Closed="true")
control_points = ControlPoints(Curve=polyline)  # -> Points, Weights, Knots

average = Average(Input=control_points.Points)  # -> flatten(ArithmeticMean)
c_script_4 = CSharpScript(x=control_points.Points, c=graft(average))  # -> a; inputs x: list of Point3d, c: Point3d; same code as c_script_4
plane_fit = PlaneFit(Points=c_script_4)  # -> Plane, Deviation

list_item_5 = ListItem(List=polyline, Index=number_slider, Wrap=True)

plane_closest_point = PlaneClosestPoint(Point=control_points.Points, Plane=plane_fit.Plane)  # -> Point, UVPoint, Distance
polyline_2 = PolyLine(Vertices=plane_closest_point.Point, Closed="true")
boundary_surfaces = BoundarySurfaces(Edges=polyline_2)  # -> flatten(Surfaces)

list_length = ListLength(List=plane_closest_point.Point)  # -> flatten(Length); disabled
# (mimo rovinu)
# NALEZENÍ ROVINY
series = Series(Start=0, Step=1, Count=list_length)
removeduplicatepts = RemoveDuplicatePts(Points=plane_closest_point.Point, Tolerance=0.01)  # disabled
text_tag = TextTag(Location=plane_closest_point.Point, Text=series, Colour=ColourSwatch(SwatchColor=RGB(255, 255, 255)))

# ----
# PŘEVÉST 3-4 BODY NA PLOCHY
merge = Merge(Data1=_4point_surface, Data2=boundary_surfaces)  # -> flatten(Result)

surfaces = ClusterOutput(merge)

# ==== cluster Cluster_6
ptswindows = ClusterInput()
surface = ClusterInput()
lines = ClusterInput()
radius = ClusterInput()

# ---- group: NE PODPORY V OKNECH
c_script = CSharpScript(points=ptswindows, lines=lines)  # -> outLines; inputs points: list of Point3d, lines: list of Line
# ---------- c_script: C# ----------
#region Usings
using System;
using System.Linq;
using System.Collections;
using System.Collections.Generic;
using System.Drawing;

using Rhino;
using Rhino.Geometry;

using Grasshopper;
using Grasshopper.Kernel;
using Grasshopper.Kernel.Data;
using Grasshopper.Kernel.Types;
#endregion

public class Script_Instance : GH_ScriptInstance {
    static double tol=1;

    private void RunScript(
		List<Point3d> points,
		List<Line> lines,
		ref object outLines) {

        List<Line> linesNotOnWindow=new List<Line>();
        
        foreach (Line l in lines) {
            bool OnWindow=false;
            foreach (Point3d p in points) {
             /*   if (p.DistanceTo(l.From)<tol) {
                    OnWindow=true;
                    break;
                }
                if (p.DistanceTo(l.To)<tol) {
                    OnWindow=true;
                    break;
                }*/
                var c=l.ClosestPoint(p, true);
                if (c.DistanceTo(p)<tol) {
                    OnWindow=true;
                    break;
                }
            }

            if (OnWindow) linesNotOnWindow.Add(l);
        }
        outLines = linesNotOnWindow;
    }
}
# ---------- end c_script ----------

# ----
# PŘIPOJENÍ K FASÁDĚ
removeduplicatelines = RemoveDuplicateLines(Lines=c_script, Tolerance=0.01)  # -> flatten(UniqueLines)
pipe = Pipe(Curve=removeduplicatelines, Radius=radius, Caps=0)  # -> flatten(Pipe); disabled

parameter_pipe_mesh = ParameterPipeMesh(
    Curve=removeduplicatelines,
    Radius=radius,
    ParametersU=[0, 0.1, 0.2, 0.3, 0.4, 0.5, 0.6, 0.7, 0.8, 0.9, 1],
    ParametersV=[0, 0.25, 0.5, 0.75, 1],
    Weighted=False,
    Lengths=False,
    Angle=0,
    Rotation=0,
    EndType=0,
    Triangulate=False)
geometry = ClusterOutput(removeduplicatelines)

# ----
# Brep se vykresluje jako Mesh
# (aby se nezobrazily artefakty hran)
panel = Panel("2")

addition = Addition(A=radius, B=panel)

# ----
# PODPORNÁ KONSTRUKCE PRŮSVITNÉ FASÁDY
multiplication = Multiplication(A=addition, B=-1)
offset_surface = OffsetSurface(Surface=surface, Distance=multiplication, Retrim=True)
deconstruct_brep = DeconstructBrep(Brep=offset_surface)  # -> Faces, flatten(Edges), Vertices
pipe_2 = Pipe(Curve=deconstruct_brep.Edges, Radius=radius, Caps=0)  # -> flatten(Pipe)
merge = Merge(Data1=pipe_2, Data2=parameter_pipe_mesh)

merge_2 = Merge(Data1=deconstruct_brep.Edges, Data2=removeduplicatelines)
geometry_2 = ClusterOutput(merge)
geometry_3 = ClusterOutput(merge_2)
